# Grasshopper definition Chengdu solver -evenly.gh (Grasshopper 1.0.5)
# plug-ins: Human

# ----
# X
# Y
panel = Panel("GeneList X")
number_slider = Slider(12, range=1..60)
genelist_x = GenePool(Decimals=0, Maximum=200, Minimum=0, Value=[102, 81, 150, 61, 138, 132, 91, 105, 113, 152, 92, 76])
genelist_y = GenePool(Decimals=0, Maximum=200, Minimum=0, Value=[67, 91, 57, 65, 81, 115, 81, 131, 64, 111, 111, 123])
cluster = Cluster_7(X=genelist_x, Y=genelist_y, threshold=number_slider)
vb = VBScript(genelist=panel, count=number_slider)  # -> out, A
# ---------- vb: VB ----------
    For Each obj As IGH_DocumentObject In owner.OnPingDocument().Objects
      If (obj.ComponentGuid <> New Guid("{21553c44-ea62-475e-a8bb-62b2a3ee5ca5}")) Then Continue For
      If (obj.NickName Like genelist) Then
        CallByName(obj, "Count", CallType.Set, count)
        'CallByName(obj, "ExpireSolution", CallType.Method, False)
        Return
      End If
    Next

    Print("No matching Gene list object found")
# ---------- end vb ----------
vb_2 = VBScript(genelist="GeneList Y", count=number_slider)  # -> out, A; same code as vb

# ----
# Spatial demand surface
data = Data(flatten(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))

# ----
# Parameters
# Cells
data_2 = Data(flatten([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]))

# ----
# EVENLY
days = Slider(365, range=0..1000)
life_time = Slider(20, range=0..100)

# ---- group: Globle control
point_color = ColourSwatch(SwatchColor=RGB(0, 0, 0))
line_color = ColourSwatch(SwatchColor=RGB(95, 78, 85))
thickness = Slider(0.5, range=0..10)

# ----
point_color_2 = Data(point_color)

# ---- group: Thickness
data_3 = Data(Slider(1, range=0..1))

# ---- group: Line Color
data_4 = Data(line_color)

# ----
# Solver
galapagos = Galapagos(fitness=cluster_10, gene=[genelist_y, genelist_x])

# ---- group: Wirte & Read data
output = DataOutput()
input = DataInput()

# ----
# Distribution of Facilities
cluster_2 = Cluster_8(facility_points=cluster, residential_cells=data_2, facility_number=number_slider)  # -> links_evenly, links_unevenly
cluster_3 = Cluster_12(linksfrompython=cluster_2.links_evenly)  # -> facility_locations, facility_capacity, total_capacity_for_check, linkages, directtransportdistance
cluster_4 = Cluster_13(spatial_demand_surface=data, facility_location=cluster_3.facility_locations)
viewer = ParamViewer(cluster_3.facility_locations)
panel_2 = Panel(cluster_3.facility_capacity)

# ---- group: ActualRoutes
cluster_5 = Cluster_11(residential_cells=data_2, facility_points=cluster, wantedpath=cluster_3.linkages, routesindex=Slider(53, range=0..100))  # -> transportroutes, actualtransportdistance, preview_of_a_single_route

# ----
division = Division(A=cluster_5.actualtransportdistance, B=cluster_3.directtransportdistance)
panel_3 = Panel(division)

# ---- group: Material revenue
cluster_6 = Cluster_6(facility_capacity=cluster_3.facility_capacity, days=days)  # -> paper_revenue, glass_revenue, ferrous_revenue, alum_revenue, plastic_revenue, recovered_organic_waste

# ----
# Evaluation
# 1. Calculation of Cost per Year
coefficients = Coefficients(
    land_price_for_each_facility=cluster_4,
    transportation_distance=cluster_5.actualtransportdistance,
    facility_capacity=cluster_3.facility_capacity,
    function_days_per_year=days,
    life_time=life_time)  # -> indoor_floor_area, cost_of_construction_per_year, required_land_area, cost_of_land_lease_per_year, consumption_of_diesel_per_year, cost_of_diesel_per_year, consumption_of_electricity_per_year, cost_of_electricity_per_year, cost_of_equipment_per_year
ma = MassAddition(Input=coefficients.indoor_floor_area)  # -> Result, PartialResults
ma_2 = MassAddition(Input=coefficients.required_land_area)  # -> Result, PartialResults

# ---- group: Diesel
number_slider_2 = Slider(1, range=0..1)
# 2. Calculation of Airborne Emissions per Year
# Total Airborne Emission per Year
cluster_7 = Cluster(consumption_of_diesel_per_year=coefficients.consumption_of_diesel_per_year, year=number_slider_2)  # -> co2_emission_ton, ch4_emission_ton, n2o_emission_ton

# ---- group: Electricity
# 3. Calculation of Material Revenue per Year
cluster_8 = Cluster_2(consumption_of_electricity_per_year=coefficients.consumption_of_electricity_per_year, year=number_slider_2)  # -> co2_emission_ton, ch4_emission_ton, n2o_emission_ton

# ---- group: Total revenue(euro)
merge = Merge(
    Data1=cluster_6.paper_revenue,
    Data2=cluster_6.glass_revenue,
    Data3=cluster_6.ferrous_revenue,
    Data4=cluster_6.alum_revenue,
    Data5=cluster_6.plastic_revenue)
ma_3 = MassAddition(Input=merge)  # -> Result, PartialResults
panel_4 = Panel(ma_3.Result)

# ---- group: Total CO2(ton)
merge_2 = Merge(Data1=flatten(cluster_7.co2_emission_ton), Data2=flatten(cluster_8.co2_emission_ton))
ma_4 = MassAddition(Input=merge_2)  # -> Result, PartialResults

# ---- group: Total CH4(ton)
merge_3 = Merge(Data1=flatten(cluster_7.ch4_emission_ton), Data2=flatten(cluster_8.ch4_emission_ton))
ma_5 = MassAddition(Input=merge_3)  # -> Result, PartialResults

# ---- group: Total N2O(ton)
merge_4 = Merge(Data1=flatten(cluster_7.n2o_emission_ton), Data2=flatten(cluster_8.n2o_emission_ton))
ma_6 = MassAddition(Input=merge_4)  # -> Result, PartialResults

# ----
# Efficiency of highly automated sorting system %
# 
# Paper 50-75
# Glass 80-90
# Ferrous 90-95
# Aluminium 90-95
# Plastic 75-90
# organic 80-90
# Material revenue (euro/Mg)
# 
# Paper 70
# Glass 23
# Ferrous 120
# Aluminium 1250
# Plastic 330
# organic: depends on biodegestion
panel_5 = Panel(cluster_6.recovered_organic_waste)

# ----
# Total Cost per Year
merge_5 = Merge(
    Data1=flatten(coefficients.cost_of_construction_per_year),
    Data2=flatten(coefficients.cost_of_land_lease_per_year),
    Data3=flatten(coefficients.cost_of_diesel_per_year),
    Data4=flatten(coefficients.cost_of_electricity_per_year),
    Data5=flatten(coefficients.cost_of_equipment_per_year))
ma_7 = MassAddition(Input=merge_5)  # -> Result, PartialResults
panel_6 = Panel(ma_7.Result)

# ---- group: CH4
expression = Expression(x=ma_5.Result, Expression="25*x")

# ---- group: N2O
expression_2 = Expression(x=ma_6.Result, Expression="298*x")

# ---- group: CO2
expression_3 = Expression(x=ma_4.Result, Expression="1*x")

# ---- group: FPoints
# Preview Sovler
data_5 = Data(cluster_3.facility_locations)

# ---- group: Capacity
data_6 = Data(cluster_3.facility_capacity)

# ---- group: llinkage
data_7 = Data(cluster_3.linkages)

# ---- group: refer to landprice
data_8 = Data(coefficients.cost_of_land_lease_per_year)

# ----
sqrt = SquareRoot(Value=data_6)
cir = Circle(Plane=data_5, Radius=expr("x/40", sqrt))
boundary = BoundarySurfaces(Edges=cir)
preview = CustomPreview(Geometry=boundary, Material=point_color_2)
previewlw = CustomPreviewLineweights(Geometry=data_7, Shader=data_4, Thickness=data_3, Absolute=False)

# ----
# Global Warming Potentials (GWPs)
# 100-year GWP :
# 
# CO2: 1
# CH4: 25
# N2O: 298
ma_8 = MassAddition(Input=[expression_3, expression, expression_2])  # -> Result, PartialResults
panel_7 = Panel(ma_8.Result)

# ----
# Weighted Value
division_2 = Division(A=coefficients.cost_of_land_lease_per_year, B=coefficients.cost_of_diesel_per_year)
panel_8 = Panel(division_2)
multiplication = Multiplication(A=coefficients.cost_of_diesel_per_year, B=3)

# ---- group: refer to distance
data_9 = Data(multiplication)

# ----
addition = Addition(A=data_8, B=data_9)
panel_9 = Panel(addition)

# ----
# Results
cluster_9 = Cluster_14(stream=panel_6, threshold="56000000")
cluster_10 = Cluster_14(stream=panel_9, threshold="34000000")
cluster_11 = Cluster_14(stream=panel_7, threshold="56000")
entwine = Entwine(
    Branch00=cluster_3.facility_locations,
    Branch01=cluster_3.facility_capacity,
    Branch02=cluster_3.linkages,
    Branch03=cluster_3.directtransportdistance,
    Branch04=cluster_5.actualtransportdistance,
    Branch05=cluster_5.transportroutes,
    Branch06=cluster_9,
    Branch07=cluster_11,
    Branch08=panel_4,
    Branch09=panel_5,
    Branch010=cluster_10,
    FlattenInputs=True)

# ----
# Done
# Done
# All the results have been recorded into the database by using the component
viewer_2 = ParamViewer(entwine)
panel_10 = Panel(entwine)

# ==== cluster Coefficients
land_price_for_each_facility = ClusterInput()  # euro/m2 per year
transportation_distance = ClusterInput()
facility_capacity = ClusterInput()
function_days_per_year = ClusterInput()
life_time = ClusterInput()

# ---- group: Indoor Floor Area(m2)
expression = Expression(x=facility_capacity, Expression="15.39*x+800")

# ---- group: Electricity Consumption（kwh)
expression_2 = Expression(x=expression, Expression="1.607*0.04*x+0.706*(1-0.04)*x")

# ---- group: Construction Cost 600Euro/m2
expression_3 = Expression(A=expression, Expression="612*A")

# ---- group: Transportation Diesel Consumption（L）
expression_4 = Expression(D=transportation_distance, Expression="D*60*0.0272")

# ---- group: Processing Diesel Consumption(L)
expression_5 = Expression(x=facility_capacity, Expression="0.7*x+4.8")

# ---- group: Equipment Cost(Euro/Mg)
expression_6 = Expression(x=facility_capacity, Expression="2.69*x+200")

# ----
# Diesel Consumption (L)
merge = Merge(Data1=flatten(expression_4), Data2=flatten(expression_5))
mass_addition = MassAddition(Input=flatten(merge))  # -> Result, PartialResults
# Cost of Diesel per Year (euro)
multiplication = Multiplication(A=mass_addition.Result, B=function_days_per_year)

# ----
# Electricity Consumption per Year (L)
mass_addition_2 = MassAddition(Input=flatten(expression_2))  # -> Result, PartialResults
# Cost of Electricity per Year (euro)
multiplication_2 = Multiplication(A=mass_addition_2.Result, B=function_days_per_year)

# ----
# Equipment Cost per Year (euro)
mass_addition_3 = MassAddition(Input=flatten(expression_6))  # -> Result, PartialResults
multiplication_3 = Multiplication(A=mass_addition_3.Result, B=function_days_per_year)

# ----
# Construction Cost per Year (euro)
mass_addition_4 = MassAddition(Input=flatten(expression_3))  # -> Result, PartialResults
division = Division(A=mass_addition_4.Result, B=life_time)

# ---- group: Diesel Cost(euro/L)
E = Expression(D=multiplication, Expression="0.842*D")

# ---- group: Electricity Cost(euro/kwh)
E_2 = Expression(E=multiplication_2, Expression="0.0868*E")

# ---- group: Requied Land Area(m2)
expression_7 = Expression(I=expression, Expression="3*I")

# ----
# Land Cost per Year (euro)
multiplication_4 = Multiplication(LandPrice=land_price_for_each_facility, LandArea=expression_7)
# Indoor Floor Area & Site Area
mass_addition_5 = MassAddition(Input=multiplication_4)  # -> Result, PartialResults

consumption_of_electricity_per_year = ClusterOutput(multiplication_2)  # (kwh)
consumption_of_diesel_per_year = ClusterOutput(multiplication)  # (L)
cost_of_construction_per_year = ClusterOutput(division)  # Total Cost/Life time
# Equipment Cost = 2.69*SUM(capacity)+200*N
# N
cost_of_equipment_per_year = ClusterOutput(multiplication_3)  # Includes purchasing, O&M; equation represents how much will be cost when processing one Mg.
cost_of_land_lease_per_year = ClusterOutput(mass_addition_5.Result)  # (euro)
# N
# 1.607*0.04*x+0.706*(1-0.04)*x=(1.607*0.04+0.706*0.96)*Indoor Floor Area
cost_of_electricity_per_year = ClusterOutput(E_2)  # (euro)
# Location&Linkages
cost_of_diesel_per_year = ClusterOutput(E)  # (euro)
# Cost of Construction= 612* Indoor Floor Area=(15.39*SUM x+800*N)*612
# N
# Required Land Area=(15.39*SUM x+800*N)*3
# Location
# Land price various based on the location
required_land_area = ClusterOutput(expression_7)  # (m2)
# N
# indoor Floor Area=(15.39*x1+800)+(15.39*x2+800)+......(15.39*xn+800)
# =15.39*(x1+x2+x3+...Xn)+800*N
# =15.39*SUM x+800*N
# N
indoor_floor_area = ClusterOutput(expression)

# ==== cluster Cluster
# Emission Factor :
# 
# Diesel fuel
# CO2: (10.21kg/gallon) (2.6975kg/L)
# CH4: (0.57g/gallon)(0.1506g/L)
# N2O: (0.26g/gallon)(0.0687g/L)
consumption_of_diesel_per_year = ClusterInput()
year = ClusterInput()
expression = Expression(x=consumption_of_diesel_per_year, y=year, Expression="0.1506*x*y*0.001*0.001")
expression_2 = Expression(x=consumption_of_diesel_per_year, y=year, Expression="0.0687*x*y*0.001*0.001")
expression_3 = Expression(x=consumption_of_diesel_per_year, y=year, Expression="2.6975*x*y*0.001")
co2_emission_ton = ClusterOutput(expression_3)
ch4_emission_ton = ClusterOutput(expression)
n2o_emission_ton = ClusterOutput(expression_2)

# ==== cluster Cluster_2
# Emission Factor :
# 
# Electricity
# CO2: (1,232.35lb/MWh) (0.55899396kg/KWh)
# CH4: (0.02414lb/MWh)(0.000010949904kg/KWh)
# N2O: (0.01826lb/MWh)(0.000008282736kg/KWh)
consumption_of_electricity_per_year = ClusterInput()
year = ClusterInput()
expression = Expression(x=consumption_of_electricity_per_year, y=year, Expression="0.000008282736*x*y*0.001")
expression_2 = Expression(x=consumption_of_electricity_per_year, y=year, Expression="0.000010949904*x*y*0.001")
expression_3 = Expression(x=consumption_of_electricity_per_year, y=year, Expression="0.55899396*x*y*0.001")
ch4_emission_ton = ClusterOutput(expression_2)
co2_emission_ton = ClusterOutput(expression_3)
n2o_emission_ton = ClusterOutput(expression)

# ==== cluster Cluster_6
facility_capacity = ClusterInput()
days = ClusterInput()  # operating days per year

# ---- group: Efficiency
cluster = Cluster_4(facility_capacity=facility_capacity)  # -> e_paper, e_glass, e_ferrous, e_aluminium, e_plastic, e_organic

# ---- group: Generated Waste per Year
cluster_2 = Cluster_5(facility_capacity=facility_capacity, days=days)  # -> paper_ton, glass_ton, ferrous_ton, alum_ton, plastic_ton, organic_ton

# ---- group: Recoveryed material
multiplication = Multiplication(A=cluster_2.paper_ton, B=cluster.e_paper)
multiplication_2 = Multiplication(A=cluster_2.glass_ton, B=cluster.e_glass)
multiplication_3 = Multiplication(A=cluster_2.ferrous_ton, B=cluster.e_ferrous)
multiplication_4 = Multiplication(A=cluster_2.alum_ton, B=cluster.e_aluminium)
multiplication_5 = Multiplication(A=cluster_2.plastic_ton, B=cluster.e_plastic)
multiplication_6 = Multiplication(A=cluster_2.organic_ton, B=cluster.e_organic)

# ----
expression = Expression(x=multiplication_4, Expression="x*1250")
expression_2 = Expression(x=multiplication_5, Expression="x*330")
expression_3 = Expression(x=multiplication_3, Expression="x*120")
expression_4 = Expression(x=multiplication, Expression="x*70")
expression_5 = Expression(x=multiplication_2, Expression="x*23")

ma = MassAddition(Input=multiplication_6)  # -> Result, PartialResults
ma_2 = MassAddition(Input=expression)  # -> Result, PartialResults
ma_3 = MassAddition(Input=expression_3)  # -> Result, PartialResults
ma_4 = MassAddition(Input=expression_5)  # -> Result, PartialResults
ma_5 = MassAddition(Input=expression_4)  # -> Result, PartialResults
ma_6 = MassAddition(Input=expression_2)  # -> Result, PartialResults
recovered_organic_waste = ClusterOutput(ma.Result)
paper_revenue = ClusterOutput(ma_5.Result)
glass_revenue = ClusterOutput(ma_4.Result)
alum_revenue = ClusterOutput(ma_2.Result)
ferrous_revenue = ClusterOutput(ma_3.Result)
plastic_revenue = ClusterOutput(ma_6.Result)

# ==== cluster Cluster_7
X = ClusterInput()
threshold = ClusterInput()
Y = ClusterInput()

pt = ConstructPoint(XCoordinate=X, YCoordinate=Y, ZCoordinate=0)

# ---- group: Reset origin
data = Data(Vector(11458.03515, 3496.394116, 0))
move = Move(Geometry=pt, Motion=data)  # -> Geometry, Transform

# ----
cset = CreateSet(List=move.Geometry)  # -> Set, Map
lng = ListLength(List=cset.Set)
equals = Equality(FirstNumber=lng, SecondNumber=threshold)  # -> Equality, Inequality
int = Integer(equals.Equality)
gate = StreamGate(Stream=move.Geometry, Gate=int)  # -> Target0, Target1
facility_points = ClusterOutput(gate.Target1)

# ==== cluster Cluster_8
facility_points = ClusterInput()
residential_cells = ClusterInput()
facility_number = ClusterInput()

# ---- group: All of the Residential cells
area = Area(Geometry=residential_cells)  # -> Area, simplify(Centroid)

# ---- group: Number of Controlled RP
lng = ListLength(List=area.Centroid)
division = Division(A=lng, B=facility_number)
addition = Addition(A=division, B=0.5)
# when n<N
# the generated links will be stopped later by stream gate before go into fitness
int = Integer(addition)

# ---- group: FP
pt = Point(facility_points)

# ---- group: RP
pt_2 = Point(area.Centroid)

# ----
viewer = ParamViewer(pt_2)
python = GhPythonScript(FP=pt, RP=pt_2, N=int)  # -> flat_list; inputs FP: list of Point3d, RP: list of Point3d, N: Int32
# ---------- python: Python ----------
__author__ = "W.Luo"
__version__ = "2018.06.23"


import rhinoscriptsyntax as rs
from collections import Counter



def FindClosestFPoints (ResidentialPoints,FacilityPoints):
    CPs=[]
    Ls=[] 

    for i in ResidentialPoints:  # i is a item in list of RP for iteration
        Index=rs.PointArrayClosestPoint(FacilityPoints,i) #rhino function 
        CP=FacilityPoints[Index]   # the closest point in the list of FPoints
        CPs.append(CP) # a list of closest points(FPoints)
        L=rs.AddLine(CP,i) # connect the RP and the closest FP
        Ls.append(L)  # list of all the lines
    # the end of for loop (already caculated all the RP in list)
    ccc=Counter(CPs)  # counting the same value of CPs (list) ccc is a dict
    v=dict.values(ccc) # get all the value from the dict for finding the largest item
    M=max(v) # the largest value
      
    CPs1=ccc.keys()[v.index(M)] #the facility point which has the most connections 
    return M,CPs,CPs1,Ls  #return a list contains M and CPs1 

def list_duplicates_of (seq,item):
    start_at=-1
    locs=[]
    while True:
        try:
            loc=seq.index(item,start_at+1)
        except ValueError:
            break
        else:
            locs.append(loc)
            start_at = loc
    return locs

def SortedPoints (links,CPs_index):
    CPs1_links=[] # all the links that connecting CPs1(the chosen point)
    for j in CPs_index:
        CPs1_link=links[j]
        CPs1_links.append(CPs1_link)
    Ds=[]        # caculate those links' length
    for k in CPs1_links:
        D=rs.CurveLength(k)
        Ds.append(D)
        
    #print Ds  #original curves and length
    NDs=sorted(Ds) # sorting from small to large

    # start from the smallest number choose N smallest lines
    SDs=NDs[0:N]

    Ds_indexs=[] # find the index for those short lines
    for h in SDs:
        Ds_index=Ds.index(h)
        Ds_indexs.append(Ds_index)
    #print Ds_indexs # those links will be exported 
    
    RP_indexs=[]
    for g in Ds_indexs:
        RP_index=CPs_index[g] # I know the index, here i want to get the value
        RP_indexs.append(RP_index)

    return RP_indexs    

Total_links=[]
m=FindClosestFPoints(RP,FP)



while (m[0]>N):
    
    CPs1_index=list_duplicates_of(m[1],m[2]) #find the index for all the CPs1 in list CPs
        # and these index can help to find the corresponding RP and also those links
    a=SortedPoints(m[3],CPs1_index)
    
    #a is the RP_indexs which can be used to find links and points
    #print a
    FRlinks=[] 
    for o in a:
        FRlink=m[3][o]
        FRlinks.append(FRlink)
        
    RP_useds=[]
    for u in a:    
        RP_used=RP[u]
        RP_useds.append(RP_used)
    #print RP_useds
    
    for x in RP_useds:
        RP.remove(x)
        
    #print len(RP)
    
    FP.remove(m[2])
    #print len(FP)
    
    Total_links.append(FRlinks)
    m=FindClosestFPoints(RP,FP)
    
else:
    Total_links.append(m[3])


flat_list = [item for sublist in Total_links for item in sublist]
print len(flat_list)
# ---------- end python ----------
python_2 = GhPythonScript(FP=pt, RP=pt_2, N=facility_number, x=Point(11468.33482, 3501.074805, 0))  # -> links; inputs FP: list of Point3d, RP: list of Point3d; disabled
# ---------- python_2: Python ----------
__author__ = "W.Luo"
__version__ = "2018.06.23"


import rhinoscriptsyntax as rs
from collections import Counter


def FindClosestFPoints (ResidentialPoints,FacilityPoints):
    CPs=[]
    Ls=[] 

    for i in ResidentialPoints:  # i is a item in list of RP for iteration
        Index=rs.PointArrayClosestPoint(FacilityPoints,i) #rhino function 
        CP=FacilityPoints[Index]   # the closest point in the list of FPoints
        CPs.append(CP) # a list of closest points(FPoints)
        L=rs.AddLine(CP,i) # connect the RP and the closest FP
        Ls.append(L)  # list of all the lines
    # the end of for loop (already caculated all the RP in list)
    ccc=Counter(CPs)
    v=dict.values(ccc)
    print v
    return Ls,v  

results=FindClosestFPoints(RP,FP)
links=results[0]
n=len(results[1])
print n

if n<N:
    Nlinks=[]
    for i in links:
        Nlink=rs.ScaleObject(i,x,[0.001,0.001,0.001])
        Nlinks.append(Nlink)
    links=Nlinks
# ---------- end python_2 ----------
links_unevenly = ClusterOutput(python_2)
links_evenly = ClusterOutput(python)

# ==== cluster Cluster_11
residential_cells = ClusterInput()
facility_points = ClusterInput()
wantedpath = ClusterInput()
routesindex = ClusterInput()

# ----
# Infra Curves
crv = Curve([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])

# ----
# Connect facility to nearest infra
cir = Circle(Plane=facility_points, Radius=1)
cluster = Cluster_10(cells=cir, infra_curves=crv)

# ----
# Connect cell to nearest infra
cluster_2 = Cluster_10(cells=residential_cells, infra_curves=crv)

# ----
# Total Infra Curves
merge = Merge(Data1=crv, Data2=cluster_2, Data3=cluster)  # -> flatten(Result)

cluster_3 = Cluster_9(curves=merge)

shortwalk = ShortestWalk(Curves=cluster_3, WantedPath=wantedpath)  # -> flatten(ShortestWalk), Succession, Direction, Length

# ---- group: Mileage
len = Length(Curve=shortwalk.ShortestWalk)  # -> flatten(Length)
ma = MassAddition(Input=len)  # -> Result, PartialResults

# ----
precesion = Precesion(A=ma.Result)

# ----
# ActualTransportation Distances
data = Data(precesion)

panel = Panel(data)

# ----
# Preview single path
item = ListItem(List=shortwalk.ShortestWalk, Index=routesindex, Wrap=True)

preview_of_a_single_route = ClusterOutput(item)
actualtransportdistance = ClusterOutput(data)
transportroutes = ClusterOutput(shortwalk.ShortestWalk)

# ==== cluster Cluster_12
linksfrompython = ClusterInput()
flatten = FlattenTree(Tree=linksfrompython, Path="{0}")
crv = Curve(flatten)
viewer = ParamViewer(crv)
panel = Panel(flatten)
end = EndPoints(Curve=crv)  # -> Start, End

len = Length(Curve=crv)  # -> flatten(Length)
ma = MassAddition(Input=len)  # -> Result, PartialResults
precesion = Precesion(A=ma.Result)

# ---- group: Cull duplicate
cullpt = CullDuplicates(Points=end.Start, Tolerance=0.1, CullMode=1)  # -> Points, Indices, Valence

# ----
multiplication = Multiplication(A=cullpt.Valence, B=60)

# ----
# Facility location
data = Data(cullpt.Points)

viewer_2 = ParamViewer(data)

# ----
# Facility Capacity
data_2 = Data(multiplication)

# ---- group: Total Capacity
ma_2 = MassAddition(Input=data_2)  # -> Result, PartialResults
panel_2 = Panel(ma_2.Result)

# ----
# Direct connection Distances
data_3 = Data(precesion)

panel_3 = Panel(data_3)

# ----
# Linkage
data_4 = Data(crv)

total_capacity_for_check = ClusterOutput(ma_2.Result)
directtransportdistance = ClusterOutput(data_3)
facility_locations = ClusterOutput(data)
facility_capacity = ClusterOutput(data_2)
linkages = ClusterOutput(data_4)

# ==== cluster Cluster_13
spatial_demand_surface = ClusterInput()
facility_location = ClusterInput()

# ---- group: Facility Location
point = Point(facility_location)

# ---- group: Z height range for price surface
panel = Panel("1")
panel_2 = Panel("30")

# ---- group: Landprice in reality
panel_3 = Panel("60")
panel_4 = Panel("20")

# ----
# industrial land price
# one year(euro/m2)
line = LineSDL(Start=point, Direction=Vector(0, 0, 1), Length=200)
# VII.Land price based location (euro/m2)
scx = SurfaceCurve(Surface=spatial_demand_surface, Curve=line)  # -> Curves, flatten(Points), UVPoints, Normals, Parameters, Tangents
pdecon = Deconstruct(Point=scx.Points)  # -> XComponent, YComponent, ZComponent
dom = ConstructDomain(DomainStart=panel, DomainEnd=panel_2)
dom_2 = ConstructDomain(DomainStart=panel_4, DomainEnd=panel_3)
remap = RemapNumbers(Value=pdecon.ZComponent, Source=dom, Target=dom_2)  # -> Mapped, Clipped

landprice_for_each_facility = ClusterOutput(remap.Mapped)

# ==== cluster Cluster_14
stream = ClusterInput()
threshold = ClusterInput()
larger = LargerThan(FirstNumber=stream, SecondNumber=threshold)  # -> LargerThan, OrEqualTo
int = Integer(larger.LargerThan)
gate = StreamGate(Stream=stream, Gate=int)  # -> Target0, Target1
output = ClusterOutput(gate.Target1)

# ==== cluster Cluster_4
facility_capacity = ClusterInput()

# ---- group: E-Paper
cluster = Cluster_3(facility_capacity=facility_capacity, lowest_number="0.50", largest_number="0.75")

# ---- group: E-Glass
cluster_2 = Cluster_3(facility_capacity=facility_capacity, lowest_number="0.80", largest_number="0.90")

# ---- group: E-Aluminium
cluster_3 = Cluster_3(facility_capacity=facility_capacity, lowest_number="0.90", largest_number="0.95")

# ---- group: E-Ferrous
cluster_4 = Cluster_3(facility_capacity=facility_capacity, lowest_number="0.90", largest_number="0.95")

# ---- group: E-Plastic
cluster_5 = Cluster_3(facility_capacity=facility_capacity, lowest_number="0.75", largest_number="0.90")

# ---- group: E-Organic
cluster_6 = Cluster_3(facility_capacity=facility_capacity, lowest_number="0.80", largest_number="0.90")

# ----
e_ferrous = ClusterOutput(cluster_4)
e_aluminium = ClusterOutput(cluster_3)
e_organic = ClusterOutput(cluster_6)
e_plastic = ClusterOutput(cluster_5)
e_paper = ClusterOutput(cluster)
e_glass = ClusterOutput(cluster_2)

# ==== cluster Cluster_5
days = ClusterInput()
facility_capacity = ClusterInput()  # how much waste will be dealt each day
multiplication = Multiplication(TPD=facility_capacity, OperatingDays=days)

# ---- group: Paper(ton)
expression = Expression(x=multiplication, Expression="0.28*x")

# ---- group: Glass(ton)
expression_2 = Expression(x=multiplication, Expression="0.05*x")

# ---- group: Ferrous(ton)
expression_3 = Expression(x=multiplication, Expression="0.07*x")

# ---- group: Alum(ton)
expression_4 = Expression(x=multiplication, Expression="0.01*x")

# ---- group: Plastic(ton)
expression_5 = Expression(x=multiplication, Expression="0.13*x")

# ---- group: Organic(ton)
expression_6 = Expression(x=multiplication, Expression="0.46*x")

# ----
organic_ton = ClusterOutput(expression_6)
ferrous_ton = ClusterOutput(expression_3)
plastic_ton = ClusterOutput(expression_5)
paper_ton = ClusterOutput(expression)
glass_ton = ClusterOutput(expression_2)
alum_ton = ClusterOutput(expression_4)

# ==== cluster Precesion
A = ClusterInput()
multiplication = Multiplication(A=A, B="1000")
integer = Integer(multiplication)
division = Division(A=integer, B="1000")
result = ClusterOutput(division)

# ==== cluster Cluster_9
curves = ClusterInput()
mcx = MultipleCurves(Curves=curves)  # -> Points, IndexA, IndexB, ParamA, ParamB
pt = Point(mcx.Points)
points_split = PointsSplit(Curve=curves, Point=pt, Tolerance=0.001, menu=[slider(0)])  # -> Splits, Parameter
crv = Curve(flatten(points_split.Splits))
splited_curves = ClusterOutput(crv)

# ==== cluster Cluster_10
infra_curves = ClusterInput()
cells = ClusterInput()
area = Area(Geometry=cells)  # -> Area, simplify(graft(Centroid))
viewer = ParamViewer(area.Centroid)
crv_cp = CurveClosestPoint(Point=area.Centroid, Curve=infra_curves)  # -> Point, Parameter, Distance
tstat = TreeStatistics(Tree=crv_cp.Point)  # -> Paths, Length, Count
dist = Distance(PointA=area.Centroid, PointB=crv_cp.Point)  # -> simplify(Distance)
# 46 curves
# 306 cells
# each cell will find its nearest point on 46 curves.
# Then choose the shortest one
cset = CreateSet(List=dist)  # -> Set, Map
sort = SortList(Keys=dist)  # -> Keys, ValuesA
dom = ConstructDomain(DomainStart=0, DomainEnd=0.5)
subset = SubList(List=sort.Keys, Domain=dom, Wrap=True)  # -> simplify(List), Index
mindex = MemberIndex(Set=cset.Set, Member=subset.List)  # -> simplify(flatten(Index)), Count
item = TreeItem(Tree=crv_cp.Point, Path=tstat.Paths, Index=mindex.Index, Wrap=True)
ln = Line(StartPoint=flatten(area.Centroid), EndPoint=item)
panel = Panel(mindex.Index)
linkage_between_cells_to_infra = ClusterOutput(ln)

# ==== cluster Cluster_3
facility_capacity = ClusterInput()
lowest_number = ClusterInput()
largest_number = ClusterInput()
dom = ConstructDomain(DomainStart=lowest_number, DomainEnd=largest_number)
remap = RemapNumbers(Value=facility_capacity, Source=Domain(100, 12000), Target=dom)  # -> Mapped, Clipped
efficiency_for_each_facility = ClusterOutput(remap.Mapped)
