# Grasshopper definition M-Centralised.gh (Grasshopper 1.0.5)
# plug-ins: Human, HoopSnake, LunchBox

# ----
# Palette
inputs = Panel("")
# Spatial Configuration
outputs = Panel("")

_1km = Slider(1, range=0..1)
number_slider = Slider(100, range=0..100)

# ---- group: Merge fields
# II.SPATIAL DEMAND CONE SIMULATION
number_slider_2 = Slider(9, range=1..10)
number_slider_3 = Slider(1.2, range=0.9..2.5)

# ----
# III.HOUSEHOLDS DISTRIBUTION CONE SIMULATION
_0_10km = Curve(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)
_10_20km = Curve(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)
_20_30km = Curve(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)
_30_40km = Curve(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)
area = Area(Geometry=_0_10km)  # -> Area, Centroid
area_2 = Area(Geometry=_10_20km)  # -> Area, Centroid
area_3 = Area(Geometry=_20_30km)  # -> Area, Centroid
area_4 = Area(Geometry=_30_40km)  # -> Area, Centroid

# ---- group: How many cells should a CBD possess
cbd = Slider(38, range=20..40)

# ---- group: How many subcenters
number_slider_4 = Slider(8, range=0..10)

number_slider_5 = Slider(8, range=0..10)

# ----
# Pick cells from layer
crv = Curve([<curve referenced from the Rhino model> x630])

# ---- group: Subcenter non-residential block
number_slider_6 = Slider(1, range=0..40)

number_slider_7 = Slider(2, range=0..40)

# ----
# Cells Distribution
panel = Panel("136")

# ---- group: Target number of cells
division = Division(A=Slider(200, range=0..1000), B="0.32")
panel_2 = Panel(division)

# ----
panel_3 = Panel("""10
20
30
40""")

# ----
# I.BASIC GRID
# 100km*100km
# 3.Center
# 2.Boundary
# 1.Basic Grid
# 4.Buffer
sqgrid = Square(Plane=PlaneXY(0, 0, 0), Size=_1km, ExtentX=number_slider, ExtentY=number_slider)  # -> Cells, Points
bbox = BoundingBox(Content=flatten(sqgrid.Cells), Plane=PlaneXY(0, 0, 0), UnionBox=True)  # -> Box, Box_2
wires = BrepWireframe(Brep=bbox.Box, Density=-1)
join = JoinCurves(Curves=wires, Preserve=False)
curve = Curve(join)
area_5 = Area(Geometry=join)  # -> flatten(Area), flatten(Centroid)
center_point = Point(area_5.Centroid)
panel_4 = Panel(area_5.Area)
panel_5 = Panel("""GB50137-2011《城市用地分类与规划建设用地标准》：
居住用地占城市建设用地比例宜为25.0%~40.0%""")
panel_6 = Panel("""GB50137-2011《城市用地分类与规划建设用地标准》：
人均城镇建设用地的指标：每人100平方米左右""")
cir = Circle(Plane=center_point, Radius=panel_3)
preview = CustomPreview(Geometry=cir, Material=ColourSwatch(SwatchColor=RGBA(255, 255, 255, 31)))
panel_7 = Panel("100km2")

# ---- group: Divide Surface
boundary = BoundarySurfaces(Edges=curve)
number_slider_8 = Slider(50, range=0..100)

# ---- group: Boundary inherited from I
crv_2 = Curve(curve)

# ----
# Center
pt = Point(center_point)

# ----
# Buffer
number_slider_9 = Slider(20, range=0..100)
cir_2 = Circle(Plane=pt, Radius=number_slider_9)
offset = OffsetCurve(Curve=cir_2, Distance=Slider(5, range=0..10), Plane=PlaneXY(0, 0, 0), Corners=1)

# ----
# Buffer
number_slider_10 = Slider(30, range=0..100)
cir_3 = Circle(Plane=pt, Radius=number_slider_10)
offset_2 = OffsetCurve(Curve=cir_3, Distance=Slider(6, range=0..10), Plane=pt, Corners=1)

# ---- group: Merge fields
# 1.Merge Fields
pcharge = PointCharge(Point=center_point, Charge=number_slider_2, Decay=number_slider_3)
mergef = MergeFields(Fields=pcharge)

# ---- group: Divide Surface
# 2.Points for evaluation
sdivide = DivideSurface(Surface=boundary, UCount=number_slider_8, VCount=number_slider_8)  # -> flatten(Points), Normals, Parameters

# ---- group: Evaluate Grid Points
# 3.Evaluate Field
evf = EvaluateField(Field=mergef, Point=sdivide.Points)  # -> Tensor, Strength
graph = GraphMapper(evf.Strength, x0=0, x1=1, y0=0, y1=1, container_name="Bezier", cpx=[0, 0.1352282465, 0.228681922, 1], cpy=[0, 0, 1, 1])

# ----
# IV.DISTORTED HEXAGON
# 1.Remap Strength
# (inherited from evaluated fields)
bnd = Bounds(Numbers=graph)
remap = RemapNumbers(Value=graph, Source=bnd, Target=Domain(0, 1))  # -> Mapped, Clipped
graph_2 = GraphMapper(
    remap.Mapped,
    x0=0,
    x1=1,
    y0=0,
    y1=1,
    container_name="Bezier",
    cpx=[0, 0.1567152888, 0.3960031569, 1],
    cpy=[0, 0.3554871082, 0.7025407553, 0.8235858679])
dom = ConstructDomain(DomainStart=0, DomainEnd=graph_2)

# ----
# Cull Pattern ( reduce points )
lng = ListLength(List=dom)
random = Random(Range=Domain(0, 1), Number=lng, Seed=2)
random_2 = Random(Range=dom, Number=1, Seed=random)  # -> flatten(Random)
# 2.Points with different density
larger = LargerThan(FirstNumber=random_2, SecondNumber=Slider(0.187, range=0.0001..0.2))  # -> LargerThan, OrEqualTo
cull = CullPattern(List=sdivide.Points, CullPattern=larger.LargerThan)
lng_2 = ListLength(List=cull)
panel_8 = Panel(lng_2)

Z = UnitZ(Factor=graph)
multiplication = Multiplication(A=Z, B=Slider(30, range=0..100))

# ----
# V.DISTRIBUTION OF 200 RESIDENTIAL BLOCKS
divide = DivideCurve(Curve=offset_2, Count=number_slider_4, Kinks=False)  # -> Points, Tangents, Parameters
divide_2 = DivideCurve(Curve=offset, Count=number_slider_5, Kinks=False)  # -> Points, Tangents, Parameters

# ----
# 4.Moved Points
move = Move(Geometry=sdivide.Points, Motion=multiplication)  # -> Geometry, Transform

# ----
# First Tier
# Second Tier
# Third Tier
neighborhood_cells = NeighborhoodCells(basic_cells=crv, points=pt, start_number=cbd, target_number=panel)  # -> flatten(cells), rest_cells, flatten(R)
neighborhood_cells_2 = NeighborhoodCells(basic_cells=neighborhood_cells.rest_cells, points=divide_2.Points, start_number=number_slider_7, target_number="5")  # -> flatten(cells), rest_cells, flatten(R)
neighborhood_cells_3 = NeighborhoodCells(basic_cells=neighborhood_cells_2.rest_cells, points=divide.Points, start_number=number_slider_6, target_number="3")  # -> flatten(cells), rest_cells, flatten(R)
panel_9 = Panel(neighborhood_cells_3.R)
panel_10 = Panel(neighborhood_cells_2.R)
panel_11 = Panel(neighborhood_cells.R)
boundary_2 = BoundarySurfaces(Edges=neighborhood_cells_3.cells)
boundary_3 = BoundarySurfaces(Edges=neighborhood_cells_2.cells)
boundary_4 = BoundarySurfaces(Edges=neighborhood_cells.cells)

# ----
# 5.Spatial Demand Cone with color
number_slider_11 = Slider(0.8, range=0..1)
cir_4 = Circle(Plane=sdivide.Points, Radius=number_slider_11)  # disabled
pdecon = Deconstruct(Point=move.Geometry)  # -> XComponent, YComponent, ZComponent; disabled
cir_5 = Circle(Plane=move.Geometry, Radius=number_slider_11)  # disabled
bnd_2 = Bounds(Numbers=pdecon.ZComponent)  # disabled
rulesrf = RuledSurface(CurveA=cir_4, CurveB=cir_5)  # disabled
cap = CapHoles(Brep=rulesrf)  # disabled
remap_2 = RemapNumbers(Value=pdecon.ZComponent, Source=bnd_2, Target=Domain(0, 1))  # -> Mapped, Clipped; disabled
gradient = Gradient(LowerLimit=0, UpperLimit=1, Parameter=remap_2.Mapped, stops=[0: RGB(0, 192, 192), 0.481: RGB(203, 39, 63)])  # disabled
preview_2 = CustomPreview(Geometry=cap, Material=gradient)  # disabled

# ---- group: Points for evaluation
pt_2 = Point(sdivide.Points)  # disabled

# ----
# 3.Distribution Cone
Z_2 = UnitZ(Factor=1)  # disabled
Z_3 = UnitZ(Factor=1)  # disabled
brep = Brep(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)  # disabled
number_slider_12 = Slider(0.8, range=0..1)  # disabled
move_2 = Move(Geometry=brep, Motion=Z_2)  # -> Geometry, Transform; disabled
line = LineSDL(Start=pt_2, Direction=Z_3, Length=50)  # disabled
bcx = BrepCurve(Brep=move_2.Geometry, Curve=line)  # -> Curves, flatten(Points); disabled
cir_6 = Circle(Plane=pt_2, Radius=number_slider_12)  # disabled
cir_7 = Circle(Plane=bcx.Points, Radius=number_slider_12)  # disabled
pdecon_2 = Deconstruct(Point=bcx.Points)  # -> XComponent, YComponent, ZComponent; disabled
rulesrf_2 = RuledSurface(CurveA=cir_6, CurveB=cir_7)  # disabled
bnd_3 = Bounds(Numbers=pdecon_2.ZComponent)  # disabled
cap_2 = CapHoles(Brep=rulesrf_2)  # disabled
remap_3 = RemapNumbers(Value=pdecon_2.ZComponent, Source=bnd_3, Target=Domain(0, 1))  # -> Mapped, Clipped; disabled
gradient_2 = Gradient(LowerLimit=0, UpperLimit=1, Parameter=remap_3.Mapped, stops=[0: RGB(0, 192, 192), 0.3: RGB(203, 39, 63)])  # disabled
preview_3 = CustomPreview(Geometry=cap_2, Material=gradient_2)  # disabled

preview_4 = CustomPreview(Geometry=boundary_4, Material=ColourSwatch(SwatchColor=RGBA(255, 0, 0, 180)))
preview_5 = CustomPreview(Geometry=boundary_2, Material=ColourSwatch(SwatchColor=RGBA(255, 0, 0, 60)))
preview_6 = CustomPreview(Geometry=boundary_3, Material=ColourSwatch(SwatchColor=RGBA(255, 0, 0, 130)))

# ---- group: Number of needed facility based on average capacity
average_capacity = Panel("12000")
number = Number(facility_capacity=average_capacity)

# ---- group: Surface represent land price
# VII.Land price based location (euro/m2)
srfgrid = SurfaceFromPoints(Points=move.Geometry, UCount=expr("x+1", number_slider_8), Interpolate=False)
srf = Surface(srfgrid)

# ---- group: Z height range for price surface
panel_12 = Panel("1")
panel_13 = Panel("30")

# ---- group: Landprice in reality
panel_14 = Panel("60")
panel_15 = Panel("20")

# ---- group: Evolutionary solver
distribution_of_facilities = DistributionOfFacilities(
    residential_1=neighborhood_cells.cells,
    residential_2=neighborhood_cells_2.cells,
    residential_3=neighborhood_cells_3.cells,
    count=number)  # -> residential_points, facility_points, facility_capacity, linkages, mileage_of_all_connections

# ----
# VI.Distribution of Facilities
panel_16 = Panel(number)
viewer = ParamViewer(distribution_of_facilities.facility_capacity)
panel_17 = Panel(distribution_of_facilities.facility_capacity)
panel_18 = Panel(distribution_of_facilities.mileage_of_all_connections)

# ----
# Average Capacity(TPD): 200
# Residential points
point = Point(Tree({0}: [Point(54.00740196, 43.95492642, 0)], {1}: [Point(56.056016, 46.00311532, 0)], {2}: [Point(54.00822701, 56.05164074, 0)], {3}: [Point(45.99188156, 56.0531796, 0)], {4}: [Point(43.93837888, 54.00670363, 0)], {5}: [Point(56.05922713, 54.01210782, 0)]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))

# ----
# Facility points
point_2 = Point([Point(55.716, 44.377, 0), Point(53.473, 57.662, 0), Point(46.048, 58.223, 0), Point(41.52, 53.465, 0), Point(56.704, 53.945, 0), Point(45.011, 42.67, 0)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])

# ---- group: Facility Location
# 1095-2920RMB/m2 for 1 year
# Source:Study on the Rational Determination of the Standard of Industrial Land Prices
# 
# 成都 １ ∶ ０ ．５３ ∶ ０ ．２０
point_3 = Point(point_2)

# ----
# industrial land price
# one year(euro/m2)
line_2 = LineSDL(Start=point_3, Direction=Vector(0, 0, 1), Length=200)
scx = SurfaceCurve(Surface=srf, Curve=line_2)  # -> Curves, Points, UVPoints, Normals, Parameters, Tangents
pdecon_3 = Deconstruct(Point=flatten(scx.Points))  # -> XComponent, YComponent, ZComponent
dom_2 = ConstructDomain(DomainStart=panel_12, DomainEnd=panel_13)
dom_3 = ConstructDomain(DomainStart=panel_15, DomainEnd=panel_14)
remap_4 = RemapNumbers(Value=pdecon_3.ZComponent, Source=dom_2, Target=dom_3)  # -> Mapped, Clipped

# ----
# Facility linkage
curve_2 = Curve(Tree({0}: [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], {1}: [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], {2}: [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], {3}: [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], {4}: [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], {5}: [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]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))
param_viewer = ParamViewer(curve_2)

# ----
# Facility capacity(TPD)
data = Data([180, 180, 240, 300, 120, 360, 120, 300, 360, 360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])
panel_19 = Panel(data)

# ----
# Linkage mileage(km)
data_2 = Data(396.085)
panel_20 = Panel(data_2)

life_time = Slider(20, range=0..100)
# 1. Calculation of Cost per Year
days = Slider(365, range=0..1000)
# Caculations
# VIII.Evaluation
coefficients = Coefficients(
    land_price_for_each_facility=remap_4.Mapped,
    transportation_distance=data_2,
    facility_capacity=data,
    function_days_per_year=days,
    life_time=life_time)  # -> indoor_floor_area, cost_of_construction_per_year, required_land_area, cost_of_land_lease_per_year, consumption_of_diesel_per_year, cost_of_diesel_per_year, consumption_of_electricity_per_year, cost_of_electricity_per_year, cost_of_equipment_per_year

# ---- group: Diesel
# Emission Factor :
# 
# Diesel fuel
# CO2: (10.21kg/gallon) (2.6975kg/L)
# CH4: (0.57g/gallon)(0.1506g/L)
# N2O: (0.26g/gallon)(0.0687g/L)
# Emission Factor :
# 
# Electricity
# CO2: (1,232.35lb/MWh) (0.55899396kg/KWh)
# CH4: (0.02414lb/MWh)(0.000010949904kg/KWh)
# N2O: (0.01826lb/MWh)(0.000008282736kg/KWh)
number_slider_13 = Slider(1, range=0..1)
# 2. Calculation of Airborne Emissions per Year
# Total Airborne Emission per Year
cluster = Cluster_2(consumption_of_diesel_per_year=coefficients.consumption_of_diesel_per_year, year=number_slider_13)  # -> co2_emission_ton, ch4_emission_ton, n2o_emission_ton

# ---- group: Electricity
cluster_2 = Cluster_3(consumption_of_electricity_per_year=coefficients.consumption_of_electricity_per_year, year=number_slider_13)  # -> co2_emission_ton, ch4_emission_ton, n2o_emission_ton

# ---- group: Material revenue
# 3. Calculation of Material Revenue per Year
cluster_3 = Cluster_7(facility_capacity=data, days=days)  # -> paper_revenue, glass_revenue, ferrous_revenue, alum_revenue, plastic_revenue, recovered_organic_waste

# ---- group: Total revenue(euro)
merge = Merge(
    Data1=cluster_3.paper_revenue,
    Data2=cluster_3.glass_revenue,
    Data3=cluster_3.ferrous_revenue,
    Data4=cluster_3.alum_revenue,
    Data5=cluster_3.plastic_revenue)
ma = MassAddition(Input=merge)  # -> Result, PartialResults
panel_21 = Panel(ma.Result)

# ---- group: Total CO2(ton)
merge_2 = Merge(Data1=flatten(cluster.co2_emission_ton), Data2=flatten(cluster_2.co2_emission_ton))
ma_2 = MassAddition(Input=merge_2)  # -> Result, PartialResults

# ---- group: Total CH4(ton)
merge_3 = Merge(Data1=flatten(cluster.ch4_emission_ton), Data2=flatten(cluster_2.ch4_emission_ton))
ma_3 = MassAddition(Input=merge_3)  # -> Result, PartialResults

# ---- group: Total N2O(ton)
merge_4 = Merge(Data1=flatten(cluster.n2o_emission_ton), Data2=flatten(cluster_2.n2o_emission_ton))
ma_4 = MassAddition(Input=merge_4)  # -> Result, PartialResults

# ----
# Material Composition of Generated MSW
# 
# Paper 28%
# Glass 5%
# Ferrous 7%
# Aluminium 1%
# Plastic 13%
# Food waste 14%
# Yard trimming 13%
# other 19%
# Efficiency of highly automated sorting system %
# 
# Paper 50-75
# Glass 80-90
# Ferrous 90-95
# Aluminium 90-95
# Plastic 75-90
# organic 80-90
# Material revenue (euro/Mg)
# 
# Paper 70
# Glass 23
# Ferrous 120
# Aluminium 1250
# Plastic 330
# organic: depends on biodegestion
panel_22 = Panel(cluster_3.recovered_organic_waste)

# ---- group: CH4
expression = Expression(x=ma_3.Result, Expression="25*x")

# ---- group: N2O
expression_2 = Expression(x=ma_4.Result, Expression="298*x")

# ---- group: CO2
expression_3 = Expression(x=ma_2.Result, Expression="1*x")

# ----
# Global Warming Potentials (GWPs)
# 100-year GWP :
# 
# CO2: 1
# CH4: 25
# N2O: 298
ma_5 = MassAddition(Input=[expression_3, expression, expression_2])  # -> Result, PartialResults
panel_23 = Panel(ma_5.Result)

ma_6 = MassAddition(Input=coefficients.indoor_floor_area)  # -> Result, PartialResults
ma_7 = MassAddition(Input=coefficients.required_land_area)  # -> Result, PartialResults

# ----
# Mininmal Spanning(km)
data_3 = Data(576.231809)
cluster_4 = Cluster(d1=point, d2=point_2)  # -> mininmal_spanning, crv_2; disabled
panel_24 = Panel(data_3)
data_4 = Data([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])

# ----
# Site Area
data_5 = Data(698040)
panel_25 = Panel(data_5)

# ----
# Cost of Land Lease per Year
data_6 = Data(30611162.64)
panel_26 = Panel(data_6)

# ----
# Cost of Electricity per Year
data_7 = Data(5470146.549)
panel_27 = Panel(data_7)

# ----
# GWP
data_8 = Data(44673.79172)
panel_28 = Panel(data_8)

# ----
# Average Capacity(TPD): 200
# Total revenue (euro)
data_9 = Data("270873128.4")
panel_29 = Panel(data_9)

# ----
# Recovered organic waste (ton)
data_10 = Data("1614068.131765")
panel_30 = Panel(data_10)

# ----
# Average Capacity(TPD): 200
# Indoor Floor Area
data_11 = Data(232680)
panel_31 = Panel(data_11)

# ----
# Cost of Construction per Year
data_12 = Data(7120008)
panel_32 = Panel(data_12)

# ----
# Cost of Diesel per Year
data_13 = Data(2868744.447)
panel_33 = Panel(data_13)

# ----
# Cost of Equipment per Year
data_14 = Data(coefficients.cost_of_equipment_per_year)
panel_34 = Panel(data_14)

# ----
# Average Capacity(TPD): 200
# Total CO2 Emission
data_15 = Data(44418.41141)
panel_35 = Panel(data_15)

# ----
# Total CH4 Emission
data_16 = Data(1.203167504)
panel_36 = Panel(data_16)

# ----
# Total N2O Emission
data_17 = Data(0.7560440453)
panel_37 = Panel(data_17)

param_viewer_2 = ParamViewer(point)

param_viewer_3 = ParamViewer(point_2)

# ----
# Average Capacity(TPD): 400
# Residential points
point_4 = Point(Tree({0}: [Point(54.00740196, 43.95492642, 0)], {1}: [Point(56.056016, 46.00311532, 0)], {2}: [Point(54.00822701, 56.05164074, 0)], {3}: [Point(45.99188156, 56.0531796, 0)], {4}: [Point(43.93837888, 54.00670363, 0)], {5}: [Point(56.05922713, 54.01210782, 0)]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))

# ----
# Facility points
point_5 = Point([Point(52.211, 41.304, 0), Point(59.186, 48.82, 0), Point(56.012, 56.298, 0), Point(46.678, 58.363, 0), Point(39.919, 52.133, 0), Point(45.946, 41.664, 0)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])

# ----
# Facility linkage
curve_3 = Curve(Tree({0}: [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], {1}: [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], {2}: [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], {3}: [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], {4}: [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], {5}: [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]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))
param_viewer_4 = ParamViewer(curve_3)

# ----
# Facility capacity(TPD)
data_18 = Data([420, 600, 540, 540, 540, 480, 420, 540, 480, 480, 480, 420, 540, 360, 420, 480, 420, 480, 300, 300, 300, 480, 480, 480, 180, 120, 180, 180, 180, 180])
panel_38 = Panel(data_18)

# ----
# Linkage mileage(km)
data_19 = Data(607.052)
panel_39 = Panel(data_19)

# ----
# Mininmal Spanning(km)
data_20 = Data(576.5009967)
cluster_5 = Cluster(d1=point_4, d2=point_5)  # -> mininmal_spanning, crv_2; disabled
panel_40 = Panel(data_20)
data_21 = Data([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])

# ----
# Recovered organic waste (ton)
data_22 = Data("1617694.771765")
panel_41 = Panel(data_22)

# ----
# Average Capacity(TPD): 400
# Indoor Floor Area
data_23 = Data(208680)
panel_42 = Panel(data_23)

# ----
# Site Area
data_24 = Data(626040)
panel_43 = Panel(data_24)

# ----
# Cost of Construction per Year
data_25 = Data(6385608)
panel_44 = Panel(data_25)

# ----
# Cost of Land Lease per Year
data_26 = Data(27598490.36)
panel_45 = Panel(data_26)

# ----
# Cost of Diesel per Year
data_27 = Data(2930302.075)
panel_46 = Panel(data_27)

# ----
# Cost of Electricity per Year
data_28 = Data(4905923.078)
panel_47 = Panel(data_28)

# ----
# Cost of Equipment per Year
data_29 = Data(13972200)
panel_48 = Panel(data_29)

# ----
# Total CH4 Emission
data_30 = Data(1.143000355)
panel_49 = Panel(data_30)

# ----
# GWP
data_31 = Data("41221.339099")
panel_50 = Panel(data_31)

# ----
# Average Capacity(TPD): 400
# Total revenue (euro)
data_32 = Data("271858234.2")
panel_51 = Panel(data_32)

# ----
# Average Capacity(TPD): 400
# Total CO2 Emission
data_33 = Data(40982.01056)
panel_52 = Panel(data_33)

# ----
# Total N2O Emission
data_34 = Data(0.7072265978)
panel_53 = Panel(data_34)

param_viewer_5 = ParamViewer(point_4)

param_viewer_6 = ParamViewer(point_5)

# ----
# Facility capacity(TPD)
data_35 = Data([960, 960, 1140, 1140, 900, 1080, 900, 1080, 480, 480, 480, 300, 480, 480, 480, 300, 180, 180])
panel_54 = Panel(data_35)

# ----
# Average Capacity(TPD): 660
# Residential points
point_6 = Point(Tree({0}: [Point(54.00740196, 43.95492642, 0)], {1}: [Point(56.056016, 46.00311532, 0)], {2}: [Point(54.00822701, 56.05164074, 0)], {3}: [Point(45.99188156, 56.0531796, 0)], {4}: [Point(43.93837888, 54.00670363, 0)], {5}: [Point(56.05922713, 54.01210782, 0)]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))

# ----
# Facility points
point_7 = Point([Point(57.152, 40.943, 0), Point(53.152, 60.892, 0), Point(44.388, 60.425, 0), Point(38.526, 51.379, 0), Point(60.238, 55.459, 0), Point(40.227, 42.465, 0), Point(62.571, 47.874, 0), Point(49.349, 38.057, 0), Point(78.251, 49.574, 0), Point(69.344, 69.267, 0), Point(48.303, 76.185, 0), Point(32.008, 64.812, 0), Point(22.677, 49.611, 0), Point(31.023, 29.713, 0), Point(49.178, 21.752, 0), Point(66.319, 32.142, 0), Point(26.821, 75.483, 0), Point(72.399, 22.837, 0)])

# ----
# Facility linkage
curve_4 = Curve(Tree({0}: [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], {1}: [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], {2}: [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], {3}: [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], {4}: [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], {5}: [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]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))
param_viewer_7 = ParamViewer(curve_4)

# ----
# Mininmal Spanning(km)
cluster_6 = Cluster(d1=point_6, d2=point_7)  # -> mininmal_spanning, crv_2; disabled
data_36 = Data(576.0202331)
panel_55 = Panel(data_36)
# X.Data Storing for Evaluation
data_37 = Data([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])

# ----
# Linkage mileage(km)
data_38 = Data(818.535)
panel_56 = Panel(data_38)

# ----
# Average Capacity(TPD): 660
# Total CO2 Emission
data_39 = Data(39811.67435)
panel_57 = Panel(data_39)

# ----
# Total CH4 Emission
data_40 = Data(1.130335221)
panel_58 = Panel(data_40)

# ----
# Total N2O Emission
data_41 = Data(0.692900804)
panel_59 = Panel(data_41)

# ----
# GWP
data_42 = Data("40046.417169")
# 3. Calculation of Material Revenue per Year
panel_60 = Panel(data_42)

# ----
# Average Capacity(TPD): 660
# Total revenue (euro)
data_43 = Data("273649084.8")
panel_61 = Panel(data_43)

# ----
# Recovered organic waste (ton)
data_44 = Data("1624287.73916")
panel_62 = Panel(data_44)

# ----
# Average Capacity(TPD): 660
# Indoor Floor Area
data_45 = Data(199080)
panel_63 = Panel(data_45)

# ----
# Site Area
data_46 = Data(597240)
panel_64 = Panel(data_46)

# ----
# Cost of Land Lease per Year
data_47 = Data(26408754.58)
panel_65 = Panel(data_47)

# ----
# Cost of Electricity per Year
data_48 = Data(4680233.69)
panel_66 = Panel(data_48)

# ----
# Cost of Construction per Year
data_49 = Data(6091848)
panel_67 = Panel(data_49)

# ----
# Cost of Diesel per Year
data_50 = Data(3018671.822)
panel_68 = Panel(data_50)

# ----
# Cost of Equipment per Year
data_51 = Data(13096200)
# 2. Calculation of Airborne Emissions per Year
panel_69 = Panel(data_51)

# ----
# M-Centralised
# IX.Data Storing for Spatial configuration
param_viewer_8 = ParamViewer(point_6)

param_viewer_9 = ParamViewer(point_7)

# ----
# Facility capacity(TPD)
data_52 = Data([1500, 1560, 1440, 1080, 1440, 1500, 1080, 480, 480, 480, 480, 480])
panel_70 = Panel(data_52)

# ----
# Database
# Average Capacity(TPD): 1000
# Residential points
point_8 = Point(Tree({0}: [Point(54.00740196, 43.95492642, 0)], {1}: [Point(56.056016, 46.00311532, 0)], {2}: [Point(54.00822701, 56.05164074, 0)], {3}: [Point(45.99188156, 56.0531796, 0)], {4}: [Point(43.93837888, 54.00670363, 0)], {5}: [Point(56.05922713, 54.01210782, 0)]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))

# ----
# Facility points
point_9 = Point([Point(59.86, 39.009, 0), Point(61.06, 51.193, 0), Point(52.451, 60.761, 0), Point(42.24, 58.811, 0), Point(38.971, 39.93, 0), Point(49.453, 35.022, 0), Point(38.111, 49.617, 0), Point(78.243, 49.544, 0), Point(69.388, 69.334, 0), Point(48.305, 76.177, 0), Point(30.027, 67.53, 0), Point(22.731, 49.618, 0)])

# ----
# Facility linkage
curve_5 = Curve(Tree({0}: [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], {1}: [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], {2}: [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], {3}: [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], {4}: [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], {5}: [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]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))
param_viewer_10 = ParamViewer(curve_5)

# ----
# Mininmal Spanning(km)
cluster_7 = Cluster(d1=point_8, d2=point_9)  # -> mininmal_spanning, crv_2; disabled
data_53 = Data(576.8204588)
panel_71 = Panel(data_53)
data_54 = Data([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])

# ----
# Linkage mileage(km)
data_55 = Data(1147.295)
panel_72 = Panel(data_55)

# ----
# Site Area
data_56 = Data(582840)
panel_73 = Panel(data_56)

# ----
# Cost of Land Lease per Year
data_57 = Data(26298453.66)
panel_74 = Panel(data_57)

# ----
# Cost of Electricity per Year
data_58 = Data(4567388.995)
panel_75 = Panel(data_58)

# ----
# 1. Calculation of Cost per Year
# Average Capacity(TPD): 1000
# Indoor Floor Area
data_59 = Data(194280)
panel_76 = Panel(data_59)

# ----
# Cost of Construction per Year
data_60 = Data(5944968)
panel_77 = Panel(data_60)

# ----
# Cost of Diesel per Year
data_61 = Data(3174714.425)
panel_78 = Panel(data_61)

# ----
# Cost of Equipment per Year
data_62 = Data(12658200)
panel_79 = Panel(data_62)

# ----
# Average Capacity(TPD): 1000
# Total CO2 Emission
data_63 = Data(39584.8628)
panel_80 = Panel(data_63)

# ----
# Total CH4 Emission
data_64 = Data(1.144009511)
panel_81 = Panel(data_64)

# ----
# Total N2O Emission
data_65 = Data(0.6948645414)
panel_82 = Panel(data_65)

# ----
# GWP
data_66 = Data("39820.532676")
panel_83 = Panel(data_66)

# ----
# Recovered organic waste (ton)
data_67 = Data("1630697.850756")
panel_84 = Panel(data_67)

# ----
# Average Capacity(TPD): 1000
# Total revenue (euro)
data_68 = Data("275390266.2")
panel_85 = Panel(data_68)

param_viewer_11 = ParamViewer(point_8)

param_viewer_12 = ParamViewer(point_9)

# ----
# Average Capacity(TPD): 1500
# Residential points
point_10 = Point(Tree({0}: [Point(54.00740196, 43.95492642, 0)], {1}: [Point(56.056016, 46.00311532, 0)], {2}: [Point(54.00822701, 56.05164074, 0)], {3}: [Point(45.99188156, 56.0531796, 0)], {4}: [Point(43.93837888, 54.00670363, 0)], {5}: [Point(56.05922713, 54.01210782, 0)]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))

# ----
# Facility points
point_11 = Point([Point(60.289, 40.745, 0), Point(51.412, 64.447, 0), Point(41.634, 56.688, 0), Point(63.975, 53.701, 0), Point(38.342, 45.481, 0), Point(49.269, 35.884, 0), Point(29.807, 64.684, 0), Point(30.259, 30.83, 0)])

# ----
# Mininmal Spanning(km)
cluster_8 = Cluster(d1=point_10, d2=point_11)  # -> mininmal_spanning, crv_2; disabled
data_69 = Data(576.9064694)
panel_86 = Panel(data_69)
data_70 = Data([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])

# ----
# Facility capacity(TPD)
data_71 = Data([1680, 1980, 1320, 2220, 1740, 1800, 720, 540])
panel_87 = Panel(data_71)

# ----
# Facility linkage
curve_6 = Curve(Tree({0}: [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], {1}: [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], {2}: [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], {3}: [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], {4}: [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], {5}: [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]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))
param_viewer_13 = ParamViewer(curve_6)

# ----
# Linkage mileage(km)
data_72 = Data(1498.285)
panel_88 = Panel(data_72)

# ----
# Average Capacity(TPD): 1500
# Indoor Floor Area
data_73 = Data(191080)
panel_89 = Panel(data_73)

# ----
# Site Area
data_74 = Data(573240)
panel_90 = Panel(data_74)

# ----
# Cost of Land Lease per Year
data_75 = Data(26389469.48)
panel_91 = Panel(data_75)

# ----
# Cost of Electricity per Year
data_76 = Data(4492159.199)
panel_92 = Panel(data_76)

# ----
# Cost of Construction per Year
data_77 = Data(5847048)
panel_93 = Panel(data_77)

# ----
# Cost of Diesel per Year
data_78 = Data(3344857.132)
panel_94 = Panel(data_78)

# ----
# Cost of Equipment per Year
data_79 = Data(12366200)
panel_95 = Panel(data_79)

# ----
# Average Capacity(TPD): 1500
# Total revenue (euro)
data_80 = Data("277661252.4")
panel_96 = Panel(data_80)

# ----
# Recovered organic waste (ton)
data_81 = Data("1639058.424202")
panel_97 = Panel(data_81)

# ----
# GWP
data_82 = Data("39883.655352")
panel_98 = Panel(data_82)

# ----
# Average Capacity(TPD): 1500
# Total CO2 Emission
data_83 = Data(39645.4643)
panel_99 = Panel(data_83)

# ----
# Total CH4 Emission
data_84 = Data(1.1649509)
panel_100 = Panel(data_84)

# ----
# Total N2O Emission
data_85 = Data(0.7015680615)
panel_101 = Panel(data_85)

param_viewer_14 = ParamViewer(point_10)

param_viewer_15 = ParamViewer(point_11)

# ----
# Average Capacity(TPD): 3000
# Residential points
point_12 = Point(Tree({0}: [Point(54.00740196, 43.95492642, 0)], {1}: [Point(56.056016, 46.00311532, 0)], {2}: [Point(54.00822701, 56.05164074, 0)], {3}: [Point(45.99188156, 56.0531796, 0)], {4}: [Point(43.93837888, 54.00670363, 0)], {5}: [Point(56.05922713, 54.01210782, 0)]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))

# ----
# Facility points
point_13 = Point([Point(54.005, 36.907, 0), Point(62.9, 53.615, 0), Point(45.447, 62.596, 0), Point(37.001, 44.905, 0)])

# ----
# Facility linkage
curve_7 = Curve(Tree({0}: [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], {1}: [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], {2}: [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], {3}: [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], {4}: [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], {5}: [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]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))
param_viewer_16 = ParamViewer(curve_7)

# ----
# Mininmal Spanning(km)
cluster_9 = Cluster(d1=point_12, d2=point_13)  # -> mininmal_spanning, crv_2; disabled
data_86 = Data(576.1342187)
panel_102 = Panel(data_86)
data_87 = Data([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])

# ----
# Facility capacity(TPD)
data_88 = Data([3000, 3000, 3060, 2940])
panel_103 = Panel(data_88)

# ----
# Linkage mileage(km)
data_89 = Data(1908.017)
panel_104 = Panel(data_89)

# ----
# Site Area
data_90 = Data(563640)
panel_105 = Panel(data_90)

# ----
# Cost of Land Lease per Year
data_91 = Data(26783751.44)
panel_106 = Panel(data_91)

# ----
# Cost of Electricity per Year
data_92 = Data(4416929.403)
panel_107 = Panel(data_92)

# ----
# Average Capacity(TPD): 3000
# Total revenue (euro)
data_93 = Data("283607759.4")
panel_108 = Panel(data_93)

# ----
# Recovered organic waste (ton)
data_94 = Data("1660950.326723")
panel_109 = Panel(data_94)

# ----
# Average Capacity(TPD): 3000
# Indoor Floor Area
data_95 = Data(187880)
panel_110 = Panel(data_95)

# ----
# Cost of Construction per Year
data_96 = Data(5749128)
panel_111 = Panel(data_96)

# ----
# Cost of Diesel per Year
data_97 = Data(3544462.627)
panel_112 = Panel(data_97)

# ----
# Cost of Equipment per Year
data_98 = Data(12074200)
panel_113 = Panel(data_98)

# ----
# Average Capacity(TPD): 3000
# Total CO2 Emission
data_99 = Data(39800.45519)
panel_114 = Panel(data_99)

# ----
# Total CH4 Emission
data_100 = Data(1.191161999)
panel_115 = Panel(data_100)

# ----
# GWP
data_101 = Data("40042.015532")
panel_116 = Panel(data_101)

# ----
# Total N2O Emission
data_102 = Data(0.7106754932)
panel_117 = Panel(data_102)

param_viewer_17 = ParamViewer(point_12)

param_viewer_18 = ParamViewer(point_13)

# ----
# Facility points
point_14 = Point(Point(49.837, 49.536, 0))

# ----
# Average Capacity(TPD): 12000
# Residential points
point_15 = Point(Tree({0}: [Point(54.00740196, 43.95492642, 0)], {1}: [Point(56.056016, 46.00311532, 0)], {2}: [Point(54.00822701, 56.05164074, 0)], {3}: [Point(45.99188156, 56.0531796, 0)], {4}: [Point(43.93837888, 54.00670363, 0)], {5}: [Point(56.05922713, 54.01210782, 0)]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))

# ----
# Facility capacity(TPD)
data_103 = Data(12000)
panel_118 = Panel(data_103)

# ----
# Facility linkage
curve_8 = Curve(Tree({0}: [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], {1}: [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], {2}: [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], {3}: [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], {4}: [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], {5}: [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]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))
param_viewer_19 = ParamViewer(curve_8)

# ----
# Mininmal Spanning(km)
cluster_10 = Cluster(d1=point_15, d2=point_14)  # -> mininmal_spanning, crv_2; disabled
data_104 = Data(582.7026792)
panel_119 = Panel(data_104)
data_105 = Data([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])

# ----
# Linkage mileage(km)
data_106 = Data(3515.366)
panel_120 = Panel(data_106)

# ----
# Site Area
data_107 = Data(556440)
panel_121 = Panel(data_107)

# ----
# Cost of Land Lease per Year
data_108 = Data(33386400)
panel_122 = Panel(data_108)

# ----
# Cost of Electricity per Year
data_109 = Data(4360507.056)
panel_123 = Panel(data_109)

# ----
# Average Capacity(TPD): 12000
# Indoor Floor Area
data_110 = Data(185480)
panel_124 = Panel(data_110)

# ----
# Cost of Construction per Year
data_111 = Data(5675688)
panel_125 = Panel(data_111)

# ----
# Cost of Diesel per Year
data_112 = Data(4346223.154)
panel_126 = Panel(data_112)

# ----
# Cost of Equipment per Year
data_113 = Data(11855200)
panel_127 = Panel(data_113)

# ----
# GWP
data_114 = Data("42268.536781")
panel_128 = Panel(data_114)

# ----
# Average Capacity(TPD): 12000
# Total CO2 Emission
data_115 = Data(42005.67953)
panel_129 = Panel(data_115)

# ----
# Total CH4 Emission
data_116 = Data(1.327447039)
panel_130 = Panel(data_116)

# ----
# Total N2O Emission
data_117 = Data(0.770708294)
panel_131 = Panel(data_117)

# ----
# Average Capacity(TPD): 12000
# Total revenue (euro)
data_118 = Data("324996000")
panel_132 = Panel(data_118)

# ----
# Recovered organic waste (ton)
data_119 = Data("1813320")
panel_133 = Panel(data_119)

param_viewer_20 = ParamViewer(point_15)

param_viewer_21 = ParamViewer(point_14)

# ---- group: Points
data_120 = Data(point_2)

# ---- group: Capacity
data_121 = Data(data)

# ---- group: llinkage
data_122 = Data(curve_2)

# ---- group: Global control
swatch = ColourSwatch(SwatchColor=RGB(0, 0, 0))
# 1.200TPD
number_slider_14 = Slider(3.6, range=0..10)

# ---- group: Globle control
point_color = ColourSwatch(SwatchColor=RGB(0, 0, 0))
line_color = ColourSwatch(SwatchColor=RGB(95, 78, 85))
# 1.200TPD
thickness = Slider(3, range=0..10)

# ----
point_color_2 = Data(point_color)

# ---- group: Thickness
data_123 = Data(thickness)

# ---- group: Line Color
data_124 = Data(line_color)

# ---- group: Linkage
data_125 = Data(data_4)

# ---- group: Line Thickness
data_126 = Data(number_slider_14)

# ----
line_color_2 = Data(swatch)
previewlw = CustomPreviewLineweights(Geometry=data_125, Shader=line_color_2, Thickness=data_126, Absolute=False)

sqrt = SquareRoot(Value=data_121)
cir_8 = Circle(Plane=data_120, Radius=expr("x/40", sqrt))
boundary_5 = BoundarySurfaces(Edges=cir_8)
preview_7 = CustomPreview(Geometry=boundary_5, Material=point_color_2)
previewlw_2 = CustomPreviewLineweights(Geometry=data_122, Shader=data_124, Thickness=data_123, Absolute=False)

# ---- group: Points
# 2.400TPD
data_127 = Data(point_5)

# ----
point_color_3 = Data(point_color)

# ---- group: Capacity
data_128 = Data(data_18)

# ---- group: llinkage
data_129 = Data(curve_3)

# ---- group: Thickness
data_130 = Data(thickness)

# ---- group: Line Color
data_131 = Data(line_color)

# ---- group: Linkage
# 2.400TPD
data_132 = Data(data_21)

# ---- group: Line Thickness
data_133 = Data(number_slider_14)

# ----
line_color_3 = Data(swatch)
previewlw_3 = CustomPreviewLineweights(Geometry=data_132, Shader=line_color_3, Thickness=data_133, Absolute=False)

# ---- group: 200TPD
merge_5 = Merge(
    Data1=flatten(panel_20),
    Data2=flatten(panel_24),
    Data3=flatten(panel_31),
    Data4=flatten(panel_25),
    Data5=flatten(panel_32),
    Data6=flatten(panel_26),
    Data7=flatten(panel_33),
    Data8=flatten(panel_27),
    Data9=flatten(panel_34),
    Data10=flatten(panel_35),
    Data11=flatten(panel_36),
    Data12=flatten(panel_37),
    Data13=flatten(panel_28),
    Data14=flatten(panel_29),
    Data15=flatten(panel_30))

# ---- group: 400TPD
merge_6 = Merge(
    Data1=flatten(panel_39),
    Data2=flatten(panel_40),
    Data3=flatten(panel_42),
    Data4=flatten(panel_43),
    Data5=flatten(panel_44),
    Data6=flatten(panel_45),
    Data7=flatten(panel_46),
    Data8=flatten(panel_47),
    Data9=flatten(panel_48),
    Data10=flatten(panel_52),
    Data11=flatten(panel_49),
    Data12=flatten(panel_53),
    Data13=flatten(panel_50),
    Data14=flatten(panel_51),
    Data15=flatten(panel_41))

# ---- group: 660TPD
merge_7 = Merge(
    Data1=flatten(panel_56),
    Data2=flatten(panel_55),
    Data3=flatten(panel_63),
    Data4=flatten(panel_64),
    Data5=flatten(panel_67),
    Data6=flatten(panel_65),
    Data7=flatten(panel_68),
    Data8=flatten(panel_66),
    Data9=flatten(panel_69),
    Data10=flatten(panel_57),
    Data11=flatten(panel_58),
    Data12=flatten(panel_59),
    Data13=flatten(panel_60),
    Data14=flatten(panel_61),
    Data15=flatten(panel_62))

# ---- group: 1000TPD
merge_8 = Merge(
    Data1=flatten(panel_72),
    Data2=flatten(panel_71),
    Data3=flatten(panel_76),
    Data4=flatten(panel_73),
    Data5=flatten(panel_77),
    Data6=flatten(panel_74),
    Data7=flatten(panel_78),
    Data8=flatten(panel_75),
    Data9=flatten(panel_79),
    Data10=flatten(panel_80),
    Data11=flatten(panel_81),
    Data12=flatten(panel_82),
    Data13=flatten(panel_83),
    Data14=flatten(panel_85),
    Data15=flatten(panel_84))

# ---- group: 1500TPD
merge_9 = Merge(
    Data1=flatten(panel_88),
    Data2=flatten(panel_86),
    Data3=flatten(panel_89),
    Data4=flatten(panel_90),
    Data5=flatten(panel_93),
    Data6=flatten(panel_91),
    Data7=flatten(panel_94),
    Data8=flatten(panel_92),
    Data9=flatten(panel_95),
    Data10=flatten(panel_99),
    Data11=flatten(panel_100),
    Data12=flatten(panel_101),
    Data13=flatten(panel_98),
    Data14=flatten(panel_96),
    Data15=flatten(panel_97))

# ---- group: 3000TPD
merge_10 = Merge(
    Data1=flatten(panel_104),
    Data2=flatten(panel_102),
    Data3=flatten(panel_110),
    Data4=flatten(panel_105),
    Data5=flatten(panel_111),
    Data6=flatten(panel_106),
    Data7=flatten(panel_112),
    Data8=flatten(panel_107),
    Data9=flatten(panel_113),
    Data10=flatten(panel_114),
    Data11=flatten(panel_115),
    Data12=flatten(panel_117),
    Data13=flatten(panel_116),
    Data14=flatten(panel_108),
    Data15=flatten(panel_109))

# ---- group: 12000TPD
merge_11 = Merge(
    Data1=flatten(panel_120),
    Data2=flatten(panel_119),
    Data3=flatten(panel_124),
    Data4=flatten(panel_121),
    Data5=flatten(panel_125),
    Data6=flatten(panel_122),
    Data7=flatten(panel_126),
    Data8=flatten(panel_123),
    Data9=flatten(panel_127),
    Data10=flatten(panel_129),
    Data11=flatten(panel_130),
    Data12=flatten(panel_131),
    Data13=flatten(panel_128),
    Data14=flatten(panel_132),
    Data15=flatten(panel_133))

# ----
sqrt_2 = SquareRoot(Value=data_128)
cir_9 = Circle(Plane=data_127, Radius=expr("x/40", sqrt_2))
boundary_6 = BoundarySurfaces(Edges=cir_9)
preview_8 = CustomPreview(Geometry=boundary_6, Material=point_color_3)
previewlw_4 = CustomPreviewLineweights(Geometry=data_129, Shader=data_131, Thickness=data_130, Absolute=False)

# ---- group: Linkage
# 3.660TPD
data_134 = Data(data_37)

# ---- group: Line Thickness
data_135 = Data(number_slider_14)

# ----
line_color_4 = Data(swatch)
previewlw_5 = CustomPreviewLineweights(Geometry=data_134, Shader=line_color_4, Thickness=data_135, Absolute=False)

# ---- group: Points
# 3.660TPD
data_136 = Data(point_7)

# ---- group: llinkage
data_137 = Data(curve_4)

# ----
point_color_4 = Data(point_color)

# ---- group: Thickness
data_138 = Data(thickness)

# ---- group: Capacity
data_139 = Data(data_35)

# ---- group: Line Color
data_140 = Data(line_color)

# ----
sqrt_3 = SquareRoot(Value=data_139)
cir_10 = Circle(Plane=data_136, Radius=expr("x/40", sqrt_3))
boundary_7 = BoundarySurfaces(Edges=cir_10)
preview_9 = CustomPreview(Geometry=boundary_7, Material=point_color_4)
previewlw_6 = CustomPreviewLineweights(Geometry=data_137, Shader=data_140, Thickness=data_138, Absolute=False)

panel_134 = Panel("""200TPD
400TPD
660TPD
1000TPD
1500TPD
3000TPD
12000TPD""")

# ---- group: Points
# Visualization
# 1. Facility Points and Linkages
# 4.1000TPD
data_141 = Data(point_9)

# ---- group: llinkage
data_142 = Data(curve_5)

# ----
point_color_5 = Data(point_color)

# ---- group: Thickness
# 2. Minimal Spanning
data_143 = Data(thickness)

# ---- group: Capacity
data_144 = Data(data_52)

# ---- group: Line Color
data_145 = Data(line_color)

# ---- group: Linkage
# 4.1000TPD
data_146 = Data(data_54)

# ---- group: Line Thickness
# Write in Excel
data_147 = Data(number_slider_14)

# ----
line_color_5 = Data(swatch)
previewlw_7 = CustomPreviewLineweights(Geometry=data_146, Shader=line_color_5, Thickness=data_147, Absolute=False)

sqrt_4 = SquareRoot(Value=data_144)
cir_11 = Circle(Plane=data_141, Radius=expr("x/40", sqrt_4))
boundary_8 = BoundarySurfaces(Edges=cir_11)
preview_10 = CustomPreview(Geometry=boundary_8, Material=point_color_5)
previewlw_8 = CustomPreviewLineweights(Geometry=data_142, Shader=data_145, Thickness=data_143, Absolute=False)

entwine = Entwine(
    Branch00=merge_5,
    Branch01=merge_6,
    Branch02=merge_7,
    Branch03=merge_8,
    Branch04=merge_9,
    Branch05=merge_10,
    Branch06=merge_11,
    FlattenInputs=True)

# ---- group: Points
# 5.1500TPD
data_148 = Data(point_11)

# ----
point_color_6 = Data(point_color)

# ---- group: Capacity
data_149 = Data(data_71)

# ---- group: llinkage
data_150 = Data(curve_6)

# ---- group: Thickness
data_151 = Data(thickness)

# ---- group: Line Color
data_152 = Data(line_color)

# ---- group: Linkage
# 5.1500TPD
data_153 = Data(data_70)

# ---- group: Line Thickness
data_154 = Data(number_slider_14)

# ----
line_color_6 = Data(swatch)
previewlw_9 = CustomPreviewLineweights(Geometry=data_153, Shader=line_color_6, Thickness=data_154, Absolute=False)

sqrt_5 = SquareRoot(Value=data_149)
cir_12 = Circle(Plane=data_148, Radius=expr("x/40", sqrt_5))
boundary_9 = BoundarySurfaces(Edges=cir_12)
preview_11 = CustomPreview(Geometry=boundary_9, Material=point_color_6)
previewlw_10 = CustomPreviewLineweights(Geometry=data_150, Shader=data_152, Thickness=data_151, Absolute=False)

panel_135 = Panel(entwine)
excelwrite = ExcelWrite(WriteExcelData=False, WorksheetName="Sheet1", ColumnHeadings=panel_134, Data=entwine, ClearSheet=False)

# ---- group: Linkage
# 6.3000TPD
data_155 = Data(data_87)

# ---- group: Line Thickness
data_156 = Data(number_slider_14)

# ----
line_color_7 = Data(swatch)
previewlw_11 = CustomPreviewLineweights(Geometry=data_155, Shader=line_color_7, Thickness=data_156, Absolute=False)

# ---- group: Points
# 6.3000TPD
data_157 = Data(point_13)

# ----
point_color_7 = Data(point_color)

# ---- group: Capacity
data_158 = Data(data_88)

# ---- group: llinkage
data_159 = Data(curve_7)

# ---- group: Thickness
data_160 = Data(thickness)

# ---- group: Line Color
data_161 = Data(line_color)

# ----
sqrt_6 = SquareRoot(Value=data_158)
cir_13 = Circle(Plane=data_157, Radius=expr("x/40", sqrt_6))
boundary_10 = BoundarySurfaces(Edges=cir_13)
preview_12 = CustomPreview(Geometry=boundary_10, Material=point_color_7)
previewlw_12 = CustomPreviewLineweights(Geometry=data_159, Shader=data_161, Thickness=data_160, Absolute=False)

# ---- group: Points
# 7.12000TPD
data_162 = Data(point_14)

# ----
point_color_8 = Data(point_color)

# ---- group: Capacity
data_163 = Data(data_103)

# ---- group: llinkage
data_164 = Data(curve_8)

# ---- group: Thickness
data_165 = Data(thickness)

# ---- group: Line Color
data_166 = Data(line_color)

# ---- group: Linkage
# 7.12000TPD
data_167 = Data(data_105)

# ---- group: Line Thickness
data_168 = Data(number_slider_14)

# ----
line_color_8 = Data(swatch)
previewlw_13 = CustomPreviewLineweights(Geometry=data_167, Shader=line_color_8, Thickness=data_168, Absolute=False)

sqrt_7 = SquareRoot(Value=data_163)
cir_14 = Circle(Plane=data_162, Radius=expr("x/40", sqrt_7))
boundary_11 = BoundarySurfaces(Edges=cir_14)
preview_13 = CustomPreview(Geometry=boundary_11, Material=point_color_8)
previewlw_14 = CustomPreviewLineweights(Geometry=data_164, Shader=data_166, Thickness=data_165, Absolute=False)

# ----
# 2.Target
merge_12 = Merge(Data1=area.Area, Data2=area_2.Area, Data3=area_3.Area, Data4=area_4.Area)
ma_8 = MassAddition(Input=merge_12)  # -> Result, PartialResults

# ----
# 1.Ratio of household distribution
division_2 = Division(A=merge_12, B=ma_8.Result)
multiplication_2 = Multiplication(A=division_2, B="100")
int = Integer(multiplication_2)
division_3 = Division(A=int, B="100")
ratio = Panel(division_3)

# ---- group: 10Million
multiplication_3 = Multiplication(A=ratio, B="10")

# ----
populations = Panel(multiplication_3)

# ---- group: Residential district(0.05Million)
division_4 = Division(A=populations, B="0.05")

# ----
number_of_needed_districts = Panel(division_4)

# ----
# Lloyd's algorithm
# Double click HS
# iteration times(3)
# Bake to layer
voronoi = Voronoi(Points=hs.Feedback, Boundary=crv_2, BruteForceOverride=False)
area_6 = Area(Geometry=voronoi)  # -> Area, Centroid
# 3.Voronoi Relaxation
hs = HoopSnake(
    StartingData=cull,
    Data=area_6.Centroid,
    Hoopsnake_Data_autoUpdate=False,
    Hoopsnake_Data_dataLimit=2147483647,
    Hoopsnake_Data_delay=0,
    Hoopsnake_Data_resetCounter=False,
    Hoopsnake_Data_updateView=True)  # -> Feedback, CumulativeFeedback, LoopsCounter, flatten(IterationsCounter)
panel_136 = Panel(hs.IterationsCounter)

# ==== cluster NeighborhoodCells
basic_cells = ClusterInput()
points = ClusterInput()
start_number = ClusterInput()
target_number = ClusterInput()
area = Area(Geometry=basic_cells)  # -> Area, Centroid
graft = GraftTree(Tree=points, IncludeEmptyLists=True, IncludeNullItems=True)
addition = Addition(A=start_number, B=target_number)
dom = ConstructDomain(DomainStart=start_number, DomainEnd=expr("x-1", addition))
dist = Distance(PointA=area.Centroid, PointB=graft)  # -> simplify(Distance)
sort = SortList(Keys=dist)  # -> Keys, ValuesA
subset = SubList(List=sort.Keys, Domain=dom, Wrap=True)  # -> simplify(List), Index
mindex = MemberIndex(Set=dist, Member=subset.List)  # -> Index, Count
index = ItemIndex(List=basic_cells, Item=basic_cells)
lng = ListLength(List=points)
lng_2 = ListLength(List=subset.List)
difference = SetDifference(SetA=flatten(index), SetB=flatten(mindex.Index))
item = ListItem(List=basic_cells, Index=mindex.Index, Wrap=True)
multiplication = Multiplication(A=lng_2, B=lng)
item_2 = ListItem(List=basic_cells, Index=difference, Wrap=True)
panel = Panel(multiplication)
R = ClusterOutput(multiplication)
cells = ClusterOutput(item)
rest_cells = ClusterOutput(item_2)

# ==== cluster DistributionOfFacilities
residential_1 = ClusterInput()
residential_2 = ClusterInput()
residential_3 = ClusterInput()
count = ClusterInput()

# ---- group: Generating Facility points
# Generating Facility points by Gene pool
panel = Panel("GeneList X")
vb = VBScript(genelist=panel, count=count)  # -> out, A
# ---------- vb: VB ----------
    For Each obj As IGH_DocumentObject In owner.OnPingDocument().Objects
      If (obj.ComponentGuid <> New Guid("{21553c44-ea62-475e-a8bb-62b2a3ee5ca5}")) Then Continue For
      If (obj.NickName Like genelist) Then
        CallByName(obj, "Count", CallType.Set, count)
        'CallByName(obj, "ExpireSolution", CallType.Method, False)
        Return
      End If
    Next

    Print("No matching Gene list object found")
# ---------- end vb ----------
vb_2 = VBScript(genelist="GeneList Y", count=count)  # -> out, A; same code as vb
genelist_x = GenePool(Decimals=3, Maximum=100, Minimum=0, Value=49.837)
genelist_y = GenePool(Decimals=3, Maximum=100, Minimum=0, Value=49.536)
pt = ConstructPoint(XCoordinate=genelist_x, YCoordinate=genelist_y, ZCoordinate=0)
viewer = ParamViewer(pt)

# ---- group: All of the Residential cells
# Centroid points of Residential Cells
merge = Merge(Data1=residential_1, Data2=residential_2, Data3=residential_3)  # -> graft(Result)
area = Area(Geometry=merge)  # -> Area, simplify(Centroid)

# ----
viewer_2 = ParamViewer(area.Centroid)

# ---- group: Duplicate points list into Tree
# Duplicating Facility list into a tree which
# contains 200 branch (same number with cells)
flatten = FlattenTree(Tree=area.Centroid, Path="{0}")
lng = ListLength(List=flatten)
dup = DuplicateData(Data="0", Number=lng, Order=True)
branch = TreeBranch(Tree=pt, Path=dup, MaintainPaths=False)
viewer_3 = ParamViewer(branch)
panel_2 = Panel(branch)

# ---- group: Nearest facility
# Distance from Cell to facility>Sorting>Smallest number
# (nearest facility in a list)>Index of nearest facility for each cell
dist = Distance(PointA=area.Centroid, PointB=pt)  # -> simplify(Distance)
panel_3 = Panel(dist)
sort = SortList(Keys=dist)  # -> Keys, ValuesA
panel_4 = Panel(sort.Keys)
dom = ConstructDomain(DomainStart=0, DomainEnd=0.5)
subset = SubList(List=sort.Keys, Domain=dom, Wrap=True)  # -> simplify(List), Index
panel_5 = Panel(subset.List)
mindex = MemberIndex(Set=dist, Member=subset.List)  # -> simplify(Index), Count
panel_6 = Panel(mindex.Index)

# ---- group: Facility points
item = ListItem(List=branch, Index=mindex.Index, Wrap=True)

# ---- group: Cells points
pt_2 = Point(area.Centroid)

# ----
# Solver
galapagos = Galapagos(fitness=precesion, gene=[genelist_x, genelist_y])

# ---- group: Connections
ln = Line(StartPoint=pt_2, EndPoint=item)

# ---- group: Cull duplicate
flatten_2 = FlattenTree(Tree=item, Path="{0}")
cullpt = CullDuplicates(Points=flatten_2, Tolerance=0.1, CullMode=1)  # -> Points, Indices, Valence

# ---- group: Mileage
len = Length(Curve=ln)  # -> flatten(Length)
ma = MassAddition(Input=len)  # -> Result, PartialResults

# ----
multiplication = Multiplication(A=cullpt.Valence, B=30)
precesion = Precesion(A=ma.Result)
mileage_of_all_connections = ClusterOutput(precesion)
residential_points = ClusterOutput(pt_2)
facility_capacity = ClusterOutput(multiplication)
facility_points = ClusterOutput(cullpt.Points)
linkages = ClusterOutput(ln)

# ==== cluster Number
# 1 residential district generates 60 tonnes waste per day
number_slider = Slider(60, range=0..100)
facility_capacity = ClusterInput()
multiplication = Multiplication(A=number_slider, B=Slider(200, range=0..1000))
panel = Panel(multiplication)
division = Division(A=panel, B=facility_capacity)
int = Integer(division)
panel_2 = Panel(int)
amounts_of_needed_facilities = ClusterOutput(int)

# ==== cluster Cluster
d1 = ClusterInput()
d2 = ClusterInput()
merge = Merge(Data1=flatten(d1), Data2=flatten(d2))
graphfrompoints = GraphFromPoints(GraphPoints=merge, ConnectingDistance=Slider(50, range=0..100), undirected=True)
minst = MinST(Graph=graphfrompoints)
display_graph = DisplayGraph(Graph=minst, GraphPoints=merge, Value="-1", hidden=False)  # -> VertexCount, EdgeCount, Edge
length = Length(Curve=display_graph.Edge)
mass_addition = MassAddition(Input=length)  # -> Result, PartialResults
division = Division(A=mass_addition.Result, B=2)
crv = Curve(display_graph.Edge)
panel = Panel(division)
mininmal_spanning = ClusterOutput(division)
crv_2 = ClusterOutput(crv)

# ==== cluster Coefficients
land_price_for_each_facility = ClusterInput()  # euro/m2 per year
transportation_distance = ClusterInput()
facility_capacity = ClusterInput()
function_days_per_year = ClusterInput()
life_time = ClusterInput()

# ---- group: Indoor Floor Area(m2)
expression = Expression(x=facility_capacity, Expression="15.39*x+800")

# ---- group: Electricity Consumption（kwh)
expression_2 = Expression(x=expression, Expression="1.607*0.04*x+0.706*(1-0.04)*x")

# ---- group: Construction Cost 600Euro/m2
expression_3 = Expression(A=expression, Expression="612*A")

# ---- group: Transportation Diesel Consumption（L）
expression_4 = Expression(D=transportation_distance, Expression="D*60*0.0272")

# ---- group: Processing Diesel Consumption(L)
expression_5 = Expression(x=facility_capacity, Expression="0.7*x+4.8")

# ---- group: Equipment Cost(Euro/Mg)
expression_6 = Expression(x=facility_capacity, Expression="2.69*x+200")

# ----
# Diesel Consumption (L)
merge = Merge(Data1=flatten(expression_4), Data2=flatten(expression_5))
mass_addition = MassAddition(Input=flatten(merge))  # -> Result, PartialResults
# Cost of Diesel per Year (euro)
multiplication = Multiplication(A=mass_addition.Result, B=function_days_per_year)

# ----
# Electricity Consumption per Year (L)
mass_addition_2 = MassAddition(Input=flatten(expression_2))  # -> Result, PartialResults
# Cost of Electricity per Year (euro)
multiplication_2 = Multiplication(A=mass_addition_2.Result, B=function_days_per_year)

# ----
# Equipment Cost per Year (euro)
mass_addition_3 = MassAddition(Input=flatten(expression_6))  # -> Result, PartialResults
multiplication_3 = Multiplication(A=mass_addition_3.Result, B=function_days_per_year)

# ----
# Construction Cost per Year (euro)
mass_addition_4 = MassAddition(Input=flatten(expression_3))  # -> Result, PartialResults
division = Division(A=mass_addition_4.Result, B=life_time)

# ---- group: Diesel Cost(euro/L)
E = Expression(D=multiplication, Expression="0.842*D")

# ---- group: Electricity Cost(euro/kwh)
E_2 = Expression(E=multiplication_2, Expression="0.0868*E")

# ---- group: Requied Land Area(m2)
expression_7 = Expression(I=expression, Expression="3*I")

# ----
# Land Cost per Year (euro)
multiplication_4 = Multiplication(LandPrice=land_price_for_each_facility, LandArea=expression_7)
# Indoor Floor Area & Site Area
mass_addition_5 = MassAddition(Input=multiplication_4)  # -> Result, PartialResults

consumption_of_electricity_per_year = ClusterOutput(multiplication_2)  # (kwh)
consumption_of_diesel_per_year = ClusterOutput(multiplication)  # (L)
cost_of_construction_per_year = ClusterOutput(division)  # Total Cost/Life time
# Equipment Cost = 2.69*SUM(capacity)+200*N
# N
cost_of_equipment_per_year = ClusterOutput(multiplication_3)  # Includes purchasing, O&M; equation represents how much will be cost when processing one Mg.
cost_of_land_lease_per_year = ClusterOutput(mass_addition_5.Result)  # (euro)
# N
# 1.607*0.04*x+0.706*(1-0.04)*x=(1.607*0.04+0.706*0.96)*Indoor Floor Area
cost_of_electricity_per_year = ClusterOutput(E_2)  # (euro)
# Location&Linkages
cost_of_diesel_per_year = ClusterOutput(E)  # (euro)
# Cost of Construction= 612* Indoor Floor Area=(15.39*SUM x+800*N)*612
# N
# Required Land Area=(15.39*SUM x+800*N)*3
# Location
# Land price various based on the location
required_land_area = ClusterOutput(expression_7)  # (m2)
# N
# indoor Floor Area=(15.39*x1+800)+(15.39*x2+800)+......(15.39*xn+800)
# =15.39*(x1+x2+x3+...Xn)+800*N
# =15.39*SUM x+800*N
# N
indoor_floor_area = ClusterOutput(expression)

# ==== cluster Cluster_2
# Emission Factor :
# 
# Diesel fuel
# CO2: (10.21kg/gallon) (2.6975kg/L)
# CH4: (0.57g/gallon)(0.1506g/L)
# N2O: (0.26g/gallon)(0.0687g/L)
consumption_of_diesel_per_year = ClusterInput()
year = ClusterInput()
expression = Expression(x=consumption_of_diesel_per_year, y=year, Expression="0.1506*x*y*0.001*0.001")
expression_2 = Expression(x=consumption_of_diesel_per_year, y=year, Expression="0.0687*x*y*0.001*0.001")
expression_3 = Expression(x=consumption_of_diesel_per_year, y=year, Expression="2.6975*x*y*0.001")
co2_emission_ton = ClusterOutput(expression_3)
ch4_emission_ton = ClusterOutput(expression)
n2o_emission_ton = ClusterOutput(expression_2)

# ==== cluster Cluster_3
# Emission Factor :
# 
# Electricity
# CO2: (1,232.35lb/MWh) (0.55899396kg/KWh)
# CH4: (0.02414lb/MWh)(0.000010949904kg/KWh)
# N2O: (0.01826lb/MWh)(0.000008282736kg/KWh)
consumption_of_electricity_per_year = ClusterInput()
year = ClusterInput()
expression = Expression(x=consumption_of_electricity_per_year, y=year, Expression="0.000008282736*x*y*0.001")
expression_2 = Expression(x=consumption_of_electricity_per_year, y=year, Expression="0.000010949904*x*y*0.001")
expression_3 = Expression(x=consumption_of_electricity_per_year, y=year, Expression="0.55899396*x*y*0.001")
ch4_emission_ton = ClusterOutput(expression_2)
co2_emission_ton = ClusterOutput(expression_3)
n2o_emission_ton = ClusterOutput(expression)

# ==== cluster Cluster_7
facility_capacity = ClusterInput()
days = ClusterInput()  # operating days per year

# ---- group: Efficiency
cluster = Cluster_5(facility_capacity=facility_capacity)  # -> e_paper, e_glass, e_ferrous, e_aluminium, e_plastic, e_organic

# ---- group: Generated Waste per Year
cluster_2 = Cluster_6(facility_capacity=facility_capacity, days=days)  # -> paper_ton, glass_ton, ferrous_ton, alum_ton, plastic_ton, organic_ton

# ---- group: Recoveryed material
multiplication = Multiplication(A=cluster_2.paper_ton, B=cluster.e_paper)
multiplication_2 = Multiplication(A=cluster_2.glass_ton, B=cluster.e_glass)
multiplication_3 = Multiplication(A=cluster_2.ferrous_ton, B=cluster.e_ferrous)
multiplication_4 = Multiplication(A=cluster_2.alum_ton, B=cluster.e_aluminium)
multiplication_5 = Multiplication(A=cluster_2.plastic_ton, B=cluster.e_plastic)
multiplication_6 = Multiplication(A=cluster_2.organic_ton, B=cluster.e_organic)

# ----
expression = Expression(x=multiplication_4, Expression="x*1250")
expression_2 = Expression(x=multiplication_5, Expression="x*330")
expression_3 = Expression(x=multiplication_3, Expression="x*120")
expression_4 = Expression(x=multiplication, Expression="x*70")
expression_5 = Expression(x=multiplication_2, Expression="x*23")

ma = MassAddition(Input=multiplication_6)  # -> Result, PartialResults
ma_2 = MassAddition(Input=expression)  # -> Result, PartialResults
ma_3 = MassAddition(Input=expression_3)  # -> Result, PartialResults
ma_4 = MassAddition(Input=expression_5)  # -> Result, PartialResults
ma_5 = MassAddition(Input=expression_4)  # -> Result, PartialResults
ma_6 = MassAddition(Input=expression_2)  # -> Result, PartialResults
recovered_organic_waste = ClusterOutput(ma.Result)
paper_revenue = ClusterOutput(ma_5.Result)
glass_revenue = ClusterOutput(ma_4.Result)
alum_revenue = ClusterOutput(ma_2.Result)
ferrous_revenue = ClusterOutput(ma_3.Result)
plastic_revenue = ClusterOutput(ma_6.Result)

# ==== cluster Precesion
A = ClusterInput()
multiplication = Multiplication(A=A, B="1000")
integer = Integer(multiplication)
division = Division(A=integer, B="1000")
result = ClusterOutput(division)

# ==== cluster Cluster_5
facility_capacity = ClusterInput()

# ---- group: E-Paper
cluster = Cluster_4(facility_capacity=facility_capacity, lowest_number="0.50", largest_number="0.75")

# ---- group: E-Glass
cluster_2 = Cluster_4(facility_capacity=facility_capacity, lowest_number="0.80", largest_number="0.90")

# ---- group: E-Aluminium
cluster_3 = Cluster_4(facility_capacity=facility_capacity, lowest_number="0.90", largest_number="0.95")

# ---- group: E-Ferrous
cluster_4 = Cluster_4(facility_capacity=facility_capacity, lowest_number="0.90", largest_number="0.95")

# ---- group: E-Plastic
cluster_5 = Cluster_4(facility_capacity=facility_capacity, lowest_number="0.75", largest_number="0.90")

# ---- group: E-Organic
cluster_6 = Cluster_4(facility_capacity=facility_capacity, lowest_number="0.80", largest_number="0.90")

# ----
e_ferrous = ClusterOutput(cluster_4)
e_aluminium = ClusterOutput(cluster_3)
e_organic = ClusterOutput(cluster_6)
e_plastic = ClusterOutput(cluster_5)
e_paper = ClusterOutput(cluster)
e_glass = ClusterOutput(cluster_2)

# ==== cluster Cluster_6
days = ClusterInput()
facility_capacity = ClusterInput()  # how much waste will be dealt each day
multiplication = Multiplication(TPD=facility_capacity, OperatingDays=days)

# ---- group: Paper(ton)
expression = Expression(x=multiplication, Expression="0.28*x")

# ---- group: Glass(ton)
expression_2 = Expression(x=multiplication, Expression="0.05*x")

# ---- group: Ferrous(ton)
expression_3 = Expression(x=multiplication, Expression="0.07*x")

# ---- group: Alum(ton)
expression_4 = Expression(x=multiplication, Expression="0.01*x")

# ---- group: Plastic(ton)
expression_5 = Expression(x=multiplication, Expression="0.13*x")

# ---- group: Organic(ton)
expression_6 = Expression(x=multiplication, Expression="0.46*x")

# ----
organic_ton = ClusterOutput(expression_6)
ferrous_ton = ClusterOutput(expression_3)
plastic_ton = ClusterOutput(expression_5)
paper_ton = ClusterOutput(expression)
glass_ton = ClusterOutput(expression_2)
alum_ton = ClusterOutput(expression_4)

# ==== cluster Cluster_4
facility_capacity = ClusterInput()
lowest_number = ClusterInput()
largest_number = ClusterInput()
dom = ConstructDomain(DomainStart=lowest_number, DomainEnd=largest_number)
remap = RemapNumbers(Value=facility_capacity, Source=Domain(100, 12000), Target=dom)  # -> Mapped, Clipped
efficiency_for_each_facility = ClusterOutput(remap.Mapped)
