# Grasshopper definition P-Dispersed.gh (Grasshopper 1.0.5)
# plug-ins: Human, HoopSnake, LunchBox

# ----
# Spatial Configuration
outputs = Panel("")

_1km = Slider(1, range=0..1)
number_slider = Slider(100, range=0..100)

# ---- group: Merge fields / 3 centers
# II.SPATIAL DEMAND CONE SIMULATION
point = Point([Point(50, 71.65127019, 0), Point(25, 28.35, 0), Point(75, 28.35, 0)])

# ---- group: Merge fields
number_slider_2 = Slider(3, range=1..10)
number_slider_3 = Slider(1.5, range=0.9..2.5)

# ----
# III.HOUSEHOLDS DISTRIBUTION CONE SIMULATION
_0_10km = Curve(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)
_10_20km = Curve(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)
_20_30km = Curve(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)
area = Area(Geometry=_0_10km)  # -> Area, Centroid
area_2 = Area(Geometry=_10_20km)  # -> Area, Centroid
area_3 = Area(Geometry=_20_30km)  # -> Area, Centroid

# ---- group: How many cells should a CBD possess
cbd = Slider(16, range=10..40)

# ---- group: How many subcenters
number_slider_4 = Slider(6, range=0..10)

number_slider_5 = Slider(6, range=0..10)

# ---- group: Merge fields
pcharge = PointCharge(Point=point, Charge=number_slider_2, Decay=number_slider_3)
mergef = MergeFields(Fields=pcharge)

# ---- group: Subcenter non-residential block
number_slider_6 = Slider(1, range=0..40)

number_slider_7 = Slider(2, range=0..40)

# ----
# Cells Distribution
panel = Panel("37")

# ---- group: Target number of cells
division = Division(A=Slider(200, range=0..1000), B="0.32")
panel_2 = Panel(division)

# ----
panel_3 = Panel("""10
20
30
40""")

# ----
# I.BASIC GRID
# 4.Buffer
sqgrid = Square(Plane=PlaneXY(0, 0, 0), Size=_1km, ExtentX=number_slider, ExtentY=number_slider)  # -> Cells, Points
bbox = BoundingBox(Content=flatten(sqgrid.Cells), Plane=PlaneXY(0, 0, 0), UnionBox=True)  # -> Box, Box_2
wires = BrepWireframe(Brep=bbox.Box, Density=-1)
join = JoinCurves(Curves=wires, Preserve=False)
curve = Curve(join)
area_4 = Area(Geometry=join)  # -> flatten(Area), flatten(Centroid)
center_point = Point(area_4.Centroid)
panel_4 = Panel(area_4.Area)
panel_5 = Panel("""GB50137-2011《城市用地分类与规划建设用地标准》：
居住用地占城市建设用地比例宜为25.0%~40.0%""")
panel_6 = Panel("""GB50137-2011《城市用地分类与规划建设用地标准》：
人均城镇建设用地的指标：每人100平方米左右""")
cir = Circle(Plane=center_point, Radius=panel_3)
preview = CustomPreview(Geometry=cir, Material=ColourSwatch(SwatchColor=RGBA(255, 255, 255, 31)))
panel_7 = Panel("100km2")

# ---- group: Divide Surface
boundary = BoundarySurfaces(Edges=curve)
number_slider_8 = Slider(50, range=0..100)

# ---- group: Boundary inherited from I
crv = Curve(curve)

# ---- group: Divide Surface
sdivide = DivideSurface(Surface=boundary, UCount=number_slider_8, VCount=number_slider_8)  # -> flatten(Points), Normals, Parameters

# ---- group: Evaluate Grid Points
evf = EvaluateField(Field=mergef, Point=sdivide.Points)  # -> Tensor, Strength
graph = GraphMapper(evf.Strength, x0=0, x1=1, y0=0, y1=1, container_name="Bezier", cpx=[0, 0.1352282465, 0.228681922, 1], cpy=[0, 0, 1, 1])

# ----
# IV.DISTORTED HEXAGON
bnd = Bounds(Numbers=evf.Strength)
remap = RemapNumbers(Value=evf.Strength, Source=bnd, Target=Domain(0, 1))  # -> Mapped, Clipped
graph_2 = GraphMapper(
    remap.Mapped,
    x0=0,
    x1=1,
    y0=0,
    y1=1,
    container_name="Bezier",
    cpx=[0, 0.1567152888, 0.3960031569, 1],
    cpy=[0, 0.3554871082, 0.7025407553, 0.8235858679])
dom = ConstructDomain(DomainStart=0, DomainEnd=graph_2)

# ----
# Cull Pattern ( reduce points )
lng = ListLength(List=dom)
random = Random(Range=Domain(0, 1), Number=lng, Seed=2)
random_2 = Random(Range=dom, Number=1, Seed=random)  # -> flatten(Random)
# 2.Points with different density
larger = LargerThan(FirstNumber=random_2, SecondNumber=Slider(0.00374, range=0.0001..0.2))  # -> LargerThan, OrEqualTo
cull = CullPattern(List=sdivide.Points, CullPattern=larger.LargerThan)
lng_2 = ListLength(List=cull)
panel_8 = Panel(lng_2)

Z = UnitZ(Factor=graph)
multiplication = Multiplication(A=Z, B=Slider(30, range=0..100))

# ----
# 4.Moved Points
move = Move(Geometry=sdivide.Points, Motion=multiplication)  # -> Geometry, Transform

# ----
# 5.Spatial Demand Cone with color
number_slider_9 = Slider(0.8, range=0..1)
cir_2 = Circle(Plane=sdivide.Points, Radius=number_slider_9)  # disabled
pdecon = Deconstruct(Point=move.Geometry)  # -> XComponent, YComponent, ZComponent; disabled
cir_3 = Circle(Plane=move.Geometry, Radius=number_slider_9)  # disabled
bnd_2 = Bounds(Numbers=pdecon.ZComponent)  # disabled
rulesrf = RuledSurface(CurveA=cir_2, CurveB=cir_3)  # disabled
cap = CapHoles(Brep=rulesrf)  # disabled
remap_2 = RemapNumbers(Value=pdecon.ZComponent, Source=bnd_2, Target=Domain(0, 1))  # -> Mapped, Clipped; disabled
gradient = Gradient(LowerLimit=0, UpperLimit=1, Parameter=remap_2.Mapped, stops=[0: RGB(0, 192, 192), 0.481: RGB(203, 39, 63)])  # disabled
preview_2 = CustomPreview(Geometry=cap, Material=gradient)  # disabled

# ---- group: Points for evaluation
pt = Point(sdivide.Points)  # disabled

# ----
# 3.Distribution Cone
Z_2 = UnitZ(Factor=1)  # disabled
Z_3 = UnitZ(Factor=1)  # disabled
brep = Brep(<brep referenced from the Rhino model>)  # disabled
number_slider_10 = Slider(0.8, range=0..1)  # disabled
move_2 = Move(Geometry=brep, Motion=Z_2)  # -> Geometry, Transform; disabled
line = LineSDL(Start=pt, Direction=Z_3, Length=50)  # disabled
bcx = BrepCurve(Brep=move_2.Geometry, Curve=line)  # -> Curves, flatten(Points); disabled
cir_4 = Circle(Plane=pt, Radius=number_slider_10)  # disabled
cir_5 = Circle(Plane=bcx.Points, Radius=number_slider_10)  # disabled
pdecon_2 = Deconstruct(Point=bcx.Points)  # -> XComponent, YComponent, ZComponent; disabled
rulesrf_2 = RuledSurface(CurveA=cir_4, CurveB=cir_5)  # disabled
bnd_3 = Bounds(Numbers=pdecon_2.ZComponent)  # disabled
cap_2 = CapHoles(Brep=rulesrf_2)  # disabled
remap_3 = RemapNumbers(Value=pdecon_2.ZComponent, Source=bnd_3, Target=Domain(0, 1))  # -> Mapped, Clipped; disabled
gradient_2 = Gradient(LowerLimit=0, UpperLimit=1, Parameter=remap_3.Mapped, stops=[0: RGB(0, 192, 192), 0.3: RGB(203, 39, 63)])  # disabled
preview_3 = CustomPreview(Geometry=cap_2, Material=gradient_2)  # disabled

# ---- group: Number of needed facility based on average capacity
average_capacity = Panel("12000")
number = Number(facility_capacity=average_capacity)

# ---- group: Surface represent land price
# VII.Land price based location (euro/m2)
srfgrid = SurfaceFromPoints(Points=move.Geometry, UCount=expr("x+1", number_slider_8), Interpolate=False)
srf = Surface(srfgrid)

# ---- group: Z height range for price surface
panel_9 = Panel("1")
panel_10 = Panel("30")

# ---- group: Landprice in reality
panel_11 = Panel("60")
panel_12 = Panel("20")

# ----
# Average Capacity(TPD): 200
# Residential points
point_2 = Point(Tree({0}: [Point(74.00661867, 21.87264322, 0)], {1}: [Point(47.30490932, 63.39716251, 0)], {2}: [Point(82.00635615, 28.00878913, 0)], {3}: [Point(47.94396143, 65.95178389, 0)], {4}: [Point(17.52669515, 25.94292827, 0)], {5}: [Point(21.9618074, 32.00988228, 0)]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))

# ----
# Facility points
point_3 = Point([Point(72.054, 21.884, 0), Point(48.297, 65.381, 0), Point(80.294, 24.684, 0), Point(19.82, 24.005, 0), Point(22.72, 34.517, 0), Point(68.965, 29.087, 0)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])

# ---- group: Facility Location
# 1095-2920RMB/m2 for 1 year
# Source:Study on the Rational Determination of the Standard of Industrial Land Prices
# 
# 成都 １ ∶ ０ ．５３ ∶ ０ ．２０
point_4 = Point(point_3)

# ----
# industrial land price
# one year(euro/m2)
line_2 = LineSDL(Start=point_4, Direction=Vector(0, 0, 1), Length=200)
scx = SurfaceCurve(Surface=srf, Curve=line_2)  # -> Curves, Points, UVPoints, Normals, Parameters, Tangents
pdecon_3 = Deconstruct(Point=flatten(scx.Points))  # -> XComponent, YComponent, ZComponent
dom_2 = ConstructDomain(DomainStart=panel_9, DomainEnd=panel_10)
dom_3 = ConstructDomain(DomainStart=panel_12, DomainEnd=panel_11)
remap_4 = RemapNumbers(Value=pdecon_3.ZComponent, Source=dom_2, Target=dom_3)  # -> Mapped, Clipped

# ----
# Facility linkage
curve_2 = Curve(Tree({0}: [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], {1}: [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], {2}: [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], {3}: [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], {4}: [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], {5}: [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]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))
param_viewer = ParamViewer(curve_2)

# ----
# Facility capacity(TPD)
data = Data([420, 180, 540, 420, 420, 360, 420, 360, 360, 240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])
panel_13 = Panel(data)

# ----
# Linkage mileage(km)
data_2 = Data(425.888)
panel_14 = Panel(data_2)

life_time = Slider(20, range=0..100)
# 1. Calculation of Cost per Year
days = Slider(365, range=0..1000)
# Caculations
# VIII.Evaluation
coefficients = Coefficients(
    land_price_for_each_facility=remap_4.Mapped,
    transportation_distance=data_2,
    facility_capacity=data,
    function_days_per_year=days,
    life_time=life_time)  # -> indoor_floor_area, cost_of_construction_per_year, required_land_area, cost_of_land_lease_per_year, consumption_of_diesel_per_year, cost_of_diesel_per_year, consumption_of_electricity_per_year, cost_of_electricity_per_year, cost_of_equipment_per_year

# ---- group: Diesel
# Emission Factor :
# 
# Diesel fuel
# CO2: (10.21kg/gallon) (2.6975kg/L)
# CH4: (0.57g/gallon)(0.1506g/L)
# N2O: (0.26g/gallon)(0.0687g/L)
# Emission Factor :
# 
# Electricity
# CO2: (1,232.35lb/MWh) (0.55899396kg/KWh)
# CH4: (0.02414lb/MWh)(0.000010949904kg/KWh)
# N2O: (0.01826lb/MWh)(0.000008282736kg/KWh)
number_slider_11 = Slider(1, range=0..1)
# 2. Calculation of Airborne Emissions per Year
# Total Airborne Emission per Year
cluster = Cluster_2(consumption_of_diesel_per_year=coefficients.consumption_of_diesel_per_year, year=number_slider_11)  # -> co2_emission_ton, ch4_emission_ton, n2o_emission_ton

# ---- group: Electricity
cluster_2 = Cluster_3(consumption_of_electricity_per_year=coefficients.consumption_of_electricity_per_year, year=number_slider_11)  # -> co2_emission_ton, ch4_emission_ton, n2o_emission_ton

# ---- group: Material revenue
# 3. Calculation of Material Revenue per Year
cluster_3 = Cluster_7(facility_capacity=data, days=days)  # -> paper_revenue, glass_revenue, ferrous_revenue, alum_revenue, plastic_revenue, recovered_organic_waste

# ---- group: Total revenue(euro)
merge = Merge(
    Data1=cluster_3.paper_revenue,
    Data2=cluster_3.glass_revenue,
    Data3=cluster_3.ferrous_revenue,
    Data4=cluster_3.alum_revenue,
    Data5=cluster_3.plastic_revenue)
ma = MassAddition(Input=merge)  # -> Result, PartialResults
panel_15 = Panel(ma.Result)

# ---- group: Total CO2(ton)
merge_2 = Merge(Data1=flatten(cluster.co2_emission_ton), Data2=flatten(cluster_2.co2_emission_ton))
ma_2 = MassAddition(Input=merge_2)  # -> Result, PartialResults

# ---- group: Total CH4(ton)
merge_3 = Merge(Data1=flatten(cluster.ch4_emission_ton), Data2=flatten(cluster_2.ch4_emission_ton))
ma_3 = MassAddition(Input=merge_3)  # -> Result, PartialResults

# ---- group: Total N2O(ton)
merge_4 = Merge(Data1=flatten(cluster.n2o_emission_ton), Data2=flatten(cluster_2.n2o_emission_ton))
ma_4 = MassAddition(Input=merge_4)  # -> Result, PartialResults

# ----
# Material Composition of Generated MSW
# 
# Paper 28%
# Glass 5%
# Ferrous 7%
# Aluminium 1%
# Plastic 13%
# Food waste 14%
# Yard trimming 13%
# other 19%
# Efficiency of highly automated sorting system %
# 
# Paper 50-75
# Glass 80-90
# Ferrous 90-95
# Aluminium 90-95
# Plastic 75-90
# organic 80-90
# Material revenue (euro/Mg)
# 
# Paper 70
# Glass 23
# Ferrous 120
# Aluminium 1250
# Plastic 330
# organic: depends on biodegestion
panel_16 = Panel(cluster_3.recovered_organic_waste)

# ---- group: CH4
expression = Expression(x=ma_3.Result, Expression="25*x")

# ---- group: N2O
expression_2 = Expression(x=ma_4.Result, Expression="298*x")

# ---- group: CO2
expression_3 = Expression(x=ma_2.Result, Expression="1*x")

# ----
# Global Warming Potentials (GWPs)
# 100-year GWP :
# 
# CO2: 1
# CH4: 25
# N2O: 298
ma_5 = MassAddition(Input=[expression_3, expression, expression_2])  # -> Result, PartialResults
panel_17 = Panel(ma_5.Result)

ma_6 = MassAddition(Input=coefficients.indoor_floor_area)  # -> Result, PartialResults
ma_7 = MassAddition(Input=coefficients.required_land_area)  # -> Result, PartialResults

# ----
# Mininmal Spanning(km)
data_3 = Data(669.581402)
cluster_4 = Cluster(d1=point_2, d2=point_3)  # -> mininmal_spanning, crv_2; disabled
panel_18 = Panel(data_3)
data_4 = Data([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])

# ----
# Site Area
data_5 = Data(698040)
panel_19 = Panel(data_5)

# ----
# Cost of Land Lease per Year
data_6 = Data(18444407.85)
panel_20 = Panel(data_6)

# ----
# Cost of Electricity per Year
data_7 = Data(5470146.549)
panel_21 = Panel(data_7)

# ----
# GWP
data_8 = Data("44722.110867")
panel_22 = Panel(data_8)

# ----
# Average Capacity(TPD): 200
# Total revenue (euro)
data_9 = Data("271044211.2")
panel_23 = Panel(data_9)

# ----
# Recovered organic waste (ton)
data_10 = Data("1614697.968403")
panel_24 = Panel(data_10)

# ----
# Average Capacity(TPD): 200
# Indoor Floor Area
data_11 = Data(232680)
panel_25 = Panel(data_11)

# ----
# Cost of Construction per Year
data_12 = Data(7120008)
panel_26 = Panel(data_12)

# ----
# Cost of Diesel per Year
data_13 = Data(2883692.516)
panel_27 = Panel(data_13)

# ----
# Cost of Equipment per Year
data_14 = Data(16162200)
panel_28 = Panel(data_14)

# ----
# Average Capacity(TPD): 200
# Total CO2 Emission
data_15 = Data(44466.30026)
panel_29 = Panel(data_15)

# ----
# Total CH4 Emission
data_16 = Data(1.205841113)
panel_30 = Panel(data_16)

# ----
# Total N2O Emission
data_17 = Data(0.7572636799)
panel_31 = Panel(data_17)

param_viewer_2 = ParamViewer(point_2)

param_viewer_3 = ParamViewer(point_3)

# ----
# Average Capacity(TPD): 400
# Residential points
point_5 = Point(Tree({0}: [Point(74.00661867, 21.87264322, 0)], {1}: [Point(47.30490932, 63.39716251, 0)], {2}: [Point(82.00635615, 28.00878913, 0)], {3}: [Point(47.94396143, 65.95178389, 0)], {4}: [Point(17.52669515, 25.94292827, 0)], {5}: [Point(21.9618074, 32.00988228, 0)]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))

# ----
# Facility points
point_6 = Point([Point(72.168, 22.129, 0), Point(52.369, 65.495, 0), Point(80.401, 25.043, 0), Point(19.837, 25.894, 0), Point(25.152, 34.76, 0), Point(67.463, 28.014, 0)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])

# ----
# Facility linkage
curve_3 = Curve(Tree({0}: [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], {1}: [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], {2}: [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], {3}: [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], {4}: [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], {5}: [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]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))
param_viewer_4 = ParamViewer(curve_3)

# ----
# Facility capacity(TPD)
data_18 = Data([420, 540, 540, 840, 840, 540, 660, 660, 840, 360, 540, 780, 300, 300, 300, 240, 240, 300, 300, 300, 300, 300, 180, 120, 180, 300, 300, 120, 120, 240])
panel_32 = Panel(data_18)

# ----
# Linkage mileage(km)
data_19 = Data(710.639)
panel_33 = Panel(data_19)

# ----
# Mininmal Spanning(km)
data_20 = Data(674.5697913)
cluster_5 = Cluster(d1=point_5, d2=point_6)  # -> mininmal_spanning, crv_2; disabled
panel_34 = Panel(data_20)
data_21 = Data([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])

# ----
# Recovered organic waste (ton)
data_22 = Data("1618964.603697")
panel_35 = Panel(data_22)

# ----
# Average Capacity(TPD): 400
# Indoor Floor Area
data_23 = Data(208680)
panel_36 = Panel(data_23)

# ----
# Site Area
data_24 = Data(626040)
panel_37 = Panel(data_24)

# ----
# Cost of Construction per Year
data_25 = Data(6385608)
panel_38 = Panel(data_25)

# ----
# Cost of Land Lease per Year
data_26 = Data(17106564.96)
panel_39 = Panel(data_26)

# ----
# Cost of Diesel per Year
data_27 = Data(2982257.436)
panel_40 = Panel(data_27)

# ----
# Cost of Electricity per Year
data_28 = Data(4905923.078)
panel_41 = Panel(data_28)

# ----
# Cost of Equipment per Year
data_29 = Data(13972200)
panel_42 = Panel(data_29)

# ----
# Total CH4 Emission
data_30 = Data(1.152293084)
panel_43 = Panel(data_30)

# ----
# GWP
data_31 = Data("41389.283113")
panel_44 = Panel(data_31)

# ----
# Average Capacity(TPD): 400
# Total revenue (euro)
data_32 = Data("272203159.2")
panel_45 = Panel(data_32)

# ----
# Average Capacity(TPD): 400
# Total CO2 Emission
data_33 = Data(41148.459)
panel_46 = Panel(data_33)

# ----
# Total N2O Emission
data_34 = Data(0.7114657109)
panel_47 = Panel(data_34)

# ----
# P-Dispersed
param_viewer_5 = ParamViewer(point_5)

param_viewer_6 = ParamViewer(point_6)

# ----
# Facility capacity(TPD)
data_35 = Data([1020, 840, 900, 1200, 960, 960, 1380, 1140, 780, 300, 300, 420, 420, 360, 300, 180, 300, 240])
panel_48 = Panel(data_35)

# ----
# Average Capacity(TPD): 660
# Residential points
point_7 = Point(Tree({0}: [Point(74.00661867, 21.87264322, 0)], {1}: [Point(47.30490932, 63.39716251, 0)], {2}: [Point(82.00635615, 28.00878913, 0)], {3}: [Point(47.94396143, 65.95178389, 0)], {4}: [Point(17.52669515, 25.94292827, 0)], {5}: [Point(21.9618074, 32.00988228, 0)]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))

# ----
# Facility points
point_8 = Point([Point(79.836, 22.293, 0), Point(49.898, 65.39, 0), Point(19.503, 22.408, 0), Point(22.583, 34.906, 0), Point(68.309, 27.679, 0), Point(77.764, 34.468, 0), Point(43.156, 75.369, 0), Point(31.206, 24.177, 0), Point(53.843, 75.899, 0), Point(70.419, 71.582, 0), Point(59.747, 88.111, 0), Point(38.411, 46.173, 0), Point(60.125, 50.61, 0), Point(7.118, 30.248, 0), Point(93.415, 29.375, 0), Point(82.03, 48.481, 0), Point(64.401, 12.242, 0), Point(52.768, 25.069, 0)])

# ----
# Facility linkage
curve_4 = Curve(Tree({0}: [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], {1}: [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], {2}: [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], {3}: [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], {4}: [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], {5}: [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]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))
param_viewer_7 = ParamViewer(curve_4)

# ----
# Mininmal Spanning(km)
cluster_6 = Cluster(d1=point_7, d2=point_8)  # -> mininmal_spanning, crv_2; disabled
data_36 = Data(673.8047548)
panel_49 = Panel(data_36)
# X.Data Storing for Evaluation
data_37 = Data([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])

# ----
# Linkage mileage(km)
data_38 = Data(1088.208)
panel_50 = Panel(data_38)

# ----
# Average Capacity(TPD): 660
# Total CO2 Emission
data_39 = Data(40244.99755)
panel_51 = Panel(data_39)

# ----
# Total CH4 Emission
data_40 = Data(1.154527426)
panel_52 = Panel(data_40)

# ----
# Total N2O Emission
data_41 = Data(0.7039366904)
panel_53 = Panel(data_41)

# ----
# GWP
data_42 = Data("40483.633866")
# 3. Calculation of Material Revenue per Year
panel_54 = Panel(data_42)

# ----
# Average Capacity(TPD): 660
# Total revenue (euro)
data_43 = Data("273864318")
panel_55 = Panel(data_43)

# ----
# Recovered organic waste (ton)
data_44 = Data("1625080.114286")
panel_56 = Panel(data_44)

# ----
# Average Capacity(TPD): 660
# Indoor Floor Area
data_45 = Data(199080)
panel_57 = Panel(data_45)

# ----
# Site Area
data_46 = Data(597240)
panel_58 = Panel(data_46)

# ----
# Cost of Land Lease per Year
data_47 = Data(16750269.74)
panel_59 = Panel(data_47)

# ----
# Cost of Electricity per Year
data_48 = Data(4680233.69)
panel_60 = Panel(data_48)

# ----
# Cost of Construction per Year
data_49 = Data(6091848)
panel_61 = Panel(data_49)

# ----
# Cost of Diesel per Year
data_50 = Data(3153929.702)
panel_62 = Panel(data_50)

# ----
# Cost of Equipment per Year
data_51 = Data(13096200)
# 2. Calculation of Airborne Emissions per Year
panel_63 = Panel(data_51)

# ----
# IX.Data Storing for Spatial configuration
param_viewer_8 = ParamViewer(point_7)

param_viewer_9 = ParamViewer(point_8)

# ----
# Facility capacity(TPD)
data_52 = Data([1440, 1140, 1440, 1440, 1020, 1140, 1920, 1140, 300, 300, 420, 300])
panel_64 = Panel(data_52)

# ----
# Database
# Average Capacity(TPD): 1000
# Residential points
point_9 = Point(Tree({0}: [Point(74.00661867, 21.87264322, 0)], {1}: [Point(47.30490932, 63.39716251, 0)], {2}: [Point(82.00635615, 28.00878913, 0)], {3}: [Point(47.94396143, 65.95178389, 0)], {4}: [Point(17.52669515, 25.94292827, 0)], {5}: [Point(21.9618074, 32.00988228, 0)]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))

# ----
# Facility points
point_10 = Point([Point(81.216, 23.945, 0), Point(50.746, 65.856, 0), Point(17.825, 25.128, 0), Point(25.757, 37.045, 0), Point(67.051, 27.006, 0), Point(76.467, 35.823, 0), Point(45.925, 76.171, 0), Point(31.75, 23.983, 0), Point(70.439, 71.5, 0), Point(59.704, 88.092, 0), Point(60.166, 50.598, 0), Point(64.448, 12.216, 0)])

# ----
# Facility linkage
curve_5 = Curve(Tree({0}: [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], {1}: [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], {2}: [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], {3}: [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], {4}: [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], {5}: [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]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))
param_viewer_10 = ParamViewer(curve_5)

# ----
# Mininmal Spanning(km)
cluster_7 = Cluster(d1=point_9, d2=point_10)  # -> mininmal_spanning, crv_2; disabled
data_53 = Data(675.0758901)
panel_65 = Panel(data_53)
data_54 = Data([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])

# ----
# Linkage mileage(km)
data_55 = Data(1412.981)
panel_66 = Panel(data_55)

# ----
# Site Area
data_56 = Data(582840)
panel_67 = Panel(data_56)

# ----
# Cost of Land Lease per Year
data_57 = Data(16820846.4)
panel_68 = Panel(data_57)

# ----
# Cost of Electricity per Year
data_58 = Data(4567388.995)
panel_69 = Panel(data_58)

# ----
# 1. Calculation of Cost per Year
# Average Capacity(TPD): 1000
# Indoor Floor Area
data_59 = Data(194280)
panel_70 = Panel(data_59)

# ----
# Cost of Construction per Year
data_60 = Data(5944968)
panel_71 = Panel(data_60)

# ----
# Cost of Diesel per Year
data_61 = Data(3307972.576)
panel_72 = Panel(data_61)

# ----
# Cost of Equipment per Year
data_62 = Data(12658200)
panel_73 = Panel(data_62)

# ----
# Average Capacity(TPD): 1000
# Total CO2 Emission
data_63 = Data(40011.7795)
panel_74 = Panel(data_63)

# ----
# Total CH4 Emission
data_64 = Data(1.167844045)
panel_75 = Panel(data_64)

# ----
# Total N2O Emission
data_65 = Data(0.7057372669)
panel_76 = Panel(data_65)

# ----
# GWP
data_66 = Data("40251.28531")
panel_77 = Panel(data_66)

# ----
# Recovered organic waste (ton)
data_67 = Data("1631723.874958")
panel_78 = Panel(data_67)

# ----
# Average Capacity(TPD): 1000
# Total revenue (euro)
data_68 = Data("275668965.6")
panel_79 = Panel(data_68)

param_viewer_11 = ParamViewer(point_9)

param_viewer_12 = ParamViewer(point_10)

# ----
# Average Capacity(TPD): 1500
# Residential points
point_11 = Point(Tree({0}: [Point(74.00661867, 21.87264322, 0)], {1}: [Point(47.30490932, 63.39716251, 0)], {2}: [Point(82.00635615, 28.00878913, 0)], {3}: [Point(47.94396143, 65.95178389, 0)], {4}: [Point(17.52669515, 25.94292827, 0)], {5}: [Point(21.9618074, 32.00988228, 0)]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))

# ----
# Facility points
point_12 = Point([Point(81.215, 23.943, 0), Point(43.313, 69.971, 0), Point(20.1, 23.068, 0), Point(27.951, 34.521, 0), Point(66.183, 25.126, 0), Point(76.142, 35.643, 0), Point(53.748, 76.656, 0), Point(60.552, 53.997, 0)])

# ----
# Mininmal Spanning(km)
cluster_8 = Cluster(d1=point_11, d2=point_12)  # -> mininmal_spanning, crv_2; disabled
data_69 = Data(674.2335309)
panel_80 = Panel(data_69)
data_70 = Data([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])

# ----
# Facility capacity(TPD)
data_71 = Data([1440, 1620, 1920, 2040, 1320, 1200, 1920, 540])
panel_81 = Panel(data_71)

# ----
# Facility linkage
curve_6 = Curve(Tree({0}: [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], {1}: [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], {2}: [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], {3}: [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], {4}: [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], {5}: [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]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))
param_viewer_13 = ParamViewer(curve_6)

# ----
# Linkage mileage(km)
data_72 = Data(1687.127)
panel_82 = Panel(data_72)

# ----
# Average Capacity(TPD): 1500
# Indoor Floor Area
data_73 = Data(191080)
panel_83 = Panel(data_73)

# ----
# Site Area
data_74 = Data(573240)
panel_84 = Panel(data_74)

# ----
# Cost of Land Lease per Year
data_75 = Data(17236218.88)
panel_85 = Panel(data_75)

# ----
# Cost of Electricity per Year
data_76 = Data(4492159.199)
panel_86 = Panel(data_76)

# ----
# Cost of Construction per Year
data_77 = Data(5847048)
panel_87 = Panel(data_77)

# ----
# Cost of Diesel per Year
data_78 = Data(3439573.209)
panel_88 = Panel(data_78)

# ----
# Cost of Equipment per Year
data_79 = Data(12366200)
panel_89 = Panel(data_79)

# ----
# Average Capacity(TPD): 1500
# Total revenue (euro)
data_80 = Data("277360477.8")
panel_90 = Panel(data_80)

# ----
# Recovered organic waste (ton)
data_81 = Data("1637951.130756")
panel_91 = Panel(data_81)

# ----
# Average Capacity(TPD): 1500
# Total CO2 Emission
data_82 = Data(39948.90446)
panel_92 = Panel(data_82)

# ----
# Total CH4 Emission
data_83 = Data(1.181891804)
panel_93 = Panel(data_83)

# ----
# Total N2O Emission
data_84 = Data(0.7092960835)
panel_94 = Panel(data_84)

# ----
# GWP
data_85 = Data("40189.821989")
panel_95 = Panel(data_85)

param_viewer_14 = ParamViewer(point_11)

param_viewer_15 = ParamViewer(point_12)

# ----
# Average Capacity(TPD): 3000
# Residential points
point_13 = Point(Tree({0}: [Point(74.00661867, 21.87264322, 0)], {1}: [Point(47.30490932, 63.39716251, 0)], {2}: [Point(82.00635615, 28.00878913, 0)], {3}: [Point(47.94396143, 65.95178389, 0)], {4}: [Point(17.52669515, 25.94292827, 0)], {5}: [Point(21.9618074, 32.00988228, 0)]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))

# ----
# Facility points
point_14 = Point([Point(74.964, 28.456, 0), Point(43.804, 73.716, 0), Point(23.995, 29.233, 0), Point(56.588, 71.764, 0)])

# ----
# Facility linkage
curve_7 = Curve(Tree({0}: [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], {1}: [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], {2}: [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], {3}: [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], {4}: [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], {5}: [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]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))
param_viewer_16 = ParamViewer(curve_7)

# ----
# Mininmal Spanning(km)
cluster_9 = Cluster(d1=point_13, d2=point_14)  # -> mininmal_spanning, crv_2; disabled
data_86 = Data(681.2216101)
panel_96 = Panel(data_86)
data_87 = Data([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])

# ----
# Facility capacity(TPD)
data_88 = Data([4080, 2040, 4020, 1860])
panel_97 = Panel(data_88)

# ----
# Linkage mileage(km)
data_89 = Data(2252.073)
panel_98 = Panel(data_89)

# ----
# Site Area
data_90 = Data(563640)
panel_99 = Panel(data_90)

# ----
# Cost of Land Lease per Year
data_91 = Data(28424928.11)
panel_100 = Panel(data_91)

# ----
# Cost of Electricity per Year
data_92 = Data(4416929.403)
panel_101 = Panel(data_92)

# ----
# Average Capacity(TPD): 3000
# Total revenue (euro)
data_93 = Data("285302031")
panel_102 = Panel(data_93)

# ----
# Recovered organic waste (ton)
data_94 = Data("1667187.741176")
panel_103 = Panel(data_94)

# ----
# Average Capacity(TPD): 3000
# Indoor Floor Area
data_95 = Data(187880)
panel_104 = Panel(data_95)

# ----
# Cost of Construction per Year
data_96 = Data(5749128)
panel_105 = Panel(data_96)

# ----
# Cost of Diesel per Year
data_97 = Data(3717028.235)
panel_106 = Panel(data_97)

# ----
# Cost of Equipment per Year
data_98 = Data(12074200)
panel_107 = Panel(data_98)

# ----
# Average Capacity(TPD): 3000
# Total CO2 Emission
data_99 = Data(40353.30047)
panel_108 = Panel(data_99)

# ----
# Total CH4 Emission
data_100 = Data(1.222027059)
panel_109 = Panel(data_100)

# ----
# GWP
data_101 = Data("40599.828245")
panel_110 = Panel(data_101)

# ----
# Total N2O Emission
data_102 = Data(0.7247553712)
panel_111 = Panel(data_102)

param_viewer_17 = ParamViewer(point_13)

param_viewer_18 = ParamViewer(point_14)

# ----
# Facility points
point_15 = Point(Point(49.961, 42.986, 0))

# ----
# Average Capacity(TPD): 12000
# Residential points
point_16 = Point(Tree({0}: [Point(74.00661867, 21.87264322, 0)], {1}: [Point(47.30490932, 63.39716251, 0)], {2}: [Point(82.00635615, 28.00878913, 0)], {3}: [Point(47.94396143, 65.95178389, 0)], {4}: [Point(17.52669515, 25.94292827, 0)], {5}: [Point(21.9618074, 32.00988228, 0)]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))

# ----
# Facility capacity(TPD)
data_103 = Data(12000)
panel_112 = Panel(data_103)

# ----
# Facility linkage
curve_8 = Curve(Tree({0}: [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], {1}: [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], {2}: [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], {3}: [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], {4}: [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], {5}: [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]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))
param_viewer_19 = ParamViewer(curve_8)

# ----
# Mininmal Spanning(km)
cluster_10 = Cluster(d1=point_16, d2=point_15)  # -> mininmal_spanning, crv_2; disabled
data_104 = Data(682.7178654)
panel_113 = Panel(data_104)
data_105 = Data([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])

# ----
# Linkage mileage(km)
data_106 = Data(6194.99)
panel_114 = Panel(data_106)

# ----
# Site Area
data_107 = Data(556440)
panel_115 = Panel(data_107)

# ----
# Cost of Land Lease per Year
data_108 = Data(10361641.95)
panel_116 = Panel(data_108)

# ----
# Cost of Electricity per Year
data_109 = Data(4360507.056)
panel_117 = Panel(data_109)

# ----
# Average Capacity(TPD): 12000
# Indoor Floor Area
data_110 = Data(185480)
panel_118 = Panel(data_110)

# ----
# Cost of Construction per Year
data_111 = Data(5675688)
panel_119 = Panel(data_111)

# ----
# Cost of Diesel per Year
data_112 = Data(5690222.228)
panel_120 = Panel(data_112)

# ----
# Cost of Equipment per Year
data_113 = Data(11855200)
panel_121 = Panel(data_113)

# ----
# Average Capacity(TPD): 12000
# Total CO2 Emission
data_114 = Data(46311.42478)
panel_122 = Panel(data_114)

# ----
# Total CH4 Emission
data_115 = Data(1.567834522)
panel_123 = Panel(data_115)

# ----
# Total N2O Emission
data_116 = Data(0.8803671257)
panel_124 = Panel(data_116)

# ----
# GWP
data_117 = Data("46612.970049")
panel_125 = Panel(data_117)

# ----
# Average Capacity(TPD): 12000
data_118 = Data("324996000")
panel_126 = Panel(data_118)

data_119 = Data("1813320")
panel_127 = Panel(data_119)

param_viewer_20 = ParamViewer(point_16)

param_viewer_21 = ParamViewer(point_15)

# ---- group: Points
data_120 = Data(point_3)

# ---- group: Capacity
data_121 = Data(data)

# ---- group: llinkage
data_122 = Data(curve_2)

# ---- group: Global control
swatch = ColourSwatch(SwatchColor=RGB(0, 0, 0))
# 1.200TPD
number_slider_12 = Slider(3.6, range=0..10)

# ---- group: Globle control
point_color = ColourSwatch(SwatchColor=RGB(0, 0, 0))
line_color = ColourSwatch(SwatchColor=RGB(95, 78, 85))
# 1.200TPD
thickness = Slider(3, range=0..10)

# ----
point_color_2 = Data(point_color)

# ---- group: Thickness
data_123 = Data(thickness)

# ---- group: Line Color
data_124 = Data(line_color)

# ---- group: Linkage
data_125 = Data(data_4)

# ---- group: Line Thickness
data_126 = Data(number_slider_12)

# ----
line_color_2 = Data(swatch)
previewlw = CustomPreviewLineweights(Geometry=data_125, Shader=line_color_2, Thickness=data_126, Absolute=False)

sqrt = SquareRoot(Value=data_121)
cir_6 = Circle(Plane=data_120, Radius=expr("x/40", sqrt))
boundary_2 = BoundarySurfaces(Edges=cir_6)
preview_4 = CustomPreview(Geometry=boundary_2, Material=point_color_2)
previewlw_2 = CustomPreviewLineweights(Geometry=data_122, Shader=data_124, Thickness=data_123, Absolute=False)

# ---- group: Points
# 2.400TPD
data_127 = Data(point_6)

# ----
point_color_3 = Data(point_color)

# ---- group: Capacity
data_128 = Data(data_18)

# ---- group: llinkage
data_129 = Data(curve_3)

# ---- group: Thickness
data_130 = Data(thickness)

# ---- group: Line Color
data_131 = Data(line_color)

# ---- group: Linkage
# 2.400TPD
data_132 = Data(data_21)

# ---- group: Line Thickness
data_133 = Data(number_slider_12)

# ----
line_color_3 = Data(swatch)
previewlw_3 = CustomPreviewLineweights(Geometry=data_132, Shader=line_color_3, Thickness=data_133, Absolute=False)

# ---- group: 200TPD
merge_5 = Merge(
    Data1=flatten(panel_14),
    Data2=flatten(panel_18),
    Data3=flatten(panel_25),
    Data4=flatten(panel_19),
    Data5=flatten(panel_26),
    Data6=flatten(panel_20),
    Data7=flatten(panel_27),
    Data8=flatten(panel_21),
    Data9=flatten(panel_28),
    Data10=flatten(panel_29),
    Data11=flatten(panel_30),
    Data12=flatten(panel_31),
    Data13=flatten(panel_22),
    Data14=flatten(panel_23),
    Data15=flatten(panel_24))

# ---- group: 400TPD
merge_6 = Merge(
    Data1=flatten(panel_33),
    Data2=flatten(panel_34),
    Data3=flatten(panel_36),
    Data4=flatten(panel_37),
    Data5=flatten(panel_38),
    Data6=flatten(panel_39),
    Data7=flatten(panel_40),
    Data8=flatten(panel_41),
    Data9=flatten(panel_42),
    Data10=flatten(panel_46),
    Data11=flatten(panel_43),
    Data12=flatten(panel_47),
    Data13=flatten(panel_44),
    Data14=flatten(panel_45),
    Data15=flatten(panel_35))

# ---- group: 660TPD
merge_7 = Merge(
    Data1=flatten(panel_50),
    Data2=flatten(panel_49),
    Data3=flatten(panel_57),
    Data4=flatten(panel_58),
    Data5=flatten(panel_61),
    Data6=flatten(panel_59),
    Data7=flatten(panel_62),
    Data8=flatten(panel_60),
    Data9=flatten(panel_63),
    Data10=flatten(panel_51),
    Data11=flatten(panel_52),
    Data12=flatten(panel_53),
    Data13=flatten(panel_54),
    Data14=flatten(panel_55),
    Data15=flatten(panel_56))

# ---- group: 1000TPD
merge_8 = Merge(
    Data1=flatten(panel_66),
    Data2=flatten(panel_65),
    Data3=flatten(panel_70),
    Data4=flatten(panel_67),
    Data5=flatten(panel_71),
    Data6=flatten(panel_68),
    Data7=flatten(panel_72),
    Data8=flatten(panel_69),
    Data9=flatten(panel_73),
    Data10=flatten(panel_74),
    Data11=flatten(panel_75),
    Data12=flatten(panel_76),
    Data13=flatten(panel_77),
    Data14=flatten(panel_79),
    Data15=flatten(panel_78))

# ---- group: 1500TPD
merge_9 = Merge(
    Data1=flatten(panel_82),
    Data2=flatten(panel_80),
    Data3=flatten(panel_83),
    Data4=flatten(panel_84),
    Data5=flatten(panel_87),
    Data6=flatten(panel_85),
    Data7=flatten(panel_88),
    Data8=flatten(panel_86),
    Data9=flatten(panel_89),
    Data10=flatten(panel_92),
    Data11=flatten(panel_93),
    Data12=flatten(panel_94),
    Data13=flatten(panel_95),
    Data14=flatten(panel_90),
    Data15=flatten(panel_91))

# ---- group: 3000TPD
merge_10 = Merge(
    Data1=flatten(panel_98),
    Data2=flatten(panel_96),
    Data3=flatten(panel_104),
    Data4=flatten(panel_99),
    Data5=flatten(panel_105),
    Data6=flatten(panel_100),
    Data7=flatten(panel_106),
    Data8=flatten(panel_101),
    Data9=flatten(panel_107),
    Data10=flatten(panel_108),
    Data11=flatten(panel_109),
    Data12=flatten(panel_111),
    Data13=flatten(panel_110),
    Data14=flatten(panel_102),
    Data15=flatten(panel_103))

# ---- group: 12000TPD
merge_11 = Merge(
    Data1=flatten(panel_114),
    Data2=flatten(panel_113),
    Data3=flatten(panel_118),
    Data4=flatten(panel_115),
    Data5=flatten(panel_119),
    Data6=flatten(panel_116),
    Data7=flatten(panel_120),
    Data8=flatten(panel_117),
    Data9=flatten(panel_121),
    Data10=flatten(panel_122),
    Data11=flatten(panel_123),
    Data12=flatten(panel_124),
    Data13=flatten(panel_125),
    Data14=flatten(panel_126),
    Data15=flatten(panel_127))

# ----
sqrt_2 = SquareRoot(Value=data_128)
cir_7 = Circle(Plane=data_127, Radius=expr("x/40", sqrt_2))
boundary_3 = BoundarySurfaces(Edges=cir_7)
preview_5 = CustomPreview(Geometry=boundary_3, Material=point_color_3)
previewlw_4 = CustomPreviewLineweights(Geometry=data_129, Shader=data_131, Thickness=data_130, Absolute=False)

# ---- group: Linkage
# 3.660TPD
data_134 = Data(data_37)

# ---- group: Line Thickness
data_135 = Data(number_slider_12)

# ----
line_color_4 = Data(swatch)
previewlw_5 = CustomPreviewLineweights(Geometry=data_134, Shader=line_color_4, Thickness=data_135, Absolute=False)

# ---- group: Points
# 3.660TPD
data_136 = Data(point_8)

# ---- group: llinkage
data_137 = Data(curve_4)

# ----
point_color_4 = Data(point_color)

# ---- group: Thickness
data_138 = Data(thickness)

# ---- group: Capacity
data_139 = Data(data_35)

# ---- group: Line Color
data_140 = Data(line_color)

# ----
sqrt_3 = SquareRoot(Value=data_139)
cir_8 = Circle(Plane=data_136, Radius=expr("x/40", sqrt_3))
boundary_4 = BoundarySurfaces(Edges=cir_8)
preview_6 = CustomPreview(Geometry=boundary_4, Material=point_color_4)
previewlw_6 = CustomPreviewLineweights(Geometry=data_137, Shader=data_140, Thickness=data_138, Absolute=False)

panel_128 = Panel("""200TPD
400TPD
660TPD
1000TPD
1500TPD
3000TPD
12000TPD""")

# ---- group: Points
# Visualization
# 1. Facility Points and Linkages
# 4.1000TPD
data_141 = Data(point_10)

# ---- group: llinkage
data_142 = Data(curve_5)

# ----
point_color_5 = Data(point_color)

# ---- group: Thickness
# 2. Minimal Spanning
data_143 = Data(thickness)

# ---- group: Capacity
data_144 = Data(data_52)

# ---- group: Line Color
data_145 = Data(line_color)

# ---- group: Linkage
# 4.1000TPD
data_146 = Data(data_54)

# ---- group: Line Thickness
# Write in Excel
data_147 = Data(number_slider_12)

# ----
line_color_5 = Data(swatch)
previewlw_7 = CustomPreviewLineweights(Geometry=data_146, Shader=line_color_5, Thickness=data_147, Absolute=False)

sqrt_4 = SquareRoot(Value=data_144)
cir_9 = Circle(Plane=data_141, Radius=expr("x/40", sqrt_4))
boundary_5 = BoundarySurfaces(Edges=cir_9)
preview_7 = CustomPreview(Geometry=boundary_5, Material=point_color_5)
previewlw_8 = CustomPreviewLineweights(Geometry=data_142, Shader=data_145, Thickness=data_143, Absolute=False)

entwine = Entwine(
    Branch00=merge_5,
    Branch01=merge_6,
    Branch02=merge_7,
    Branch03=merge_8,
    Branch04=merge_9,
    Branch05=merge_10,
    Branch06=merge_11,
    FlattenInputs=True)

# ---- group: Points
# 5.1500TPD
data_148 = Data(point_12)

# ----
point_color_6 = Data(point_color)

# ---- group: Capacity
data_149 = Data(data_71)

# ---- group: llinkage
data_150 = Data(curve_6)

# ---- group: Thickness
data_151 = Data(thickness)

# ---- group: Line Color
data_152 = Data(line_color)

# ---- group: Linkage
# 5.1500TPD
data_153 = Data(data_70)

# ---- group: Line Thickness
data_154 = Data(number_slider_12)

# ----
line_color_6 = Data(swatch)
previewlw_9 = CustomPreviewLineweights(Geometry=data_153, Shader=line_color_6, Thickness=data_154, Absolute=False)

sqrt_5 = SquareRoot(Value=data_149)
cir_10 = Circle(Plane=data_148, Radius=expr("x/40", sqrt_5))
boundary_6 = BoundarySurfaces(Edges=cir_10)
preview_8 = CustomPreview(Geometry=boundary_6, Material=point_color_6)
previewlw_10 = CustomPreviewLineweights(Geometry=data_150, Shader=data_152, Thickness=data_151, Absolute=False)

panel_129 = Panel(entwine)
excelwrite = ExcelWrite(WriteExcelData=False, WorksheetName="Sheet1", ColumnHeadings=panel_128, Data=entwine, ClearSheet=False)

# ---- group: Linkage
# 6.3000TPD
data_155 = Data(data_87)

# ---- group: Line Thickness
data_156 = Data(number_slider_12)

# ----
line_color_7 = Data(swatch)
previewlw_11 = CustomPreviewLineweights(Geometry=data_155, Shader=line_color_7, Thickness=data_156, Absolute=False)

# ---- group: Points
# 6.3000TPD
data_157 = Data(point_14)

# ----
point_color_7 = Data(point_color)

# ---- group: Capacity
data_158 = Data(data_88)

# ---- group: llinkage
data_159 = Data(curve_7)

# ---- group: Thickness
data_160 = Data(thickness)

# ---- group: Line Color
data_161 = Data(line_color)

# ----
sqrt_6 = SquareRoot(Value=data_158)
cir_11 = Circle(Plane=data_157, Radius=expr("x/40", sqrt_6))
boundary_7 = BoundarySurfaces(Edges=cir_11)
preview_9 = CustomPreview(Geometry=boundary_7, Material=point_color_7)
previewlw_12 = CustomPreviewLineweights(Geometry=data_159, Shader=data_161, Thickness=data_160, Absolute=False)

# ---- group: Points
# 7.12000TPD
data_162 = Data(point_15)

# ----
point_color_8 = Data(point_color)

# ---- group: Capacity
data_163 = Data(data_103)

# ---- group: llinkage
data_164 = Data(curve_8)

# ---- group: Thickness
data_165 = Data(thickness)

# ---- group: Line Color
data_166 = Data(line_color)

# ---- group: Linkage
# 7.12000TPD
data_167 = Data(data_105)

# ---- group: Line Thickness
data_168 = Data(number_slider_12)

# ----
line_color_8 = Data(swatch)
previewlw_13 = CustomPreviewLineweights(Geometry=data_167, Shader=line_color_8, Thickness=data_168, Absolute=False)

sqrt_7 = SquareRoot(Value=data_163)
cir_12 = Circle(Plane=data_162, Radius=expr("x/40", sqrt_7))
boundary_8 = BoundarySurfaces(Edges=cir_12)
preview_10 = CustomPreview(Geometry=boundary_8, Material=point_color_8)
previewlw_14 = CustomPreviewLineweights(Geometry=data_164, Shader=data_166, Thickness=data_165, Absolute=False)

# ----
# Buffer
number_slider_13 = Slider(12, range=0..100)

# ----
# Buffer
number_slider_14 = Slider(1, range=0..10)

# ----
# V.DISTRIBUTION OF 200 RESIDENTIAL BLOCKS
crv_2 = Curve([<curve referenced from the Rhino model> x628])
pt_2 = Point(point)

cir_13 = Circle(Plane=pt_2, Radius=Slider(20, range=0..100))
offset = OffsetCurve(Curve=cir_13, Distance=number_slider_14, Plane=pt_2, Corners=1)

cir_14 = Circle(Plane=pt_2, Radius=number_slider_13)
offset_2 = OffsetCurve(Curve=cir_14, Distance=Slider(1, range=0..10), Plane=PlaneXY(0, 0, 0), Corners=1)

# ----
# 2.Target
merge_12 = Merge(Data1=area.Area, Data2=area_2.Area, Data3=area_3.Area)
merge_13 = Merge(Data1=merge_12, Data2=merge_12, Data3=merge_12)
ma_8 = MassAddition(Input=merge_13)  # -> Result, PartialResults

# ----
# 1.Ratio of household distribution
division_2 = Division(A=merge_13, B=ma_8.Result)
multiplication_2 = Multiplication(A=division_2, B="100")
int = Integer(multiplication_2)
division_3 = Division(A=int, B="100")
ratio = Panel(division_3)

# ---- group: 10Million
multiplication_3 = Multiplication(A=ratio, B="10")

# ----
divide = DivideCurve(Curve=offset, Count=number_slider_4, Kinks=False)  # -> flatten(Points), Tangents, Parameters
divide_2 = DivideCurve(Curve=offset_2, Count=number_slider_5, Kinks=False)  # -> flatten(Points), Tangents, Parameters

# ----
# First Tier
# Second Tier
# Third Tier
neighborhood_cells = NeighborhoodCells(basic_cells=crv_2, points=pt_2, start_number=cbd, target_number=panel)  # -> flatten(cells), rest_cells, flatten(R)
neighborhood_cells_2 = NeighborhoodCells(basic_cells=neighborhood_cells.rest_cells, points=divide_2.Points, start_number=number_slider_7, target_number="3")  # -> flatten(cells), rest_cells, flatten(R)
neighborhood_cells_3 = NeighborhoodCells(basic_cells=neighborhood_cells_2.rest_cells, points=divide.Points, start_number=number_slider_6, target_number="2")  # -> flatten(cells), rest_cells, flatten(R)
panel_130 = Panel(neighborhood_cells_3.R)
panel_131 = Panel(neighborhood_cells_2.R)
panel_132 = Panel(neighborhood_cells.R)

random_reduce = RandomReduce(List=neighborhood_cells.cells, Reduction=1, Seed=1)  # -> flatten(List)

boundary_9 = BoundarySurfaces(Edges=random_reduce)
boundary_10 = BoundarySurfaces(Edges=neighborhood_cells_2.cells)
boundary_11 = BoundarySurfaces(Edges=neighborhood_cells_3.cells)

preview_11 = CustomPreview(Geometry=boundary_9, Material=ColourSwatch(SwatchColor=RGBA(255, 0, 0, 180)))
preview_12 = CustomPreview(Geometry=boundary_10, Material=ColourSwatch(SwatchColor=RGBA(255, 0, 0, 130)))
preview_13 = CustomPreview(Geometry=boundary_11, Material=ColourSwatch(SwatchColor=RGBA(255, 0, 0, 60)))

# ---- group: Evolutionary solver
distribution_of_facilities = DistributionOfFacilities(
    residential_1=random_reduce,
    residential_2=neighborhood_cells_2.cells,
    residential_3=neighborhood_cells_3.cells,
    count=number)  # -> residential_points, facility_points, facility_capacity, linkages, mileage_of_all_connections

# ----
# VI.Distribution of Facilities
panel_133 = Panel(number)
viewer = ParamViewer(distribution_of_facilities.facility_capacity)
panel_134 = Panel(distribution_of_facilities.facility_capacity)
panel_135 = Panel(distribution_of_facilities.mileage_of_all_connections)

populations = Panel(multiplication_3)

# ---- group: Residential district(0.05Million)
division_4 = Division(A=populations, B="0.05")

# ----
number_of_needed_districts = Panel(division_4)

# ----
# Lloyd's algorithm
voronoi = Voronoi(Points=hs.Feedback, Boundary=crv, BruteForceOverride=False)
area_5 = Area(Geometry=voronoi)  # -> Area, Centroid
# 3.Voronoi Relaxation
hs = HoopSnake(
    StartingData=cull,
    Data=area_5.Centroid,
    Hoopsnake_Data_autoUpdate=False,
    Hoopsnake_Data_dataLimit=2147483647,
    Hoopsnake_Data_delay=0,
    Hoopsnake_Data_resetCounter=False,
    Hoopsnake_Data_updateView=True)  # -> Feedback, CumulativeFeedback, LoopsCounter, flatten(IterationsCounter)
panel_136 = Panel(hs.IterationsCounter)

# ==== cluster NeighborhoodCells
basic_cells = ClusterInput()
points = ClusterInput()
start_number = ClusterInput()
target_number = ClusterInput()
area = Area(Geometry=basic_cells)  # -> Area, Centroid
graft = GraftTree(Tree=points, IncludeEmptyLists=True, IncludeNullItems=True)
addition = Addition(A=start_number, B=target_number)
dom = ConstructDomain(DomainStart=start_number, DomainEnd=expr("x-1", addition))
dist = Distance(PointA=area.Centroid, PointB=graft)  # -> simplify(Distance)
sort = SortList(Keys=dist)  # -> Keys, ValuesA
subset = SubList(List=sort.Keys, Domain=dom, Wrap=True)  # -> simplify(List), Index
lng = ListLength(List=points)
index = ItemIndex(List=basic_cells, Item=basic_cells)
mindex = MemberIndex(Set=dist, Member=subset.List)  # -> Index, Count
lng_2 = ListLength(List=subset.List)
difference = SetDifference(SetA=flatten(index), SetB=flatten(mindex.Index))
item = ListItem(List=basic_cells, Index=mindex.Index, Wrap=True)
multiplication = Multiplication(A=lng_2, B=lng)
item_2 = ListItem(List=basic_cells, Index=difference, Wrap=True)
panel = Panel(multiplication)
R = ClusterOutput(multiplication)
cells = ClusterOutput(item)
rest_cells = ClusterOutput(item_2)
sort_2 = SortList(Keys=flatten(mindex.Index))  # -> Keys, ValuesA
panel_2 = Panel(sort_2.Keys)
cset = CreateSet(List=panel_2)  # -> Set, Map
panel_3 = Panel(cset.Set)

# ==== cluster DistributionOfFacilities
residential_1 = ClusterInput()
residential_2 = ClusterInput()
residential_3 = ClusterInput()
count = ClusterInput()

# ---- group: Generating Facility points
# Generating Facility points by Gene pool
panel = Panel("GeneList X")
vb = VBScript(genelist=panel, count=count)  # -> out, A
# ---------- vb: VB ----------
    For Each obj As IGH_DocumentObject In owner.OnPingDocument().Objects
      If (obj.ComponentGuid <> New Guid("{21553c44-ea62-475e-a8bb-62b2a3ee5ca5}")) Then Continue For
      If (obj.NickName Like genelist) Then
        CallByName(obj, "Count", CallType.Set, count)
        'CallByName(obj, "ExpireSolution", CallType.Method, False)
        Return
      End If
    Next

    Print("No matching Gene list object found")
# ---------- end vb ----------
vb_2 = VBScript(genelist="GeneList Y", count=count)  # -> out, A; same code as vb
genelist_x = GenePool(Decimals=3, Maximum=100, Minimum=0, Value=49.837)
genelist_y = GenePool(Decimals=3, Maximum=100, Minimum=0, Value=49.536)
pt = ConstructPoint(XCoordinate=genelist_x, YCoordinate=genelist_y, ZCoordinate=0)
viewer = ParamViewer(pt)

# ---- group: All of the Residential cells
# Centroid points of Residential Cells
merge = Merge(Data1=residential_1, Data2=residential_2, Data3=residential_3)  # -> graft(Result)
area = Area(Geometry=merge)  # -> Area, simplify(Centroid)

# ----
viewer_2 = ParamViewer(area.Centroid)

# ---- group: Duplicate points list into Tree
# Duplicating Facility list into a tree which
# contains 200 branch (same number with cells)
flatten = FlattenTree(Tree=area.Centroid, Path="{0}")
lng = ListLength(List=flatten)
dup = DuplicateData(Data="0", Number=lng, Order=True)
branch = TreeBranch(Tree=pt, Path=dup, MaintainPaths=False)
viewer_3 = ParamViewer(branch)
panel_2 = Panel(branch)

# ---- group: Nearest facility
# Distance from Cell to facility>Sorting>Smallest number
# (nearest facility in a list)>Index of nearest facility for each cell
dist = Distance(PointA=area.Centroid, PointB=pt)  # -> simplify(Distance)
panel_3 = Panel(dist)
sort = SortList(Keys=dist)  # -> Keys, ValuesA
panel_4 = Panel(sort.Keys)
dom = ConstructDomain(DomainStart=0, DomainEnd=0.5)
subset = SubList(List=sort.Keys, Domain=dom, Wrap=True)  # -> simplify(List), Index
panel_5 = Panel(subset.List)
mindex = MemberIndex(Set=dist, Member=subset.List)  # -> simplify(Index), Count
panel_6 = Panel(mindex.Index)

# ---- group: Facility points
item = ListItem(List=branch, Index=mindex.Index, Wrap=True)

# ---- group: Cells points
pt_2 = Point(area.Centroid)

# ----
# Solver
galapagos = Galapagos(fitness=precesion, gene=[genelist_x, genelist_y])

# ---- group: Connections
ln = Line(StartPoint=pt_2, EndPoint=item)

# ---- group: Cull duplicate
flatten_2 = FlattenTree(Tree=item, Path="{0}")
cullpt = CullDuplicates(Points=flatten_2, Tolerance=0.1, CullMode=1)  # -> Points, Indices, Valence

# ---- group: Mileage
len = Length(Curve=ln)  # -> flatten(Length)
ma = MassAddition(Input=len)  # -> Result, PartialResults

# ----
multiplication = Multiplication(A=cullpt.Valence, B=30)
precesion = Precesion(A=ma.Result)
mileage_of_all_connections = ClusterOutput(precesion)
residential_points = ClusterOutput(pt_2)
facility_capacity = ClusterOutput(multiplication)
facility_points = ClusterOutput(cullpt.Points)
linkages = ClusterOutput(ln)

# ==== cluster Number
# 1 residential district generates 60 tonnes waste per day
number_slider = Slider(60, range=0..100)
facility_capacity = ClusterInput()
multiplication = Multiplication(A=number_slider, B=Slider(200, range=0..1000))
panel = Panel(multiplication)
division = Division(A=panel, B=facility_capacity)
int = Integer(division)
panel_2 = Panel(int)
amounts_of_needed_facilities = ClusterOutput(int)

# ==== cluster Cluster
d1 = ClusterInput()
d2 = ClusterInput()
merge = Merge(Data1=flatten(d1), Data2=flatten(d2))
graphfrompoints = GraphFromPoints(GraphPoints=merge, ConnectingDistance=Slider(50, range=0..100), undirected=True)
minst = MinST(Graph=graphfrompoints)
display_graph = DisplayGraph(Graph=minst, GraphPoints=merge, Value="-1", hidden=False)  # -> VertexCount, EdgeCount, Edge
length = Length(Curve=display_graph.Edge)
mass_addition = MassAddition(Input=length)  # -> Result, PartialResults
division = Division(A=mass_addition.Result, B=2)
crv = Curve(display_graph.Edge)
panel = Panel(division)
mininmal_spanning = ClusterOutput(division)
crv_2 = ClusterOutput(crv)

# ==== cluster Coefficients
land_price_for_each_facility = ClusterInput()  # euro/m2 per year
transportation_distance = ClusterInput()
facility_capacity = ClusterInput()
function_days_per_year = ClusterInput()
life_time = ClusterInput()

# ---- group: Indoor Floor Area(m2)
expression = Expression(x=facility_capacity, Expression="15.39*x+800")

# ---- group: Electricity Consumption（kwh)
expression_2 = Expression(x=expression, Expression="1.607*0.04*x+0.706*(1-0.04)*x")

# ---- group: Construction Cost 600Euro/m2
expression_3 = Expression(A=expression, Expression="612*A")

# ---- group: Transportation Diesel Consumption（L）
expression_4 = Expression(D=transportation_distance, Expression="D*60*0.0272")

# ---- group: Processing Diesel Consumption(L)
expression_5 = Expression(x=facility_capacity, Expression="0.7*x+4.8")

# ---- group: Equipment Cost(Euro/Mg)
expression_6 = Expression(x=facility_capacity, Expression="2.69*x+200")

# ----
# Diesel Consumption (L)
merge = Merge(Data1=flatten(expression_4), Data2=flatten(expression_5))
mass_addition = MassAddition(Input=flatten(merge))  # -> Result, PartialResults
# Cost of Diesel per Year (euro)
multiplication = Multiplication(A=mass_addition.Result, B=function_days_per_year)

# ----
# Electricity Consumption per Year (L)
mass_addition_2 = MassAddition(Input=flatten(expression_2))  # -> Result, PartialResults
# Cost of Electricity per Year (euro)
multiplication_2 = Multiplication(A=mass_addition_2.Result, B=function_days_per_year)

# ----
# Equipment Cost per Year (euro)
mass_addition_3 = MassAddition(Input=flatten(expression_6))  # -> Result, PartialResults
multiplication_3 = Multiplication(A=mass_addition_3.Result, B=function_days_per_year)

# ----
# Construction Cost per Year (euro)
mass_addition_4 = MassAddition(Input=flatten(expression_3))  # -> Result, PartialResults
division = Division(A=mass_addition_4.Result, B=life_time)

# ---- group: Diesel Cost(euro/L)
E = Expression(D=multiplication, Expression="0.842*D")

# ---- group: Electricity Cost(euro/kwh)
E_2 = Expression(E=multiplication_2, Expression="0.0868*E")

# ---- group: Requied Land Area(m2)
expression_7 = Expression(I=expression, Expression="3*I")

# ----
# Land Cost per Year (euro)
multiplication_4 = Multiplication(LandPrice=land_price_for_each_facility, LandArea=expression_7)
# Indoor Floor Area & Site Area
mass_addition_5 = MassAddition(Input=multiplication_4)  # -> Result, PartialResults

consumption_of_electricity_per_year = ClusterOutput(multiplication_2)  # (kwh)
consumption_of_diesel_per_year = ClusterOutput(multiplication)  # (L)
cost_of_construction_per_year = ClusterOutput(division)  # Total Cost/Life time
# Equipment Cost = 2.69*SUM(capacity)+200*N
# N
cost_of_equipment_per_year = ClusterOutput(multiplication_3)  # Includes purchasing, O&M; equation represents how much will be cost when processing one Mg.
cost_of_land_lease_per_year = ClusterOutput(mass_addition_5.Result)  # (euro)
# N
# 1.607*0.04*x+0.706*(1-0.04)*x=(1.607*0.04+0.706*0.96)*Indoor Floor Area
cost_of_electricity_per_year = ClusterOutput(E_2)  # (euro)
# Location&Linkages
cost_of_diesel_per_year = ClusterOutput(E)  # (euro)
# Cost of Construction= 612* Indoor Floor Area=(15.39*SUM x+800*N)*612
# N
# Required Land Area=(15.39*SUM x+800*N)*3
# Location
# Land price various based on the location
required_land_area = ClusterOutput(expression_7)  # (m2)
# N
# indoor Floor Area=(15.39*x1+800)+(15.39*x2+800)+......(15.39*xn+800)
# =15.39*(x1+x2+x3+...Xn)+800*N
# =15.39*SUM x+800*N
# N
indoor_floor_area = ClusterOutput(expression)

# ==== cluster Cluster_2
# Emission Factor :
# 
# Diesel fuel
# CO2: (10.21kg/gallon) (2.6975kg/L)
# CH4: (0.57g/gallon)(0.1506g/L)
# N2O: (0.26g/gallon)(0.0687g/L)
consumption_of_diesel_per_year = ClusterInput()
year = ClusterInput()
expression = Expression(x=consumption_of_diesel_per_year, y=year, Expression="0.1506*x*y*0.001*0.001")
expression_2 = Expression(x=consumption_of_diesel_per_year, y=year, Expression="0.0687*x*y*0.001*0.001")
expression_3 = Expression(x=consumption_of_diesel_per_year, y=year, Expression="2.6975*x*y*0.001")
co2_emission_ton = ClusterOutput(expression_3)
ch4_emission_ton = ClusterOutput(expression)
n2o_emission_ton = ClusterOutput(expression_2)

# ==== cluster Cluster_3
# Emission Factor :
# 
# Electricity
# CO2: (1,232.35lb/MWh) (0.55899396kg/KWh)
# CH4: (0.02414lb/MWh)(0.000010949904kg/KWh)
# N2O: (0.01826lb/MWh)(0.000008282736kg/KWh)
consumption_of_electricity_per_year = ClusterInput()
year = ClusterInput()
expression = Expression(x=consumption_of_electricity_per_year, y=year, Expression="0.000008282736*x*y*0.001")
expression_2 = Expression(x=consumption_of_electricity_per_year, y=year, Expression="0.000010949904*x*y*0.001")
expression_3 = Expression(x=consumption_of_electricity_per_year, y=year, Expression="0.55899396*x*y*0.001")
ch4_emission_ton = ClusterOutput(expression_2)
co2_emission_ton = ClusterOutput(expression_3)
n2o_emission_ton = ClusterOutput(expression)

# ==== cluster Cluster_7
facility_capacity = ClusterInput()
days = ClusterInput()  # operating days per year

# ---- group: Efficiency
cluster = Cluster_5(facility_capacity=facility_capacity)  # -> e_paper, e_glass, e_ferrous, e_aluminium, e_plastic, e_organic

# ---- group: Generated Waste per Year
cluster_2 = Cluster_6(facility_capacity=facility_capacity, days=days)  # -> paper_ton, glass_ton, ferrous_ton, alum_ton, plastic_ton, organic_ton

# ---- group: Recoveryed material
multiplication = Multiplication(A=cluster_2.paper_ton, B=cluster.e_paper)
multiplication_2 = Multiplication(A=cluster_2.glass_ton, B=cluster.e_glass)
multiplication_3 = Multiplication(A=cluster_2.ferrous_ton, B=cluster.e_ferrous)
multiplication_4 = Multiplication(A=cluster_2.alum_ton, B=cluster.e_aluminium)
multiplication_5 = Multiplication(A=cluster_2.plastic_ton, B=cluster.e_plastic)
multiplication_6 = Multiplication(A=cluster_2.organic_ton, B=cluster.e_organic)

# ----
expression = Expression(x=multiplication_4, Expression="x*1250")
expression_2 = Expression(x=multiplication_5, Expression="x*330")
expression_3 = Expression(x=multiplication_3, Expression="x*120")
expression_4 = Expression(x=multiplication, Expression="x*70")
expression_5 = Expression(x=multiplication_2, Expression="x*23")

ma = MassAddition(Input=multiplication_6)  # -> Result, PartialResults
ma_2 = MassAddition(Input=expression)  # -> Result, PartialResults
ma_3 = MassAddition(Input=expression_3)  # -> Result, PartialResults
ma_4 = MassAddition(Input=expression_5)  # -> Result, PartialResults
ma_5 = MassAddition(Input=expression_4)  # -> Result, PartialResults
ma_6 = MassAddition(Input=expression_2)  # -> Result, PartialResults
recovered_organic_waste = ClusterOutput(ma.Result)
paper_revenue = ClusterOutput(ma_5.Result)
glass_revenue = ClusterOutput(ma_4.Result)
alum_revenue = ClusterOutput(ma_2.Result)
ferrous_revenue = ClusterOutput(ma_3.Result)
plastic_revenue = ClusterOutput(ma_6.Result)

# ==== cluster Precesion
A = ClusterInput()
multiplication = Multiplication(A=A, B="1000")
integer = Integer(multiplication)
division = Division(A=integer, B="1000")
result = ClusterOutput(division)

# ==== cluster Cluster_5
facility_capacity = ClusterInput()

# ---- group: E-Paper
cluster = Cluster_4(facility_capacity=facility_capacity, lowest_number="0.50", largest_number="0.75")

# ---- group: E-Glass
cluster_2 = Cluster_4(facility_capacity=facility_capacity, lowest_number="0.80", largest_number="0.90")

# ---- group: E-Aluminium
cluster_3 = Cluster_4(facility_capacity=facility_capacity, lowest_number="0.90", largest_number="0.95")

# ---- group: E-Ferrous
cluster_4 = Cluster_4(facility_capacity=facility_capacity, lowest_number="0.90", largest_number="0.95")

# ---- group: E-Plastic
cluster_5 = Cluster_4(facility_capacity=facility_capacity, lowest_number="0.75", largest_number="0.90")

# ---- group: E-Organic
cluster_6 = Cluster_4(facility_capacity=facility_capacity, lowest_number="0.80", largest_number="0.90")

# ----
e_ferrous = ClusterOutput(cluster_4)
e_aluminium = ClusterOutput(cluster_3)
e_organic = ClusterOutput(cluster_6)
e_plastic = ClusterOutput(cluster_5)
e_paper = ClusterOutput(cluster)
e_glass = ClusterOutput(cluster_2)

# ==== cluster Cluster_6
days = ClusterInput()
facility_capacity = ClusterInput()  # how much waste will be dealt each day
multiplication = Multiplication(TPD=facility_capacity, OperatingDays=days)

# ---- group: Paper(ton)
expression = Expression(x=multiplication, Expression="0.28*x")

# ---- group: Glass(ton)
expression_2 = Expression(x=multiplication, Expression="0.05*x")

# ---- group: Ferrous(ton)
expression_3 = Expression(x=multiplication, Expression="0.07*x")

# ---- group: Alum(ton)
expression_4 = Expression(x=multiplication, Expression="0.01*x")

# ---- group: Plastic(ton)
expression_5 = Expression(x=multiplication, Expression="0.13*x")

# ---- group: Organic(ton)
expression_6 = Expression(x=multiplication, Expression="0.46*x")

# ----
organic_ton = ClusterOutput(expression_6)
ferrous_ton = ClusterOutput(expression_3)
plastic_ton = ClusterOutput(expression_5)
paper_ton = ClusterOutput(expression)
glass_ton = ClusterOutput(expression_2)
alum_ton = ClusterOutput(expression_4)

# ==== cluster Cluster_4
facility_capacity = ClusterInput()
lowest_number = ClusterInput()
largest_number = ClusterInput()
dom = ConstructDomain(DomainStart=lowest_number, DomainEnd=largest_number)
remap = RemapNumbers(Value=facility_capacity, Source=Domain(100, 12000), Target=dom)  # -> Mapped, Clipped
efficiency_for_each_facility = ClusterOutput(remap.Mapped)
