# Grasshopper definition Solver P-C.gh (Grasshopper 1.0.5)
# plug-ins: Human, HoopSnake, LunchBox

# ----
# Spatial Configuration
outputs = Panel("")

_1km = Slider(1, range=0..1)
number_slider = Slider(100, range=0..100)

# ---- group: Merge fields / 3 centers
# II.SPATIAL DEMAND CONE SIMULATION
point = Point([Point(50, 71.65127019, 0), Point(25, 28.35, 0), Point(75, 28.35, 0)])

# ---- group: Merge fields
number_slider_2 = Slider(5, range=1..10)
number_slider_3 = Slider(1.4, range=0.9..2.5)

# ----
# III.HOUSEHOLDS DISTRIBUTION CONE SIMULATION
_0_10km = Curve(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)
_10_20km = Curve(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)
_20_30km = Curve(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)
area = Area(Geometry=_0_10km)  # -> Area, Centroid
area_2 = Area(Geometry=_10_20km)  # -> Area, Centroid
area_3 = Area(Geometry=_20_30km)  # -> Area, Centroid

# ---- group: How many cells should a CBD possess
cbd = Slider(20, range=20..40)

# ---- group: How many subcenters
number_slider_4 = Slider(4, range=0..10)

number_slider_5 = Slider(4, range=0..10)

# ---- group: Merge fields
pcharge = PointCharge(Point=point, Charge=number_slider_2, Decay=number_slider_3)
mergef = MergeFields(Fields=pcharge)

# ---- group: Subcenter non-residential block
number_slider_6 = Slider(1, range=0..40)

number_slider_7 = Slider(2, range=0..40)

# ----
# Cells Distribution
panel = Panel("47")

# ---- group: Target number of cells
division = Division(A=Slider(200, range=0..1000), B="0.32")
panel_2 = Panel(division)

# ----
panel_3 = Panel("""10
20
30
40""")

# ----
# I.BASIC GRID
# 4.Buffer
sqgrid = Square(Plane=PlaneXY(0, 0, 0), Size=_1km, ExtentX=number_slider, ExtentY=number_slider)  # -> Cells, Points
bbox = BoundingBox(Content=flatten(sqgrid.Cells), Plane=PlaneXY(0, 0, 0), UnionBox=True)  # -> Box, Box_2
wires = BrepWireframe(Brep=bbox.Box, Density=-1)
join = JoinCurves(Curves=wires, Preserve=False)
curve = Curve(join)
area_4 = Area(Geometry=join)  # -> flatten(Area), flatten(Centroid)
center_point = Point(area_4.Centroid)
panel_4 = Panel(area_4.Area)
panel_5 = Panel("""GB50137-2011《城市用地分类与规划建设用地标准》：
居住用地占城市建设用地比例宜为25.0%~40.0%""")
panel_6 = Panel("""GB50137-2011《城市用地分类与规划建设用地标准》：
人均城镇建设用地的指标：每人100平方米左右""")
cir = Circle(Plane=center_point, Radius=panel_3)
preview = CustomPreview(Geometry=cir, Material=ColourSwatch(SwatchColor=RGBA(255, 255, 255, 31)))
panel_7 = Panel("100km2")

# ---- group: Divide Surface
boundary = BoundarySurfaces(Edges=curve)
number_slider_8 = Slider(50, range=0..100)

# ---- group: Boundary inherited from I
crv = Curve(curve)

# ---- group: Divide Surface
sdivide = DivideSurface(Surface=boundary, UCount=number_slider_8, VCount=number_slider_8)  # -> flatten(Points), Normals, Parameters

# ---- group: Evaluate Grid Points
evf = EvaluateField(Field=mergef, Point=sdivide.Points)  # -> Tensor, Strength
graph = GraphMapper(evf.Strength, x0=0, x1=1, y0=0, y1=1, container_name="Bezier", cpx=[0, 0.1352282465, 0.228681922, 1], cpy=[0, 0, 1, 1])

# ----
# IV.DISTORTED HEXAGON
bnd = Bounds(Numbers=evf.Strength)
remap = RemapNumbers(Value=evf.Strength, Source=bnd, Target=Domain(0, 1))  # -> Mapped, Clipped
graph_2 = GraphMapper(
    remap.Mapped,
    x0=0,
    x1=1,
    y0=0,
    y1=1,
    container_name="Bezier",
    cpx=[0, 0.1567152888, 0.3960031569, 1],
    cpy=[0, 0.3554871082, 0.7025407553, 0.8235858679])
dom = ConstructDomain(DomainStart=0, DomainEnd=graph_2)

# ----
# Cull Pattern ( reduce points )
lng = ListLength(List=dom)
random = Random(Range=Domain(0, 1), Number=lng, Seed=2)
random_2 = Random(Range=dom, Number=1, Seed=random)  # -> flatten(Random)
# 2.Points with different density
larger = LargerThan(FirstNumber=random_2, SecondNumber=Slider(0.0058, range=0.0001..0.2))  # -> LargerThan, OrEqualTo
cull = CullPattern(List=sdivide.Points, CullPattern=larger.LargerThan)
lng_2 = ListLength(List=cull)
panel_8 = Panel(lng_2)

Z = UnitZ(Factor=graph)
multiplication = Multiplication(A=Z, B=Slider(30, range=0..100))

# ----
# 4.Moved Points
move = Move(Geometry=sdivide.Points, Motion=multiplication)  # -> Geometry, Transform

# ----
# 5.Spatial Demand Cone with color
number_slider_9 = Slider(0.8, range=0..1)
cir_2 = Circle(Plane=sdivide.Points, Radius=number_slider_9)  # disabled
pdecon = Deconstruct(Point=move.Geometry)  # -> XComponent, YComponent, ZComponent; disabled
cir_3 = Circle(Plane=move.Geometry, Radius=number_slider_9)  # disabled
bnd_2 = Bounds(Numbers=pdecon.ZComponent)  # disabled
rulesrf = RuledSurface(CurveA=cir_2, CurveB=cir_3)  # disabled
cap = CapHoles(Brep=rulesrf)  # disabled
remap_2 = RemapNumbers(Value=pdecon.ZComponent, Source=bnd_2, Target=Domain(0, 1))  # -> Mapped, Clipped; disabled
gradient = Gradient(LowerLimit=0, UpperLimit=1, Parameter=remap_2.Mapped, stops=[0: RGB(0, 192, 192), 0.481: RGB(203, 39, 63)])  # disabled
preview_2 = CustomPreview(Geometry=cap, Material=gradient)  # disabled

# ---- group: Points for evaluation
pt = Point(sdivide.Points)  # disabled

# ----
# 3.Distribution Cone
Z_2 = UnitZ(Factor=1)  # disabled
Z_3 = UnitZ(Factor=1)  # disabled
brep = Brep(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)  # disabled
number_slider_10 = Slider(0.8, range=0..1)  # disabled
move_2 = Move(Geometry=brep, Motion=Z_2)  # -> Geometry, Transform; disabled
line = LineSDL(Start=pt, Direction=Z_3, Length=50)  # disabled
bcx = BrepCurve(Brep=move_2.Geometry, Curve=line)  # -> Curves, flatten(Points); disabled
cir_4 = Circle(Plane=pt, Radius=number_slider_10)  # disabled
cir_5 = Circle(Plane=bcx.Points, Radius=number_slider_10)  # disabled
pdecon_2 = Deconstruct(Point=bcx.Points)  # -> XComponent, YComponent, ZComponent; disabled
rulesrf_2 = RuledSurface(CurveA=cir_4, CurveB=cir_5)  # disabled
bnd_3 = Bounds(Numbers=pdecon_2.ZComponent)  # disabled
cap_2 = CapHoles(Brep=rulesrf_2)  # disabled
remap_3 = RemapNumbers(Value=pdecon_2.ZComponent, Source=bnd_3, Target=Domain(0, 1))  # -> Mapped, Clipped; disabled
gradient_2 = Gradient(LowerLimit=0, UpperLimit=1, Parameter=remap_3.Mapped, stops=[0: RGB(0, 192, 192), 0.3: RGB(203, 39, 63)])  # disabled
preview_3 = CustomPreview(Geometry=cap_2, Material=gradient_2)  # disabled

# ---- group: Globle control
point_color = ColourSwatch(SwatchColor=RGB(0, 0, 0))
line_color = ColourSwatch(SwatchColor=RGB(95, 78, 85))
# 1. Facility Points and Linkages
thickness = Slider(3, range=0..10)

# ---- group: Global control
swatch = ColourSwatch(SwatchColor=RGB(0, 0, 0))
# 2. Minimal Spanning
number_slider_11 = Slider(3.6, range=0..10)

# ----
# Residential points
point_2 = Point(Tree({0}: [Point(15.6939624, 30.05877474, 0)], {1}: [Point(41.27704397, 71.90521357, 0)], {2}: [Point(82.08524135, 23.79572993, 0)], {3}: [Point(67.53324941, 32.36832968, 0)], {4}: [Point(29.9996881, 19.74799558, 0)], {5}: [Point(43.99865949, 69.96968013, 0)]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))

# ----
# Facility points
point_3 = Point([Point(7.4, 28, 0), Point(33.2, 71.8, 0), Point(92.2, 27.5, 0), Point(59.5, 28.9, 0), Point(23.8, 11, 0), Point(40.2, 29.3, 0), Point(49.9, 56.4, 0), Point(75.8, 11.1, 0), Point(71.2, 43.7, 0), Point(28.6, 43.7, 0), Point(65.9, 72.1, 0), Point(50.7, 89.3, 0)])

# ----
# Mininmal Spanning(km)
cluster = Cluster_7(d1=point_2, d2=point_3)  # -> mininmal_spanning, crv_2; disabled
data = Data(582.5831195)
panel_9 = Panel(data)
data_2 = Data([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])

# ----
# Facility capacity(TPD)
data_3 = Data([960, 1020, 1080, 1020, 960, 1080, 1080, 960, 960, 960, 960, 960])
panel_10 = Panel(data_3)

# ----
# Facility linkage
curve_2 = Curve(Tree({0}: [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], {1}: [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], {2}: [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], {3}: [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], {4}: [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], {5}: [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]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))
param_viewer = ParamViewer(curve_2)

# ----
# Linkage mileage(km)
data_4 = Data(1730.502)
panel_11 = Panel(data_4)

# ----
# Total Cost(euro)
data_5 = Data("40938954.604441")
panel_12 = Panel(data_5)

# ----
# Recovered organic waste (ton)
data_6 = Data("1627122.004034")
panel_13 = Panel(data_6)

# ----
# Total revenue (euro)
data_7 = Data("274418957.4")
panel_14 = Panel(data_7)

# ----
# Weighted Score
data_8 = Data(18419079.16)
panel_15 = Panel(data_8)

# ----
# GWP
data_9 = Data("40766.077235")
panel_16 = Panel(data_9)

# ---- group: Points
# 12
data_10 = Data(point_3)

# ----
point_color_2 = Data(point_color)

# ---- group: Capacity
data_11 = Data(data_3)

# ---- group: llinkage
data_12 = Data(curve_2)

# ---- group: Thickness
data_13 = Data(thickness)

# ---- group: Line Color
data_14 = Data(line_color)

# ---- group: Linkage
# 12
data_15 = Data(data_2)

# ---- group: Line Thickness
data_16 = Data(number_slider_11)

# ----
line_color_2 = Data(swatch)
previewlw = CustomPreviewLineweights(Geometry=data_15, Shader=line_color_2, Thickness=data_16, Absolute=False)

sqrt = SquareRoot(Value=data_11)
cir_6 = Circle(Plane=data_10, Radius=expr("x/40", sqrt))
boundary_2 = BoundarySurfaces(Edges=cir_6)
preview_4 = CustomPreview(Geometry=boundary_2, Material=point_color_2)
previewlw_2 = CustomPreviewLineweights(Geometry=data_12, Shader=data_14, Thickness=data_13, Absolute=False)

param_viewer_2 = ParamViewer(point_3)

# ----
# 12
param_viewer_3 = ParamViewer(point_2)

# ----
# Residential points
point_4 = Point(Tree({0}: [Point(15.6939624, 30.05877474, 0)], {1}: [Point(41.27704397, 71.90521357, 0)], {2}: [Point(82.08524135, 23.79572993, 0)], {3}: [Point(67.53324941, 32.36832968, 0)], {4}: [Point(29.9996881, 19.74799558, 0)], {5}: [Point(43.99865949, 69.96968013, 0)]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))

# ----
# Facility points
point_5 = Point([Point(7, 28.4, 0), Point(33.3, 72, 0), Point(91.4, 23.4, 0), Point(59.8, 27.4, 0), Point(24.2, 10.8, 0), Point(40.2, 29.3, 0), Point(50.1, 56.3, 0), Point(71.5, 43.4, 0), Point(28.5, 43.8, 0), Point(66, 71.8, 0), Point(50.4, 89.2, 0)])

# ----
# Mininmal Spanning(km)
cluster_2 = Cluster_7(d1=point_4, d2=point_5)  # -> mininmal_spanning, crv_2; disabled
data_17 = Data(584.2758015)
panel_17 = Panel(data_17)
data_18 = Data([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])

# ----
# Facility capacity(TPD)
data_19 = Data([960, 1020, 1500, 1440, 960, 1080, 1080, 1080, 960, 960, 960])
panel_18 = Panel(data_19)

# ----
# Facility linkage
curve_3 = Curve(Tree({0}: [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], {1}: [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], {2}: [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], {3}: [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], {4}: [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], {5}: [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]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))
param_viewer_4 = ParamViewer(curve_3)

# ----
# Linkage mileage(km)
data_20 = Data(1849.196)
panel_19 = Panel(data_20)

# ----
# Total Cost(euro)
data_21 = Data("40774353.143124")
panel_20 = Panel(data_21)

# ----
# GWP
data_22 = Data("40832.03099")
panel_21 = Panel(data_22)

# ----
# Recovered organic waste (ton)
data_23 = Data("1629153.735126")
panel_22 = Panel(data_23)

# ----
# Total revenue (euro)
data_24 = Data("274970837.4")
panel_23 = Panel(data_24)

# ----
# Weighted Score
data_25 = Data(18554579.68)
panel_24 = Panel(data_25)

# ---- group: Points
# 11
data_26 = Data(point_5)

# ----
point_color_3 = Data(point_color)

# ---- group: Capacity
data_27 = Data(data_19)

# ---- group: llinkage
data_28 = Data(curve_3)

# ---- group: Thickness
data_29 = Data(thickness)

# ---- group: Line Color
data_30 = Data(line_color)

# ---- group: Linkage
# 11
data_31 = Data(data_18)

# ---- group: Line Thickness
data_32 = Data(number_slider_11)

# ----
line_color_3 = Data(swatch)
previewlw_3 = CustomPreviewLineweights(Geometry=data_31, Shader=line_color_3, Thickness=data_32, Absolute=False)

point_color_4 = Data(point_color)

# ---- group: Thickness
data_33 = Data(Slider(1, range=0..1))

# ---- group: Line Color
data_34 = Data(line_color)

# ----
sqrt_2 = SquareRoot(Value=data_27)
cir_7 = Circle(Plane=data_26, Radius=expr("x/40", sqrt_2))
boundary_3 = BoundarySurfaces(Edges=cir_7)
preview_5 = CustomPreview(Geometry=boundary_3, Material=point_color_3)
previewlw_4 = CustomPreviewLineweights(Geometry=data_28, Shader=data_30, Thickness=data_29, Absolute=False)

param_viewer_5 = ParamViewer(point_5)

# ----
# 11
param_viewer_6 = ParamViewer(point_4)

# ----
# Residential points
point_6 = Point(Tree({0}: [Point(15.6939624, 30.05877474, 0)], {1}: [Point(41.27704397, 71.90521357, 0)], {2}: [Point(82.08524135, 23.79572993, 0)], {3}: [Point(67.53324941, 32.36832968, 0)], {4}: [Point(29.9996881, 19.74799558, 0)], {5}: [Point(43.99865949, 69.96968013, 0)]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))

# ----
# Facility points
point_7 = Point([Point(7.4, 28.9, 0), Point(33.3, 71.9, 0), Point(91.6, 23.6, 0), Point(59.6, 27.9, 0), Point(24.8, 10.5, 0), Point(37.1, 36.6, 0), Point(50.2, 56.2, 0), Point(71.7, 43.7, 0), Point(66.2, 71.7, 0), Point(50.6, 89.2, 0)])

# ----
# Mininmal Spanning(km)
cluster_3 = Cluster_7(d1=point_6, d2=point_7)  # -> mininmal_spanning, crv_2; disabled
data_35 = Data(588.1229502)
panel_25 = Panel(data_35)
data_36 = Data([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])

# ----
# Facility capacity(TPD)
data_37 = Data([1020, 1020, 1500, 1440, 1140, 1800, 1080, 1080, 960, 960])
panel_26 = Panel(data_37)

# ----
# Facility linkage
curve_4 = Curve(Tree({0}: [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], {1}: [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], {2}: [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], {3}: [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], {4}: [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], {5}: [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]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))
param_viewer_7 = ParamViewer(curve_4)

# ----
# Linkage mileage(km)
data_38 = Data(1972.603)
panel_27 = Panel(data_38)

# ----
# Total Cost(euro)
data_39 = Data("40606204.088756")
panel_28 = Panel(data_39)

# ----
# GWP
data_40 = Data("40905.625859")
panel_29 = Panel(data_40)

# ----
# Recovered organic waste (ton)
data_41 = Data("1631480.067227")
panel_30 = Panel(data_41)

# ----
# Total revenue (euro)
data_42 = Data("275602740")
panel_31 = Panel(data_42)

# ----
# Weighted Score
data_43 = Data(18694807.03)
panel_32 = Panel(data_43)

# ---- group: Points
# 10
data_44 = Data(point_7)

# ----
point_color_5 = Data(point_color)

# ---- group: Capacity
data_45 = Data(data_37)

# ---- group: llinkage
data_46 = Data(curve_4)

# ---- group: Thickness
data_47 = Data(thickness)

# ---- group: Line Color
data_48 = Data(line_color)

# ---- group: Linkage
# 10
data_49 = Data(data_36)

# ---- group: Line Thickness
data_50 = Data(number_slider_11)

# ----
line_color_4 = Data(swatch)
previewlw_5 = CustomPreviewLineweights(Geometry=data_49, Shader=line_color_4, Thickness=data_50, Absolute=False)

sqrt_3 = SquareRoot(Value=data_45)
cir_8 = Circle(Plane=data_44, Radius=expr("x/40", sqrt_3))
boundary_4 = BoundarySurfaces(Edges=cir_8)
preview_6 = CustomPreview(Geometry=boundary_4, Material=point_color_5)
previewlw_6 = CustomPreviewLineweights(Geometry=data_46, Shader=data_48, Thickness=data_47, Absolute=False)

param_viewer_8 = ParamViewer(point_7)

# ----
# 10
param_viewer_9 = ParamViewer(point_6)

# ----
# Residential points
point_8 = Point(Tree({0}: [Point(15.6939624, 30.05877474, 0)], {1}: [Point(41.27704397, 71.90521357, 0)], {2}: [Point(82.08524135, 23.79572993, 0)], {3}: [Point(67.53324941, 32.36832968, 0)], {4}: [Point(29.9996881, 19.74799558, 0)], {5}: [Point(43.99865949, 69.96968013, 0)]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))

# ----
# Facility points
point_9 = Point([Point(6.9, 28.6, 0), Point(45.2, 57.3, 0), Point(90.4, 21.6, 0), Point(59.6, 28.5, 0), Point(24.7, 10.7, 0), Point(37.8, 36, 0), Point(71.8, 43.8, 0), Point(51, 89.3, 0), Point(66, 70.4, 0)])

# ----
# Mininmal Spanning(km)
cluster_4 = Cluster_7(d1=point_8, d2=point_9)  # -> mininmal_spanning, crv_2; disabled
data_51 = Data(590.6087468)
panel_33 = Panel(data_51)
data_52 = Data([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])

# ----
# Facility capacity(TPD)
data_53 = Data([1020, 1740, 1620, 1320, 1140, 1800, 1080, 1200, 1080])
panel_34 = Panel(data_53)

# ----
# Facility linkage
curve_5 = Curve(Tree({0}: [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], {1}: [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], {2}: [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], {3}: [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], {4}: [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], {5}: [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]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))
param_viewer_10 = ParamViewer(curve_5)

# ----
# Linkage mileage(km)
data_54 = Data(2104.675)
panel_35 = Panel(data_54)

# ----
# Total Cost(euro)
data_55 = Data("40418052.93578")
panel_36 = Panel(data_55)

# ----
# Recovered organic waste (ton)
data_56 = Data("1633775.923361")
panel_37 = Panel(data_56)

# ----
# GWP
data_57 = Data("40993.26916")
panel_38 = Panel(data_57)

# ----
# Total revenue (euro)
data_58 = Data("276226364.4")
panel_39 = Panel(data_58)

# ----
# Weighted Score
data_59 = Data(18836984.95)
panel_40 = Panel(data_59)

# ---- group: Points
# 9
data_60 = Data(point_9)

# ----
point_color_6 = Data(point_color)

# ---- group: Capacity
data_61 = Data(data_53)

# ---- group: llinkage
data_62 = Data(curve_5)

# ---- group: Thickness
data_63 = Data(thickness)

# ---- group: Line Color
data_64 = Data(line_color)

# ---- group: Linkage
# 9
data_65 = Data(data_52)

# ---- group: Line Thickness
data_66 = Data(number_slider_11)

# ----
line_color_5 = Data(swatch)
previewlw_7 = CustomPreviewLineweights(Geometry=data_65, Shader=line_color_5, Thickness=data_66, Absolute=False)

sqrt_4 = SquareRoot(Value=data_61)
cir_9 = Circle(Plane=data_60, Radius=expr("x/40", sqrt_4))
boundary_5 = BoundarySurfaces(Edges=cir_9)
preview_7 = CustomPreview(Geometry=boundary_5, Material=point_color_6)
previewlw_8 = CustomPreviewLineweights(Geometry=data_62, Shader=data_64, Thickness=data_63, Absolute=False)

param_viewer_11 = ParamViewer(point_9)

# ----
# P-Centralised
# 9
param_viewer_12 = ParamViewer(point_8)

# ---- group: Surface represent land price
# VII.Land price based location (euro/m2)
srfgrid = SurfaceFromPoints(Points=move.Geometry, UCount=expr("x+1", number_slider_8), Interpolate=False)
srf = Surface(srfgrid)

# ----
# Residential points
point_10 = Point(Tree({0}: [Point(15.6939624, 30.05877474, 0)], {1}: [Point(41.27704397, 71.90521357, 0)], {2}: [Point(82.08524135, 23.79572993, 0)], {3}: [Point(67.53324941, 32.36832968, 0)], {4}: [Point(29.9996881, 19.74799558, 0)], {5}: [Point(43.99865949, 69.96968013, 0)]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))

# ----
# Facility points
point_11 = Point([Point(6.9, 28.9, 0), Point(46.7, 56.4, 0), Point(91.9, 24.1, 0), Point(60.9, 33.2, 0), Point(24.2, 11.2, 0), Point(37.8, 35.6, 0), Point(46.4, 88.2, 0), Point(66.1, 68.9, 0)])

# ----
# Mininmal Spanning(km)
cluster_5 = Cluster_7(d1=point_10, d2=point_11)  # -> mininmal_spanning, crv_2; disabled
data_67 = Data(591.3842925)
panel_41 = Panel(data_67)
data_68 = Data([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])

# ----
# Facility capacity(TPD)
data_69 = Data([960, 1500, 1800, 2160, 1200, 1800, 1440, 1140])
panel_42 = Panel(data_69)

# ----
# Facility linkage
curve_6 = Curve(Tree({0}: [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], {1}: [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], {2}: [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], {3}: [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], {4}: [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], {5}: [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]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))
param_viewer_13 = ParamViewer(curve_6)

# ----
# Linkage mileage(km)
data_70 = Data(2236.094)
panel_43 = Panel(data_70)

# ----
# Total Cost(euro)
data_71 = Data("40287376.138683")
panel_44 = Panel(data_71)

# ----
# GWP
data_72 = Data("41079.853761")
panel_45 = Panel(data_72)

# ----
# Total revenue (euro)
data_73 = Data("277139725.8")
panel_46 = Panel(data_73)

# ----
# Recovered organic waste (ton)
data_74 = Data("1637138.438319")
panel_47 = Panel(data_74)

# ----
# Weighted Score
data_75 = Data(19006999.35)
panel_48 = Panel(data_75)

# ---- group: Points
# 8
data_76 = Data(point_11)

# ----
point_color_7 = Data(point_color)

# ---- group: Capacity
data_77 = Data(data_69)

# ---- group: llinkage
data_78 = Data(curve_6)

# ---- group: Thickness
data_79 = Data(thickness)

# ---- group: Line Color
data_80 = Data(line_color)

# ---- group: Linkage
# 8
data_81 = Data(data_68)

# ---- group: Line Thickness
data_82 = Data(number_slider_11)

# ----
line_color_6 = Data(swatch)
previewlw_9 = CustomPreviewLineweights(Geometry=data_81, Shader=line_color_6, Thickness=data_82, Absolute=False)

sqrt_5 = SquareRoot(Value=data_77)
cir_10 = Circle(Plane=data_76, Radius=expr("x/40", sqrt_5))
boundary_6 = BoundarySurfaces(Edges=cir_10)
preview_8 = CustomPreview(Geometry=boundary_6, Material=point_color_7)
previewlw_10 = CustomPreviewLineweights(Geometry=data_78, Shader=data_80, Thickness=data_79, Absolute=False)

param_viewer_14 = ParamViewer(point_11)

# ----
# Weighted-COST as fitness
# 8
param_viewer_15 = ParamViewer(point_10)

# ----
# Residential points
point_12 = Point(Tree({0}: [Point(15.6939624, 30.05877474, 0)], {1}: [Point(41.27704397, 71.90521357, 0)], {2}: [Point(82.08524135, 23.79572993, 0)], {3}: [Point(67.53324941, 32.36832968, 0)], {4}: [Point(29.9996881, 19.74799558, 0)], {5}: [Point(43.99865949, 69.96968013, 0)]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))

# ----
# Facility points
point_13 = Point([Point(7, 28.7, 0), Point(47.1, 56.6, 0), Point(92.2, 24.8, 0), Point(61.4, 34.3, 0), Point(24.4, 10.8, 0), Point(37.5, 36.2, 0), Point(55.2, 87.8, 0)])

# ----
# Mininmal Spanning(km)
cluster_6 = Cluster_7(d1=point_12, d2=point_13)  # -> mininmal_spanning, crv_2; disabled
data_83 = Data(588.1704904)
panel_49 = Panel(data_83)
data_84 = Data([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])

# ----
# Facility capacity(TPD)
data_85 = Data([1020, 2100, 1800, 2220, 1140, 1800, 1920])
panel_50 = Panel(data_85)

# ----
# Facility linkage
curve_7 = Curve(Tree({0}: [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], {1}: [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], {2}: [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], {3}: [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], {4}: [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], {5}: [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]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))
param_viewer_16 = ParamViewer(curve_7)

# ----
# Linkage mileage(km)
data_86 = Data(2389.709)
panel_51 = Panel(data_86)

# ----
# Total Cost(euro)
data_87 = Data("40083929.418089")
panel_52 = Panel(data_87)

# ----
# Recovered organic waste (ton)
data_88 = Data("1640968.251429")
panel_53 = Panel(data_88)

# ----
# GWP
data_89 = Data("41202.424397")
panel_54 = Panel(data_89)

# ----
# Total revenue (euro)
data_90 = Data("278180019.6")
panel_55 = Panel(data_90)

# ----
# Weighted Score
data_91 = Data(19171243.68)
panel_56 = Panel(data_91)

# ---- group: Points
# 7
data_92 = Data(point_13)

# ----
point_color_8 = Data(point_color)

# ---- group: Capacity
data_93 = Data(data_85)

# ---- group: llinkage
data_94 = Data(curve_7)

# ---- group: Thickness
data_95 = Data(thickness)

# ---- group: Line Color
data_96 = Data(line_color)

# ---- group: Linkage
# 7
data_97 = Data(data_84)

# ---- group: Line Thickness
# Visualization
data_98 = Data(number_slider_11)

# ----
line_color_7 = Data(swatch)
previewlw_11 = CustomPreviewLineweights(Geometry=data_97, Shader=line_color_7, Thickness=data_98, Absolute=False)

sqrt_6 = SquareRoot(Value=data_93)
cir_11 = Circle(Plane=data_92, Radius=expr("x/40", sqrt_6))
boundary_7 = BoundarySurfaces(Edges=cir_11)
preview_9 = CustomPreview(Geometry=boundary_7, Material=point_color_8)
previewlw_12 = CustomPreviewLineweights(Geometry=data_94, Shader=data_96, Thickness=data_95, Absolute=False)

param_viewer_17 = ParamViewer(point_13)

# ----
# Database
# 7
param_viewer_18 = ParamViewer(point_12)

# ----
# Residential points
point_14 = Point(Tree({0}: [Point(15.6939624, 30.05877474, 0)], {1}: [Point(41.27704397, 71.90521357, 0)], {2}: [Point(82.08524135, 23.79572993, 0)], {3}: [Point(67.53324941, 32.36832968, 0)], {4}: [Point(29.9996881, 19.74799558, 0)], {5}: [Point(43.99865949, 69.96968013, 0)]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))

# ----
# Facility points
point_15 = Point([Point(8.578, 20.583, 0), Point(49.31, 56.815, 0), Point(86.973, 16.389, 0), Point(64.357, 38.929, 0), Point(39.257, 33.234, 0), Point(53.325, 89.427, 0)])

# ----
# Mininmal Spanning(km)
cluster_7 = Cluster_7(d1=point_14, d2=point_15)  # -> mininmal_spanning, crv_2; disabled
data_99 = Data(596.9068773)
panel_57 = Panel(data_99)
data_100 = Data([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])

# ----
# Facility capacity(TPD)
data_101 = Data([1680, 2340, 1920, 2040, 2340, 1680])
panel_58 = Panel(data_101)

# ----
# Facility linkage
curve_8 = Curve(Tree({0}: [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], {1}: [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], {2}: [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], {3}: [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], {4}: [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], {5}: [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]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))
param_viewer_19 = ParamViewer(curve_8)

# ----
# Linkage mileage(km)
data_102 = Data(2568.883)
panel_59 = Panel(data_102)

# ----
# Total Cost(euro)
data_103 = Data("39866602.029777")
panel_60 = Panel(data_103)

# ----
# GWP
data_104 = Data("41366.433448")
panel_61 = Panel(data_104)

# ----
# Total revenue (euro)
data_105 = Data("279176163")
panel_62 = Panel(data_105)

# ----
# Recovered organic waste (ton)
data_106 = Data("1644635.52605")
panel_63 = Panel(data_106)

# ----
# Weighted Score
data_107 = Data(19363801.12)
panel_64 = Panel(data_107)

# ---- group: Points
# 6
data_108 = Data(point_15)

# ----
point_color_9 = Data(point_color)

# ---- group: Capacity
data_109 = Data(data_101)

# ---- group: llinkage
data_110 = Data(curve_8)

# ---- group: Thickness
data_111 = Data(thickness)

# ---- group: Line Color
data_112 = Data(line_color)

# ---- group: Linkage
# 6
data_113 = Data(data_100)

# ---- group: Line Thickness
data_114 = Data(number_slider_11)

# ----
line_color_8 = Data(swatch)
previewlw_13 = CustomPreviewLineweights(Geometry=data_113, Shader=line_color_8, Thickness=data_114, Absolute=False)

sqrt_7 = SquareRoot(Value=data_109)
cir_12 = Circle(Plane=data_108, Radius=expr("x/40", sqrt_7))
boundary_8 = BoundarySurfaces(Edges=cir_12)
preview_10 = CustomPreview(Geometry=boundary_8, Material=point_color_9)
previewlw_14 = CustomPreviewLineweights(Geometry=data_110, Shader=data_112, Thickness=data_111, Absolute=False)

param_viewer_20 = ParamViewer(point_15)

# ----
# 6
param_viewer_21 = ParamViewer(point_14)

# ----
# Residential points
point_16 = Point(Tree({0}: [Point(15.6939624, 30.05877474, 0)], {1}: [Point(41.27704397, 71.90521357, 0)], {2}: [Point(82.08524135, 23.79572993, 0)], {3}: [Point(67.53324941, 32.36832968, 0)], {4}: [Point(29.9996881, 19.74799558, 0)], {5}: [Point(43.99865949, 69.96968013, 0)]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))

# ----
# Facility points
point_17 = Point([Point(38.639, 33.902, 0), Point(49.157, 56.838, 0), Point(86.491, 16.052, 0), Point(63.974, 38.363, 0), Point(53.177, 89.439, 0)])

# ----
# Mininmal Spanning(km)
cluster_8 = Cluster_7(d1=point_16, d2=point_17)  # -> mininmal_spanning, crv_2; disabled
data_115 = Data(590.87371)
panel_65 = Panel(data_115)
data_116 = Data([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])

# ----
# Facility capacity(TPD)
data_117 = Data([3960, 2340, 1920, 2100, 1680])
panel_66 = Panel(data_117)

# ----
# Facility linkage
curve_9 = Curve(Tree({0}: [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], {1}: [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], {2}: [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], {3}: [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], {4}: [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], {5}: [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]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))
param_viewer_22 = ParamViewer(curve_9)

# ----
# Linkage mileage(km)
data_118 = Data(2853.151)
panel_67 = Panel(data_118)

# ----
# Total Cost(euro)
data_119 = Data("39576676.892752")
panel_68 = Panel(data_119)

# ----
# GWP
data_120 = Data("41700.829788")
panel_69 = Panel(data_120)

# ----
# Total revenue (euro)
data_121 = Data("282101127")
panel_70 = Panel(data_121)

# ----
# Recovered organic waste (ton)
data_122 = Data("1655403.70084")
panel_71 = Panel(data_122)

# ----
# Weighted Score
data_123 = Data(19665015.53)
panel_72 = Panel(data_123)

# ---- group: Points
# 5
data_124 = Data(point_17)

# ----
point_color_10 = Data(point_color)

# ---- group: Capacity
data_125 = Data(data_117)

# ---- group: llinkage
data_126 = Data(curve_9)

# ---- group: Thickness
data_127 = Data(thickness)

# ---- group: Line Color
data_128 = Data(line_color)

# ---- group: Linkage
# 5
data_129 = Data(data_116)

# ---- group: Line Thickness
data_130 = Data(number_slider_11)

# ----
line_color_9 = Data(swatch)
previewlw_15 = CustomPreviewLineweights(Geometry=data_129, Shader=line_color_9, Thickness=data_130, Absolute=False)

# ---- group: Z height range for price surface
panel_73 = Panel("1")
panel_74 = Panel("30")

# ---- group: Landprice in reality
panel_75 = Panel("60")
panel_76 = Panel("20")

# ----
sqrt_8 = SquareRoot(Value=data_125)
cir_13 = Circle(Plane=data_124, Radius=expr("x/40", sqrt_8))
boundary_9 = BoundarySurfaces(Edges=cir_13)
preview_11 = CustomPreview(Geometry=boundary_9, Material=point_color_10)
previewlw_16 = CustomPreviewLineweights(Geometry=data_126, Shader=data_128, Thickness=data_127, Absolute=False)

param_viewer_23 = ParamViewer(point_17)

# ----
# 5
param_viewer_24 = ParamViewer(point_16)

# ----
# Residential points
point_18 = Point(Tree({0}: [Point(15.6939624, 30.05877474, 0)], {1}: [Point(41.27704397, 71.90521357, 0)], {2}: [Point(82.08524135, 23.79572993, 0)], {3}: [Point(67.53324941, 32.36832968, 0)], {4}: [Point(29.9996881, 19.74799558, 0)], {5}: [Point(43.99865949, 69.96968013, 0)]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))

# ----
# Facility points
point_19 = Point([Point(38.6, 34, 0), Point(44.1, 87.3, 0), Point(61.3, 33.8, 0), Point(52.3, 56.5, 0)])

# ----
# Mininmal Spanning(km)
cluster_9 = Cluster_7(d1=point_18, d2=point_19)  # -> mininmal_spanning, crv_2; disabled
data_131 = Data(584.232429)
panel_77 = Panel(data_131)
data_132 = Data([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])

# ----
# Facility capacity(TPD)
data_133 = Data([3960, 1920, 3960, 2160])
panel_78 = Panel(data_133)

# ----
# Facility linkage
curve_10 = Curve(Tree({0}: [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], {1}: [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], {2}: [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], {3}: [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], {4}: [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], {5}: [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]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))
param_viewer_25 = ParamViewer(curve_10)

# ----
# Linkage mileage(km)
data_134 = Data(3176.317)
panel_79 = Panel(data_134)

# ----
# Total Cost(euro)
data_135 = Data("39231608.350999")
panel_80 = Panel(data_135)

# ----
# GWP
data_136 = Data("42098.290858")
panel_81 = Panel(data_136)

# ----
# Total revenue (euro)
data_137 = Data("285028850.4")
panel_82 = Panel(data_137)

# ----
# Recovered organic waste (ton)
data_138 = Data("1666182.034286")
panel_83 = Panel(data_138)

# ----
# Weighted Score
data_139 = Data(19992310.13)
panel_84 = Panel(data_139)

# ---- group: Points
# 4
data_140 = Data(point_19)

# ----
point_color_11 = Data(point_color)

# ---- group: Capacity
data_141 = Data(data_133)

# ---- group: llinkage
data_142 = Data(curve_10)

# ---- group: Thickness
data_143 = Data(thickness)

# ---- group: Line Color
data_144 = Data(line_color)

# ---- group: Linkage
# 4
data_145 = Data(data_132)

# ---- group: Line Thickness
data_146 = Data(number_slider_11)

# ----
line_color_10 = Data(swatch)
previewlw_17 = CustomPreviewLineweights(Geometry=data_145, Shader=line_color_10, Thickness=data_146, Absolute=False)

sqrt_9 = SquareRoot(Value=data_141)
cir_14 = Circle(Plane=data_140, Radius=expr("x/40", sqrt_9))
boundary_10 = BoundarySurfaces(Edges=cir_14)
preview_12 = CustomPreview(Geometry=boundary_10, Material=point_color_11)
previewlw_18 = CustomPreviewLineweights(Geometry=data_142, Shader=data_144, Thickness=data_143, Absolute=False)

param_viewer_26 = ParamViewer(point_19)

# ----
# 4
param_viewer_27 = ParamViewer(point_18)

# ----
# Residential points
point_20 = Point(Tree({0}: [Point(15.6939624, 30.05877474, 0)], {1}: [Point(41.27704397, 71.90521357, 0)], {2}: [Point(82.08524135, 23.79572993, 0)], {3}: [Point(67.53324941, 32.36832968, 0)], {4}: [Point(29.9996881, 19.74799558, 0)], {5}: [Point(43.99865949, 69.96968013, 0)]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))

# ----
# Facility points
point_21 = Point([Point(38.6, 34, 0), Point(49.8, 56.9, 0), Point(61.8, 34.8, 0)])

# ----
# Mininmal Spanning(km)
cluster_10 = Cluster_7(d1=point_20, d2=point_21)  # -> mininmal_spanning, crv_2; disabled
data_147 = Data(580.973174)
panel_85 = Panel(data_147)
data_148 = Data([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])

# ----
# Facility capacity(TPD)
data_149 = Data([3960, 4020, 4020])
panel_86 = Panel(data_149)

# ----
# Facility linkage
curve_11 = Curve(Tree({0}: [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], {1}: [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], {2}: [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], {3}: [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], {4}: [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], {5}: [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]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))
param_viewer_28 = ParamViewer(curve_11)

# ----
# Linkage mileage(km)
data_150 = Data(3514.8)
panel_87 = Panel(data_150)

# ----
# Total Cost(euro)
data_151 = Data("38826344.280324")
panel_88 = Panel(data_151)

# ----
# GWP
data_152 = Data("42520.585146")
panel_89 = Panel(data_152)

# ----
# Total revenue (euro)
data_153 = Data("288204919.8")
panel_90 = Panel(data_153)

# ----
# Recovered organic waste (ton)
data_154 = Data("1677874.646723")
panel_91 = Panel(data_154)

# ----
# Weighted Score
data_155 = Data(20310633.67)
panel_92 = Panel(data_155)

# ---- group: Points
# 3
data_156 = Data(point_21)

# ----
point_color_12 = Data(point_color)

# ---- group: Capacity
data_157 = Data(data_149)

# ---- group: llinkage
data_158 = Data(curve_11)

# ---- group: Thickness
data_159 = Data(thickness)

# ---- group: Line Color
data_160 = Data(line_color)

# ---- group: Linkage
data_161 = Data(data_148)

# ---- group: Line Thickness
data_162 = Data(number_slider_11)

# ----
line_color_11 = Data(swatch)
# 3
previewlw_19 = CustomPreviewLineweights(Geometry=data_161, Shader=line_color_11, Thickness=data_162, Absolute=False)

sqrt_10 = SquareRoot(Value=data_157)
cir_15 = Circle(Plane=data_156, Radius=expr("x/40", sqrt_10))
boundary_11 = BoundarySurfaces(Edges=cir_15)
preview_13 = CustomPreview(Geometry=boundary_11, Material=point_color_12)
previewlw_20 = CustomPreviewLineweights(Geometry=data_158, Shader=data_160, Thickness=data_159, Absolute=False)

param_viewer_29 = ParamViewer(point_21)

# ----
# 3
param_viewer_30 = ParamViewer(point_20)

# ----
# Residential points
point_22 = Point(Tree({0}: [Point(15.6939624, 30.05877474, 0)], {1}: [Point(41.27704397, 71.90521357, 0)], {2}: [Point(82.08524135, 23.79572993, 0)], {3}: [Point(67.53324941, 32.36832968, 0)], {4}: [Point(29.9996881, 19.74799558, 0)], {5}: [Point(43.99865949, 69.96968013, 0)]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))

# ----
# Facility points
point_23 = Point([Point(50.3, 29.6, 0), Point(49.1, 56.5, 0)])

# ----
# Mininmal Spanning(km)
cluster_11 = Cluster_7(d1=point_22, d2=point_23)  # -> mininmal_spanning, crv_2; disabled
data_163 = Data(576.1221667)
panel_93 = Panel(data_163)
data_164 = Data([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])

# ----
# Facility capacity(TPD)
data_165 = Data([7680, 4320])
panel_94 = Panel(data_165)

# ----
# Facility linkage
curve_12 = Curve(Tree({0}: [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], {1}: [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], {2}: [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], {3}: [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], {4}: [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], {5}: [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]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))
param_viewer_31 = ParamViewer(curve_12)

# ----
# Linkage mileage(km)
data_166 = Data(4747.479)
panel_95 = Panel(data_166)

# ----
# Total Cost(euro)
data_167 = Data("38110444.377126")
panel_96 = Panel(data_167)

# ----
# GWP
data_168 = Data("44392.625685")
panel_97 = Panel(data_168)

# ----
# Total revenue (euro)
data_169 = Data("299565369.6")
panel_98 = Panel(data_169)

# ----
# Recovered organic waste (ton)
data_170 = Data("1719697.831261")
panel_99 = Panel(data_170)

# ----
# Weighted Score
data_171 = Data(21707001.18)
panel_100 = Panel(data_171)

# ---- group: Points
# 2
data_172 = Data(point_23)

# ----
point_color_13 = Data(point_color)

# ---- group: Capacity
data_173 = Data(data_165)

# ---- group: llinkage
data_174 = Data(curve_12)

# ---- group: Thickness
data_175 = Data(thickness)

# ---- group: Line Color
data_176 = Data(line_color)

# ---- group: Linkage
data_177 = Data(data_164)

# ---- group: Line Thickness
data_178 = Data(number_slider_11)

# ----
line_color_12 = Data(swatch)
# 2
previewlw_21 = CustomPreviewLineweights(Geometry=data_177, Shader=line_color_12, Thickness=data_178, Absolute=False)

sqrt_11 = SquareRoot(Value=data_173)
cir_16 = Circle(Plane=data_172, Radius=expr("x/40", sqrt_11))
boundary_12 = BoundarySurfaces(Edges=cir_16)
preview_14 = CustomPreview(Geometry=boundary_12, Material=point_color_13)
previewlw_22 = CustomPreviewLineweights(Geometry=data_174, Shader=data_176, Thickness=data_175, Absolute=False)

param_viewer_32 = ParamViewer(point_23)

# ----
# 1. Calculation of Cost per Year
days = Slider(365, range=0..1000)
life_time = Slider(20, range=0..100)

# ----
# 2
param_viewer_33 = ParamViewer(point_22)

# ----
# Residential points
point_24 = Point(Tree({0}: [Point(15.6939624, 30.05877474, 0)], {1}: [Point(41.27704397, 71.90521357, 0)], {2}: [Point(82.08524135, 23.79572993, 0)], {3}: [Point(67.53324941, 32.36832968, 0)], {4}: [Point(29.9996881, 19.74799558, 0)], {5}: [Point(43.99865949, 69.96968013, 0)]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))

# ----
# Facility points
point_25 = Point(Point(50.077, 42.767, 0))

# ----
# Mininmal Spanning(km)
cluster_12 = Cluster_7(d1=point_24, d2=point_25)  # -> mininmal_spanning, crv_2; disabled
data_179 = Data(579.9565871)
panel_101 = Panel(data_179)
data_180 = Data([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])

# ----
# Facility capacity(TPD)
data_181 = Data(12000)
panel_102 = Panel(data_181)

# ----
# Facility linkage
curve_13 = Curve(Tree({0}: [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], {1}: [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], {2}: [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], {3}: [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], {4}: [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], {5}: [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]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))
param_viewer_34 = ParamViewer(curve_13)

# ----
# Linkage mileage(km)
data_182 = Data(6128.994)
panel_103 = Panel(data_182)

# ----
# Total Cost(euro)
data_183 = Data("37911066.255773")
panel_104 = Panel(data_183)

# ----
# Recovered organic waste (ton)
data_184 = Data("1813320")
panel_105 = Panel(data_184)

# ----
# GWP
data_185 = Data("46505.971747")
panel_106 = Panel(data_185)

# ----
# Total revenue (euro)
data_186 = Data("324996000")
panel_107 = Panel(data_186)

# ----
# Weighted Score
data_187 = Data(23566918.64)
panel_108 = Panel(data_187)

# ---- group: Points
# 1
data_188 = Data(point_25)

# ----
point_color_14 = Data(point_color)

# ---- group: Capacity
data_189 = Data(data_181)

# ---- group: llinkage
data_190 = Data(curve_13)

# ---- group: Thickness
data_191 = Data(thickness)

# ---- group: Line Color
data_192 = Data(line_color)

# ---- group: Linkage
data_193 = Data(data_180)

# ---- group: Line Thickness
data_194 = Data(number_slider_11)

# ----
line_color_13 = Data(swatch)
# 1
previewlw_23 = CustomPreviewLineweights(Geometry=data_193, Shader=line_color_13, Thickness=data_194, Absolute=False)

sqrt_12 = SquareRoot(Value=data_189)
cir_17 = Circle(Plane=data_188, Radius=expr("x/40", sqrt_12))
boundary_13 = BoundarySurfaces(Edges=cir_17)
preview_15 = CustomPreview(Geometry=boundary_13, Material=point_color_14)
previewlw_24 = CustomPreviewLineweights(Geometry=data_190, Shader=data_192, Thickness=data_191, Absolute=False)

param_viewer_35 = ParamViewer(point_25)

# ----
# 1
param_viewer_36 = ParamViewer(point_24)

# ----
# Solver
galapagos = Galapagos(gene=[genelist_x, genelist_y])

merge = Merge(
    Data1=flatten(data_4),
    Data2=flatten(data_5),
    Data3=flatten(data_9),
    Data4=flatten(data_7),
    Data5=flatten(data_6),
    Data6=flatten(data_8))
merge_2 = Merge(
    Data1=flatten(data_20),
    Data2=flatten(data_21),
    Data3=flatten(data_22),
    Data4=flatten(data_24),
    Data5=flatten(data_23),
    Data6=flatten(data_25))
merge_3 = Merge(
    Data1=flatten(data_38),
    Data2=flatten(data_39),
    Data3=flatten(data_40),
    Data4=flatten(data_42),
    Data5=flatten(data_41),
    Data6=flatten(data_43))
merge_4 = Merge(
    Data1=flatten(data_54),
    Data2=flatten(data_55),
    Data3=flatten(data_57),
    Data4=flatten(data_58),
    Data5=flatten(data_56),
    Data6=flatten(data_59))
merge_5 = Merge(
    Data1=flatten(data_70),
    Data2=flatten(data_71),
    Data3=flatten(data_72),
    Data4=flatten(data_73),
    Data5=flatten(data_74),
    Data6=flatten(data_75))
merge_6 = Merge(
    Data1=flatten(data_86),
    Data2=flatten(data_87),
    Data3=flatten(data_89),
    Data4=flatten(data_90),
    Data5=flatten(data_88),
    Data6=flatten(data_91))
merge_7 = Merge(
    Data1=flatten(data_102),
    Data2=flatten(data_103),
    Data3=flatten(data_104),
    Data4=flatten(data_105),
    Data5=flatten(data_106),
    Data6=flatten(data_107))
merge_8 = Merge(
    Data1=flatten(data_118),
    Data2=flatten(data_119),
    Data3=flatten(data_120),
    Data4=flatten(data_121),
    Data5=flatten(data_122),
    Data6=flatten(data_123))
merge_9 = Merge(
    Data1=flatten(data_134),
    Data2=flatten(data_135),
    Data3=flatten(data_136),
    Data4=flatten(data_137),
    Data5=flatten(data_138),
    Data6=flatten(data_139))
merge_10 = Merge(
    Data1=flatten(data_150),
    Data2=flatten(data_151),
    Data3=flatten(data_152),
    Data4=flatten(data_153),
    Data5=flatten(data_154),
    Data6=flatten(data_155))
merge_11 = Merge(
    Data1=flatten(data_166),
    Data2=flatten(data_167),
    Data3=flatten(data_168),
    Data4=flatten(data_169),
    Data5=flatten(data_170),
    Data6=flatten(data_171))
merge_12 = Merge(
    Data1=flatten(data_182),
    Data2=flatten(data_183),
    Data3=flatten(data_185),
    Data4=flatten(data_186),
    Data5=flatten(data_184),
    Data6=flatten(data_187))
# Write in Excel
panel_109 = Panel("""12
11
10
9
8
7
6
5
4
3
2
1""")
entwine = Entwine(
    Branch00=merge,
    Branch01=merge_2,
    Branch02=merge_3,
    Branch03=merge_4,
    Branch04=merge_5,
    Branch05=merge_6,
    Branch06=merge_7,
    Branch07=merge_8,
    Branch08=merge_9,
    Branch09=merge_10,
    Branch010=merge_11,
    Branch011=merge_12,
    FlattenInputs=True)
panel_110 = Panel(entwine)
excelwrite = ExcelWrite(WriteExcelData=False, WorksheetName="Sheet1", ColumnHeadings=panel_109, Data=entwine, ClearSheet=False)

# ----
# V.DISTRIBUTION OF 200 RESIDENTIAL BLOCKS
crv_2 = Curve([<curve referenced from the Rhino model> x630])
pt_2 = Point(point)

# ----
# Buffer
number_slider_12 = Slider(12, range=0..100)
cir_18 = Circle(Plane=pt_2, Radius=number_slider_12)
offset = OffsetCurve(Curve=cir_18, Distance=Slider(2, range=0..10), Plane=PlaneXY(0, 0, 0), Corners=1)

# ----
# Buffer
number_slider_13 = Slider(20, range=0..100)
cir_19 = Circle(Plane=pt_2, Radius=number_slider_13)
# Need to change. Now there are some blocks have been caculated twice.
# Later: whole cells > 1 tier
# whole cells-1tier> 2 tier
# whole cells -1tier-2 tier> 3 tier
offset_2 = OffsetCurve(Curve=cir_19, Distance=Slider(1, range=0..10), Plane=pt_2, Corners=1)

divide = DivideCurve(Curve=offset_2, Count=number_slider_4, Kinks=False)  # -> flatten(Points), Tangents, Parameters
divide_2 = DivideCurve(Curve=offset, Count=number_slider_5, Kinks=False)  # -> flatten(Points), Tangents, Parameters

# ----
# First Tier
# Second Tier
# Third Tier
neighborhood_cells = NeighborhoodCells(basic_cells=crv_2, points=pt_2, start_number=cbd, target_number=panel)  # -> flatten(cells), rest_cells, flatten(R)
neighborhood_cells_2 = NeighborhoodCells(basic_cells=neighborhood_cells.rest_cells, points=divide_2.Points, start_number=number_slider_7, target_number="3")  # -> flatten(cells), rest_cells, flatten(R)
neighborhood_cells_3 = NeighborhoodCells(basic_cells=neighborhood_cells_2.rest_cells, points=divide.Points, start_number=number_slider_6, target_number="2")  # -> flatten(cells), rest_cells, flatten(R)
panel_111 = Panel(neighborhood_cells_3.R)
panel_112 = Panel(neighborhood_cells_2.R)
panel_113 = Panel(neighborhood_cells.R)

random_reduce = RandomReduce(List=neighborhood_cells.cells, Reduction=1, Seed=1)  # -> flatten(List)

# ---- group: All of the Residential cells
merge_13 = Merge(Data1=random_reduce, Data2=neighborhood_cells_2.cells, Data3=neighborhood_cells_3.cells)  # -> graft(Result)
area_5 = Area(Geometry=merge_13)  # -> Area, simplify(Centroid)

# ----
boundary_14 = BoundarySurfaces(Edges=neighborhood_cells_3.cells)
boundary_15 = BoundarySurfaces(Edges=neighborhood_cells_2.cells)
boundary_16 = BoundarySurfaces(Edges=random_reduce)

preview_16 = CustomPreview(Geometry=boundary_16, Material=ColourSwatch(SwatchColor=RGBA(255, 0, 0, 180)))
preview_17 = CustomPreview(Geometry=boundary_14, Material=ColourSwatch(SwatchColor=RGBA(255, 0, 0, 60)))
preview_18 = CustomPreview(Geometry=boundary_15, Material=ColourSwatch(SwatchColor=RGBA(255, 0, 0, 130)))

# ---- group: Cells points
pt_3 = Point(area_5.Centroid)

# ----
# 2.Target
merge_14 = Merge(Data1=area.Area, Data2=area_2.Area, Data3=area_3.Area)
merge_15 = Merge(Data1=merge_14, Data2=merge_14, Data3=merge_14)
ma = MassAddition(Input=merge_15)  # -> Result, PartialResults

# ----
# 1.Ratio of household distribution
division_2 = Division(A=merge_15, B=ma.Result)
multiplication_2 = Multiplication(A=division_2, B="100")
int = Integer(multiplication_2)
division_3 = Division(A=int, B="100")
ratio = Panel(division_3)

# ---- group: 10Million
multiplication_3 = Multiplication(A=ratio, B="10")

# ----
# VI.Distribution of Facilities
number_slider_14 = Slider(9, range=1..60)
viewer = ParamViewer(area_5.Centroid)
number_slider_15 = Slider(0.5, range=0.1..0.9)
subtraction = Subtraction(A=1, B=number_slider_15)

# ---- group: Generating Facility points
vb = VBScript(genelist="GeneList X", count=number_slider_14)  # -> out, A
# ---------- vb: VB ----------
    For Each obj As IGH_DocumentObject In owner.OnPingDocument().Objects
      If (obj.ComponentGuid <> New Guid("{21553c44-ea62-475e-a8bb-62b2a3ee5ca5}")) Then Continue For
      If (obj.NickName Like genelist) Then
        CallByName(obj, "Count", CallType.Set, count)
        'CallByName(obj, "ExpireSolution", CallType.Method, False)
        Return
      End If
    Next

    Print("No matching Gene list object found")
# ---------- end vb ----------
vb_2 = VBScript(genelist="GeneList Y", count=number_slider_14)  # -> out, A; same code as vb
genelist_x = GenePool(Decimals=1, Maximum=100, Minimum=0, Value=[50.5, 22.5, 63.4, 72.9, 39, 88.5, 11.4, 36.3, 58])
genelist_y = GenePool(Decimals=1, Maximum=100, Minimum=0, Value=[56.4, 89.2, 81.4, 43.9, 35.6, 17.8, 14.3, 81.2, 28.4])
pt_4 = ConstructPoint(XCoordinate=genelist_x, YCoordinate=genelist_y, ZCoordinate=0)
viewer_2 = ParamViewer(pt_4)

# ---- group: Duplicate points list into Tree
flatten = FlattenTree(Tree=area_5.Centroid, Path="{0}")
lng_3 = ListLength(List=flatten)
dup = DuplicateData(Data="0", Number=lng_3, Order=True)
branch = TreeBranch(Tree=pt_4, Path=dup, MaintainPaths=False)
viewer_3 = ParamViewer(branch)
panel_114 = Panel(branch)

# ---- group: Nearest facility
# Distance from Cell to facility>Sorting>Smallest number
# (nearest facility in a list)>Index of nearest facility for each cell
dist = Distance(PointA=area_5.Centroid, PointB=pt_4)  # -> simplify(Distance)
panel_115 = Panel(dist)
cset = CreateSet(List=dist)  # -> Set, Map
sort = SortList(Keys=dist)  # -> Keys, ValuesA
panel_116 = Panel(sort.Keys)
dom_2 = ConstructDomain(DomainStart=0, DomainEnd=0.5)
subset = SubList(List=sort.Keys, Domain=dom_2, Wrap=True)  # -> simplify(List), Index
panel_117 = Panel(subset.List)
mindex = MemberIndex(Set=cset.Set, Member=subset.List)  # -> simplify(Index), Count
panel_118 = Panel(mindex.Index)

# ---- group: Facility points
item = ListItem(List=branch, Index=mindex.Index, Wrap=True)

# ---- group: Connections
ln = Line(StartPoint=pt_3, EndPoint=item)

# ---- group: Cull duplicate
flatten_2 = FlattenTree(Tree=item, Path="{0}")
cullpt = CullDuplicates(Points=flatten_2, Tolerance=0.1, CullMode=1)  # -> Points, Indices, Valence

# ---- group: Mileage
len = Length(Curve=ln)  # -> flatten(Length)
ma_2 = MassAddition(Input=len)  # -> Result, PartialResults

# ----
# Facility location
data_195 = Data(cullpt.Points)

# ----
# Linkage
data_196 = Data(ln)

# ---- group: Points
# Sovler
data_197 = Data(data_195)

# ---- group: llinkage
data_198 = Data(data_196)

# ---- group: Facility Location
# 1095-2920RMB/m2 for 1 year
# Source:Study on the Rational Determination of the Standard of Industrial Land Prices
# 
# 成都 １ ∶ ０ ．５３ ∶ ０ ．２０
point_26 = Point(data_195)

# ----
# industrial land price
# one year(euro/m2)
line_2 = LineSDL(Start=point_26, Direction=Vector(0, 0, 1), Length=200)
scx = SurfaceCurve(Surface=srf, Curve=line_2)  # -> Curves, Points, UVPoints, Normals, Parameters, Tangents
pdecon_3 = Deconstruct(Point=flatten(scx.Points))  # -> XComponent, YComponent, ZComponent
dom_3 = ConstructDomain(DomainStart=panel_73, DomainEnd=panel_74)
dom_4 = ConstructDomain(DomainStart=panel_76, DomainEnd=panel_75)
remap_4 = RemapNumbers(Value=pdecon_3.ZComponent, Source=dom_3, Target=dom_4)  # -> Mapped, Clipped

populations = Panel(multiplication_3)

# ---- group: Residential district(0.05Million)
division_4 = Division(A=populations, B="0.05")

# ----
number_of_needed_districts = Panel(division_4)

precesion = Precesion(A=ma_2.Result)
multiplication_4 = Multiplication(A=cullpt.Valence, B=60)
viewer_4 = ParamViewer(data_195)

# ----
# Transportation Distances
data_199 = Data(precesion)

# ----
# Facility Capacity
data_200 = Data(multiplication_4)

# ---- group: Capacity
data_201 = Data(data_200)

# ----
sqrt_13 = SquareRoot(Value=data_201)
cir_20 = Circle(Plane=data_197, Radius=expr("x/40", sqrt_13))
boundary_17 = BoundarySurfaces(Edges=cir_20)
preview_19 = CustomPreview(Geometry=boundary_17, Material=point_color_4)
previewlw_25 = CustomPreviewLineweights(Geometry=data_198, Shader=data_34, Thickness=data_33, Absolute=False)

# ---- group: Material revenue
# 3. Calculation of Material Revenue per Year
cluster_13 = Cluster_6(facility_capacity=data_200, days=days)  # -> paper_revenue, glass_revenue, ferrous_revenue, alum_revenue, plastic_revenue, recovered_organic_waste

# ---- group: Total revenue(euro)
merge_16 = Merge(
    Data1=cluster_13.paper_revenue,
    Data2=cluster_13.glass_revenue,
    Data3=cluster_13.ferrous_revenue,
    Data4=cluster_13.alum_revenue,
    Data5=cluster_13.plastic_revenue)
ma_3 = MassAddition(Input=merge_16)  # -> Result, PartialResults
panel_119 = Panel(ma_3.Result)

# ----
# VIII.Evaluation
coefficients = Coefficients(
    land_price_for_each_facility=remap_4.Mapped,
    transportation_distance=data_199,
    facility_capacity=data_200,
    function_days_per_year=days,
    life_time=life_time)  # -> indoor_floor_area, cost_of_construction_per_year, required_land_area, cost_of_land_lease_per_year, consumption_of_diesel_per_year, cost_of_diesel_per_year, consumption_of_electricity_per_year, cost_of_electricity_per_year, cost_of_equipment_per_year
ma_4 = MassAddition(Input=coefficients.indoor_floor_area)  # -> Result, PartialResults
ma_5 = MassAddition(Input=coefficients.required_land_area)  # -> Result, PartialResults

# ---- group: Diesel
# Emission Factor :
# 
# Diesel fuel
# CO2: (10.21kg/gallon) (2.6975kg/L)
# CH4: (0.57g/gallon)(0.1506g/L)
# N2O: (0.26g/gallon)(0.0687g/L)
# Emission Factor :
# 
# Electricity
# CO2: (1,232.35lb/MWh) (0.55899396kg/KWh)
# CH4: (0.02414lb/MWh)(0.000010949904kg/KWh)
# N2O: (0.01826lb/MWh)(0.000008282736kg/KWh)
number_slider_16 = Slider(1, range=0..1)
# 2. Calculation of Airborne Emissions per Year
# Total Airborne Emission per Year
cluster_14 = Cluster(consumption_of_diesel_per_year=coefficients.consumption_of_diesel_per_year, year=number_slider_16)  # -> co2_emission_ton, ch4_emission_ton, n2o_emission_ton

# ---- group: Electricity
cluster_15 = Cluster_2(consumption_of_electricity_per_year=coefficients.consumption_of_electricity_per_year, year=number_slider_16)  # -> co2_emission_ton, ch4_emission_ton, n2o_emission_ton

# ---- group: Total CO2(ton)
merge_17 = Merge(Data1=flatten(cluster_14.co2_emission_ton), Data2=flatten(cluster_15.co2_emission_ton))
ma_6 = MassAddition(Input=merge_17)  # -> Result, PartialResults

# ---- group: Total CH4(ton)
merge_18 = Merge(Data1=flatten(cluster_14.ch4_emission_ton), Data2=flatten(cluster_15.ch4_emission_ton))
ma_7 = MassAddition(Input=merge_18)  # -> Result, PartialResults

# ---- group: Total N2O(ton)
merge_19 = Merge(Data1=flatten(cluster_14.n2o_emission_ton), Data2=flatten(cluster_15.n2o_emission_ton))
ma_8 = MassAddition(Input=merge_19)  # -> Result, PartialResults

# ----
# Material Composition of Generated MSW
# 
# Paper 28%
# Glass 5%
# Ferrous 7%
# Aluminium 1%
# Plastic 13%
# Food waste 14%
# Yard trimming 13%
# other 19%
# Efficiency of highly automated sorting system %
# 
# Paper 50-75
# Glass 80-90
# Ferrous 90-95
# Aluminium 90-95
# Plastic 75-90
# organic 80-90
# Material revenue (euro/Mg)
# 
# Paper 70
# Glass 23
# Ferrous 120
# Aluminium 1250
# Plastic 330
# organic: depends on biodegestion
panel_120 = Panel(cluster_13.recovered_organic_waste)

# ---- group: CH4
expression = Expression(x=ma_7.Result, Expression="25*x")

# ---- group: N2O
expression_2 = Expression(x=ma_8.Result, Expression="298*x")

# ---- group: CO2
expression_3 = Expression(x=ma_6.Result, Expression="1*x")

# ----
# Global Warming Potentials (GWPs)
# 100-year GWP :
# 
# CO2: 1
# CH4: 25
# N2O: 298
ma_9 = MassAddition(Input=[expression_3, expression, expression_2])  # -> Result, PartialResults
panel_121 = Panel(ma_9.Result)

# ---- group: refer to landprice
data_202 = Data(coefficients.cost_of_land_lease_per_year)

# ----
ma_10 = MassAddition(Input=data_200)  # -> Result, PartialResults
panel_122 = Panel(data_199)
panel_123 = Panel(data_200)
panel_124 = Panel(ma_10.Result)
merge_20 = Merge(
    Data1=flatten(coefficients.cost_of_construction_per_year),
    Data2=flatten(coefficients.cost_of_land_lease_per_year),
    Data3=flatten(coefficients.cost_of_diesel_per_year),
    Data4=flatten(coefficients.cost_of_electricity_per_year),
    Data5=flatten(coefficients.cost_of_equipment_per_year))
multiplication_5 = Multiplication(A=coefficients.cost_of_diesel_per_year, B=6.5)
multiplication_6 = Multiplication(A=data_202, B=number_slider_15)

# ----
# Total Cost per Year
ma_11 = MassAddition(Input=merge_20)  # -> Result, PartialResults
panel_125 = Panel(ma_11.Result)

# ---- group: refer to distance
data_203 = Data(multiplication_5)

# ----
multiplication_7 = Multiplication(A=data_203, B=subtraction)
addition = Addition(A=multiplication_6, B=multiplication_7)

# ----
# Lloyd's algorithm
voronoi = Voronoi(Points=hs.Feedback, Boundary=crv, BruteForceOverride=False)
area_6 = Area(Geometry=voronoi)  # -> Area, Centroid
# 3.Voronoi Relaxation
hs = HoopSnake(
    StartingData=cull,
    Data=area_6.Centroid,
    Hoopsnake_Data_autoUpdate=False,
    Hoopsnake_Data_dataLimit=2147483647,
    Hoopsnake_Data_delay=0,
    Hoopsnake_Data_resetCounter=False,
    Hoopsnake_Data_updateView=True)  # -> Feedback, CumulativeFeedback, LoopsCounter, flatten(IterationsCounter)
panel_126 = Panel(hs.IterationsCounter)

# ==== cluster NeighborhoodCells
basic_cells = ClusterInput()
points = ClusterInput()
start_number = ClusterInput()
target_number = ClusterInput()
area = Area(Geometry=basic_cells)  # -> Area, Centroid
graft = GraftTree(Tree=points, IncludeEmptyLists=True, IncludeNullItems=True)
addition = Addition(A=start_number, B=target_number)
dom = ConstructDomain(DomainStart=start_number, DomainEnd=expr("x-1", addition))
dist = Distance(PointA=area.Centroid, PointB=graft)  # -> simplify(Distance)
sort = SortList(Keys=dist)  # -> Keys, ValuesA
subset = SubList(List=sort.Keys, Domain=dom, Wrap=True)  # -> simplify(List), Index
lng = ListLength(List=points)
index = ItemIndex(List=basic_cells, Item=basic_cells)
mindex = MemberIndex(Set=dist, Member=subset.List)  # -> Index, Count
lng_2 = ListLength(List=subset.List)
difference = SetDifference(SetA=flatten(index), SetB=flatten(mindex.Index))
item = ListItem(List=basic_cells, Index=mindex.Index, Wrap=True)
multiplication = Multiplication(A=lng_2, B=lng)
item_2 = ListItem(List=basic_cells, Index=difference, Wrap=True)
panel = Panel(multiplication)
R = ClusterOutput(multiplication)
cells = ClusterOutput(item)
rest_cells = ClusterOutput(item_2)
sort_2 = SortList(Keys=flatten(mindex.Index))  # -> Keys, ValuesA
panel_2 = Panel(sort_2.Keys)
cset = CreateSet(List=panel_2)  # -> Set, Map
panel_3 = Panel(cset.Set)

# ==== cluster Coefficients
land_price_for_each_facility = ClusterInput()  # euro/m2 per year
transportation_distance = ClusterInput()
facility_capacity = ClusterInput()
function_days_per_year = ClusterInput()
life_time = ClusterInput()

# ---- group: Indoor Floor Area(m2)
expression = Expression(x=facility_capacity, Expression="15.39*x+800")

# ---- group: Electricity Consumption（kwh)
expression_2 = Expression(x=expression, Expression="1.607*0.04*x+0.706*(1-0.04)*x")

# ---- group: Construction Cost 600Euro/m2
expression_3 = Expression(A=expression, Expression="612*A")

# ---- group: Transportation Diesel Consumption（L）
expression_4 = Expression(D=transportation_distance, Expression="D*60*0.0272")

# ---- group: Processing Diesel Consumption(L)
expression_5 = Expression(x=facility_capacity, Expression="0.7*x+4.8")

# ---- group: Equipment Cost(Euro/Mg)
expression_6 = Expression(x=facility_capacity, Expression="2.69*x+200")

# ----
# Diesel Consumption (L)
merge = Merge(Data1=flatten(expression_4), Data2=flatten(expression_5))
mass_addition = MassAddition(Input=flatten(merge))  # -> Result, PartialResults
# Cost of Diesel per Year (euro)
multiplication = Multiplication(A=mass_addition.Result, B=function_days_per_year)

# ----
# Electricity Consumption per Year (L)
mass_addition_2 = MassAddition(Input=flatten(expression_2))  # -> Result, PartialResults
# Cost of Electricity per Year (euro)
multiplication_2 = Multiplication(A=mass_addition_2.Result, B=function_days_per_year)

# ----
# Equipment Cost per Year (euro)
mass_addition_3 = MassAddition(Input=flatten(expression_6))  # -> Result, PartialResults
multiplication_3 = Multiplication(A=mass_addition_3.Result, B=function_days_per_year)

# ----
# Construction Cost per Year (euro)
mass_addition_4 = MassAddition(Input=flatten(expression_3))  # -> Result, PartialResults
division = Division(A=mass_addition_4.Result, B=life_time)

# ---- group: Diesel Cost(euro/L)
E = Expression(D=multiplication, Expression="0.842*D")

# ---- group: Electricity Cost(euro/kwh)
E_2 = Expression(E=multiplication_2, Expression="0.0868*E")

# ---- group: Requied Land Area(m2)
expression_7 = Expression(I=expression, Expression="3*I")

# ----
# Land Cost per Year (euro)
multiplication_4 = Multiplication(LandPrice=land_price_for_each_facility, LandArea=expression_7)
# Indoor Floor Area & Site Area
mass_addition_5 = MassAddition(Input=multiplication_4)  # -> Result, PartialResults

consumption_of_electricity_per_year = ClusterOutput(multiplication_2)  # (kwh)
consumption_of_diesel_per_year = ClusterOutput(multiplication)  # (L)
cost_of_construction_per_year = ClusterOutput(division)  # Total Cost/Life time
# Equipment Cost = 2.69*SUM(capacity)+200*N
# N
cost_of_equipment_per_year = ClusterOutput(multiplication_3)  # Includes purchasing, O&M; equation represents how much will be cost when processing one Mg.
cost_of_land_lease_per_year = ClusterOutput(mass_addition_5.Result)  # (euro)
# N
# 1.607*0.04*x+0.706*(1-0.04)*x=(1.607*0.04+0.706*0.96)*Indoor Floor Area
cost_of_electricity_per_year = ClusterOutput(E_2)  # (euro)
# Location&Linkages
cost_of_diesel_per_year = ClusterOutput(E)  # (euro)
# Cost of Construction= 612* Indoor Floor Area=(15.39*SUM x+800*N)*612
# N
# Required Land Area=(15.39*SUM x+800*N)*3
# Location
# Land price various based on the location
required_land_area = ClusterOutput(expression_7)  # (m2)
# N
# indoor Floor Area=(15.39*x1+800)+(15.39*x2+800)+......(15.39*xn+800)
# =15.39*(x1+x2+x3+...Xn)+800*N
# =15.39*SUM x+800*N
# N
indoor_floor_area = ClusterOutput(expression)

# ==== cluster Cluster
# Emission Factor :
# 
# Diesel fuel
# CO2: (10.21kg/gallon) (2.6975kg/L)
# CH4: (0.57g/gallon)(0.1506g/L)
# N2O: (0.26g/gallon)(0.0687g/L)
consumption_of_diesel_per_year = ClusterInput()
year = ClusterInput()
expression = Expression(x=consumption_of_diesel_per_year, y=year, Expression="0.1506*x*y*0.001*0.001")
expression_2 = Expression(x=consumption_of_diesel_per_year, y=year, Expression="0.0687*x*y*0.001*0.001")
expression_3 = Expression(x=consumption_of_diesel_per_year, y=year, Expression="2.6975*x*y*0.001")
co2_emission_ton = ClusterOutput(expression_3)
ch4_emission_ton = ClusterOutput(expression)
n2o_emission_ton = ClusterOutput(expression_2)

# ==== cluster Cluster_2
# Emission Factor :
# 
# Electricity
# CO2: (1,232.35lb/MWh) (0.55899396kg/KWh)
# CH4: (0.02414lb/MWh)(0.000010949904kg/KWh)
# N2O: (0.01826lb/MWh)(0.000008282736kg/KWh)
consumption_of_electricity_per_year = ClusterInput()
year = ClusterInput()
expression = Expression(x=consumption_of_electricity_per_year, y=year, Expression="0.000008282736*x*y*0.001")
expression_2 = Expression(x=consumption_of_electricity_per_year, y=year, Expression="0.000010949904*x*y*0.001")
expression_3 = Expression(x=consumption_of_electricity_per_year, y=year, Expression="0.55899396*x*y*0.001")
ch4_emission_ton = ClusterOutput(expression_2)
co2_emission_ton = ClusterOutput(expression_3)
n2o_emission_ton = ClusterOutput(expression)

# ==== cluster Cluster_6
facility_capacity = ClusterInput()
days = ClusterInput()  # operating days per year

# ---- group: Efficiency
cluster = Cluster_4(facility_capacity=facility_capacity)  # -> e_paper, e_glass, e_ferrous, e_aluminium, e_plastic, e_organic

# ---- group: Generated Waste per Year
cluster_2 = Cluster_5(facility_capacity=facility_capacity, days=days)  # -> paper_ton, glass_ton, ferrous_ton, alum_ton, plastic_ton, organic_ton

# ---- group: Recoveryed material
multiplication = Multiplication(A=cluster_2.paper_ton, B=cluster.e_paper)
multiplication_2 = Multiplication(A=cluster_2.glass_ton, B=cluster.e_glass)
multiplication_3 = Multiplication(A=cluster_2.ferrous_ton, B=cluster.e_ferrous)
multiplication_4 = Multiplication(A=cluster_2.alum_ton, B=cluster.e_aluminium)
multiplication_5 = Multiplication(A=cluster_2.plastic_ton, B=cluster.e_plastic)
multiplication_6 = Multiplication(A=cluster_2.organic_ton, B=cluster.e_organic)

# ----
expression = Expression(x=multiplication_4, Expression="x*1250")
expression_2 = Expression(x=multiplication_5, Expression="x*330")
expression_3 = Expression(x=multiplication_3, Expression="x*120")
expression_4 = Expression(x=multiplication, Expression="x*70")
expression_5 = Expression(x=multiplication_2, Expression="x*23")

ma = MassAddition(Input=multiplication_6)  # -> Result, PartialResults
ma_2 = MassAddition(Input=expression)  # -> Result, PartialResults
ma_3 = MassAddition(Input=expression_3)  # -> Result, PartialResults
ma_4 = MassAddition(Input=expression_5)  # -> Result, PartialResults
ma_5 = MassAddition(Input=expression_4)  # -> Result, PartialResults
ma_6 = MassAddition(Input=expression_2)  # -> Result, PartialResults
recovered_organic_waste = ClusterOutput(ma.Result)
paper_revenue = ClusterOutput(ma_5.Result)
glass_revenue = ClusterOutput(ma_4.Result)
alum_revenue = ClusterOutput(ma_2.Result)
ferrous_revenue = ClusterOutput(ma_3.Result)
plastic_revenue = ClusterOutput(ma_6.Result)

# ==== cluster Precesion
A = ClusterInput()
multiplication = Multiplication(A=A, B="1000")
integer = Integer(multiplication)
division = Division(A=integer, B="1000")
result = ClusterOutput(division)

# ==== cluster Cluster_7
d1 = ClusterInput()
d2 = ClusterInput()
merge = Merge(Data1=flatten(d1), Data2=flatten(d2))
graphfrompoints = GraphFromPoints(GraphPoints=merge, ConnectingDistance=Slider(50, range=0..100), undirected=True)
minst = MinST(Graph=graphfrompoints)
display_graph = DisplayGraph(Graph=minst, GraphPoints=merge, Value="-1", hidden=False)  # -> VertexCount, EdgeCount, Edge
length = Length(Curve=display_graph.Edge)
mass_addition = MassAddition(Input=length)  # -> Result, PartialResults
division = Division(A=mass_addition.Result, B=2)
crv = Curve(display_graph.Edge)
panel = Panel(division)
mininmal_spanning = ClusterOutput(division)
crv_2 = ClusterOutput(crv)

# ==== cluster Cluster_4
facility_capacity = ClusterInput()

# ---- group: E-Paper
cluster = Cluster_3(facility_capacity=facility_capacity, lowest_number="0.50", largest_number="0.75")

# ---- group: E-Glass
cluster_2 = Cluster_3(facility_capacity=facility_capacity, lowest_number="0.80", largest_number="0.90")

# ---- group: E-Aluminium
cluster_3 = Cluster_3(facility_capacity=facility_capacity, lowest_number="0.90", largest_number="0.95")

# ---- group: E-Ferrous
cluster_4 = Cluster_3(facility_capacity=facility_capacity, lowest_number="0.90", largest_number="0.95")

# ---- group: E-Plastic
cluster_5 = Cluster_3(facility_capacity=facility_capacity, lowest_number="0.75", largest_number="0.90")

# ---- group: E-Organic
cluster_6 = Cluster_3(facility_capacity=facility_capacity, lowest_number="0.80", largest_number="0.90")

# ----
e_ferrous = ClusterOutput(cluster_4)
e_aluminium = ClusterOutput(cluster_3)
e_organic = ClusterOutput(cluster_6)
e_plastic = ClusterOutput(cluster_5)
e_paper = ClusterOutput(cluster)
e_glass = ClusterOutput(cluster_2)

# ==== cluster Cluster_5
days = ClusterInput()
facility_capacity = ClusterInput()  # how much waste will be dealt each day
multiplication = Multiplication(TPD=facility_capacity, OperatingDays=days)

# ---- group: Paper(ton)
expression = Expression(x=multiplication, Expression="0.28*x")

# ---- group: Glass(ton)
expression_2 = Expression(x=multiplication, Expression="0.05*x")

# ---- group: Ferrous(ton)
expression_3 = Expression(x=multiplication, Expression="0.07*x")

# ---- group: Alum(ton)
expression_4 = Expression(x=multiplication, Expression="0.01*x")

# ---- group: Plastic(ton)
expression_5 = Expression(x=multiplication, Expression="0.13*x")

# ---- group: Organic(ton)
expression_6 = Expression(x=multiplication, Expression="0.46*x")

# ----
organic_ton = ClusterOutput(expression_6)
ferrous_ton = ClusterOutput(expression_3)
plastic_ton = ClusterOutput(expression_5)
paper_ton = ClusterOutput(expression)
glass_ton = ClusterOutput(expression_2)
alum_ton = ClusterOutput(expression_4)

# ==== cluster Cluster_3
facility_capacity = ClusterInput()
lowest_number = ClusterInput()
largest_number = ClusterInput()
dom = ConstructDomain(DomainStart=lowest_number, DomainEnd=largest_number)
remap = RemapNumbers(Value=facility_capacity, Source=Domain(100, 12000), Target=dom)  # -> Mapped, Clipped
efficiency_for_each_facility = ClusterOutput(remap.Mapped)
