# Grasshopper definition Solver P-D.gh (Grasshopper 1.0.5)
# plug-ins: Human, HoopSnake, LunchBox

# ----
# Spatial Configuration
outputs = Panel("")

_1km = Slider(1, range=0..1)
number_slider = Slider(100, range=0..100)

# ---- group: Merge fields / 3 centers
# II.SPATIAL DEMAND CONE SIMULATION
point = Point([Point(50, 71.65127019, 0), Point(25, 28.35, 0), Point(75, 28.35, 0)])

# ---- group: Merge fields
number_slider_2 = Slider(3, range=1..10)
number_slider_3 = Slider(1.5, range=0.9..2.5)

# ----
# III.HOUSEHOLDS DISTRIBUTION CONE SIMULATION
_0_10km = Curve(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)
_10_20km = Curve(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)
_20_30km = Curve(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)
area = Area(Geometry=_0_10km)  # -> Area, Centroid
area_2 = Area(Geometry=_10_20km)  # -> Area, Centroid
area_3 = Area(Geometry=_20_30km)  # -> Area, Centroid

# ---- group: How many cells should a CBD possess
cbd = Slider(16, range=10..40)

# ---- group: How many subcenters
number_slider_4 = Slider(6, range=0..10)

number_slider_5 = Slider(6, range=0..10)

# ----
# Facility number
number_slider_6 = Slider(9, range=1..60)

# ---- group: Merge fields
pcharge = PointCharge(Point=point, Charge=number_slider_2, Decay=number_slider_3)
mergef = MergeFields(Fields=pcharge)

# ---- group: Generating Facility points
# Generating Facility points by Gene pool
panel = Panel("GeneList X")
vb = VBScript(genelist=panel, count=number_slider_6)  # -> out, A
# ---------- vb: VB ----------
    For Each obj As IGH_DocumentObject In owner.OnPingDocument().Objects
      If (obj.ComponentGuid <> New Guid("{21553c44-ea62-475e-a8bb-62b2a3ee5ca5}")) Then Continue For
      If (obj.NickName Like genelist) Then
        CallByName(obj, "Count", CallType.Set, count)
        'CallByName(obj, "ExpireSolution", CallType.Method, False)
        Return
      End If
    Next

    Print("No matching Gene list object found")
# ---------- end vb ----------
vb_2 = VBScript(genelist="GeneList Y", count=number_slider_6)  # -> out, A; same code as vb
genelist_x = GenePool(Decimals=3, Maximum=100, Minimum=0, Value=[23.839, 32.452, 56.731, 42.159, 74.9, 69.075, 49.814, 18.262, 81.717])
genelist_y = GenePool(Decimals=3, Maximum=100, Minimum=0, Value=[36.07, 24.842, 67.187, 68.645, 20.404, 32.502, 78.547, 24.496, 32.013])
pt = ConstructPoint(XCoordinate=genelist_x, YCoordinate=genelist_y, ZCoordinate=0)
viewer = ParamViewer(pt)

# ---- group: Subcenter non-residential block
number_slider_7 = Slider(1, range=0..40)

number_slider_8 = Slider(2, range=0..40)

# ----
# Cells Distribution
panel_2 = Panel("37")

# ---- group: Target number of cells
division = Division(A=Slider(200, range=0..1000), B="0.32")
panel_3 = Panel(division)

# ----
panel_4 = Panel("""10
20
30
40""")

# ----
# I.BASIC GRID
# 4.Buffer
sqgrid = Square(Plane=PlaneXY(0, 0, 0), Size=_1km, ExtentX=number_slider, ExtentY=number_slider)  # -> Cells, Points
bbox = BoundingBox(Content=flatten(sqgrid.Cells), Plane=PlaneXY(0, 0, 0), UnionBox=True)  # -> Box, Box_2
wires = BrepWireframe(Brep=bbox.Box, Density=-1)
join = JoinCurves(Curves=wires, Preserve=False)
curve = Curve(join)
area_4 = Area(Geometry=join)  # -> flatten(Area), flatten(Centroid)
center_point = Point(area_4.Centroid)
panel_5 = Panel(area_4.Area)
panel_6 = Panel("""GB50137-2011《城市用地分类与规划建设用地标准》：
居住用地占城市建设用地比例宜为25.0%~40.0%""")
panel_7 = Panel("""GB50137-2011《城市用地分类与规划建设用地标准》：
人均城镇建设用地的指标：每人100平方米左右""")
cir = Circle(Plane=center_point, Radius=panel_4)
preview = CustomPreview(Geometry=cir, Material=ColourSwatch(SwatchColor=RGBA(255, 255, 255, 31)))
panel_8 = Panel("100km2")

# ---- group: Divide Surface
boundary = BoundarySurfaces(Edges=curve)
number_slider_9 = Slider(50, range=0..100)

# ---- group: Boundary inherited from I
crv = Curve(curve)

# ---- group: Divide Surface
sdivide = DivideSurface(Surface=boundary, UCount=number_slider_9, VCount=number_slider_9)  # -> flatten(Points), Normals, Parameters

# ---- group: Evaluate Grid Points
evf = EvaluateField(Field=mergef, Point=sdivide.Points)  # -> Tensor, Strength
graph = GraphMapper(evf.Strength, x0=0, x1=1, y0=0, y1=1, container_name="Bezier", cpx=[0, 0.1352282465, 0.228681922, 1], cpy=[0, 0, 1, 1])

# ----
# IV.DISTORTED HEXAGON
bnd = Bounds(Numbers=evf.Strength)
remap = RemapNumbers(Value=evf.Strength, Source=bnd, Target=Domain(0, 1))  # -> Mapped, Clipped
graph_2 = GraphMapper(
    remap.Mapped,
    x0=0,
    x1=1,
    y0=0,
    y1=1,
    container_name="Bezier",
    cpx=[0, 0.1567152888, 0.3960031569, 1],
    cpy=[0, 0.3554871082, 0.7025407553, 0.8235858679])
dom = ConstructDomain(DomainStart=0, DomainEnd=graph_2)

# ----
# Cull Pattern ( reduce points )
lng = ListLength(List=dom)
random = Random(Range=Domain(0, 1), Number=lng, Seed=2)
random_2 = Random(Range=dom, Number=1, Seed=random)  # -> flatten(Random)
# 2.Points with different density
larger = LargerThan(FirstNumber=random_2, SecondNumber=Slider(0.00374, range=0.0001..0.2))  # -> LargerThan, OrEqualTo
cull = CullPattern(List=sdivide.Points, CullPattern=larger.LargerThan)
lng_2 = ListLength(List=cull)
panel_9 = Panel(lng_2)

Z = UnitZ(Factor=graph)
multiplication = Multiplication(A=Z, B=Slider(30, range=0..100))

# ----
# 4.Moved Points
move = Move(Geometry=sdivide.Points, Motion=multiplication)  # -> Geometry, Transform

# ----
# 5.Spatial Demand Cone with color
number_slider_10 = Slider(0.8, range=0..1)
cir_2 = Circle(Plane=sdivide.Points, Radius=number_slider_10)  # disabled
pdecon = Deconstruct(Point=move.Geometry)  # -> XComponent, YComponent, ZComponent; disabled
cir_3 = Circle(Plane=move.Geometry, Radius=number_slider_10)  # disabled
bnd_2 = Bounds(Numbers=pdecon.ZComponent)  # disabled
rulesrf = RuledSurface(CurveA=cir_2, CurveB=cir_3)  # disabled
cap = CapHoles(Brep=rulesrf)  # disabled
remap_2 = RemapNumbers(Value=pdecon.ZComponent, Source=bnd_2, Target=Domain(0, 1))  # -> Mapped, Clipped; disabled
gradient = Gradient(LowerLimit=0, UpperLimit=1, Parameter=remap_2.Mapped, stops=[0: RGB(0, 192, 192), 0.481: RGB(203, 39, 63)])  # disabled
preview_2 = CustomPreview(Geometry=cap, Material=gradient)  # disabled

# ---- group: Points for evaluation
pt_2 = Point(sdivide.Points)  # disabled

# ----
# 3.Distribution Cone
Z_2 = UnitZ(Factor=1)  # disabled
Z_3 = UnitZ(Factor=1)  # disabled
brep = Brep(<brep referenced from the Rhino model>)  # disabled
number_slider_11 = Slider(0.8, range=0..1)  # disabled
move_2 = Move(Geometry=brep, Motion=Z_2)  # -> Geometry, Transform; disabled
line = LineSDL(Start=pt_2, Direction=Z_3, Length=50)  # disabled
bcx = BrepCurve(Brep=move_2.Geometry, Curve=line)  # -> Curves, flatten(Points); disabled
cir_4 = Circle(Plane=pt_2, Radius=number_slider_11)  # disabled
cir_5 = Circle(Plane=bcx.Points, Radius=number_slider_11)  # disabled
pdecon_2 = Deconstruct(Point=bcx.Points)  # -> XComponent, YComponent, ZComponent; disabled
rulesrf_2 = RuledSurface(CurveA=cir_4, CurveB=cir_5)  # disabled
bnd_3 = Bounds(Numbers=pdecon_2.ZComponent)  # disabled
cap_2 = CapHoles(Brep=rulesrf_2)  # disabled
remap_3 = RemapNumbers(Value=pdecon_2.ZComponent, Source=bnd_3, Target=Domain(0, 1))  # -> Mapped, Clipped; disabled
gradient_2 = Gradient(LowerLimit=0, UpperLimit=1, Parameter=remap_3.Mapped, stops=[0: RGB(0, 192, 192), 0.3: RGB(203, 39, 63)])  # disabled
preview_3 = CustomPreview(Geometry=cap_2, Material=gradient_2)  # disabled

# ---- group: Globle control
point_color = ColourSwatch(SwatchColor=RGB(0, 0, 0))
line_color = ColourSwatch(SwatchColor=RGB(95, 78, 85))
# 1. Facility Points and Linkages
thickness = Slider(3, range=0..10)

# ---- group: Global control
swatch = ColourSwatch(SwatchColor=RGB(0, 0, 0))
# 2. Minimal Spanning
number_slider_12 = Slider(3.6, range=0..10)

# ----
# Residential points
point_2 = Point(Tree({0}: [Point(74.00661867, 21.87264322, 0)], {1}: [Point(47.30490932, 63.39716251, 0)], {2}: [Point(82.00635615, 28.00878913, 0)], {3}: [Point(47.94396143, 65.95178389, 0)], {4}: [Point(17.52669515, 25.94292827, 0)], {5}: [Point(21.9618074, 32.00988228, 0)]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))

# ----
# Facility points
point_3 = Point([Point(65.993, 18.239, 0), Point(39.385, 63.945, 0), Point(90.293, 28.247, 0), Point(13.034, 22.1, 0), Point(26.871, 41.08, 0), Point(66.223, 37.537, 0), Point(82.395, 38.937, 0), Point(43.406, 82.97, 0), Point(82.391, 15.382, 0), Point(38.531, 24.549, 0), Point(57.913, 82.702, 0), Point(59.25, 62.656, 0)])

# ----
# Mininmal Spanning(km)
cluster = Cluster_7(d1=point_2, d2=point_3)  # -> mininmal_spanning, crv_2; disabled
data = Data(643.7772278)
panel_10 = Panel(data)
data_2 = Data([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])

# ----
# Facility capacity(TPD)
data_3 = Data([900, 1140, 600, 1380, 1380, 1020, 780, 1020, 660, 1320, 780, 1020])
panel_11 = Panel(data_3)

# ----
# Facility linkage
curve_2 = Curve(Tree({0}: [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], {1}: [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], {2}: [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], {3}: [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], {4}: [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], {5}: [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]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))
param_viewer = ParamViewer(curve_2)

# ----
# Linkage mileage(km)
data_4 = Data(1534.123)
panel_12 = Panel(data_4)

# ----
# Total Cost(euro)
data_5 = Data("38913432.168182")
panel_13 = Panel(data_5)

# ----
# Recovered organic waste (ton)
data_6 = Data("1628198.821513")
# 12
panel_14 = Panel(data_6)

# ----
# Total revenue (euro)
data_7 = Data("274711453.8")
panel_15 = Panel(data_7)

# ----
# GWP
data_8 = Data("40447.690976")
panel_16 = Panel(data_8)

# ---- group: Points
data_9 = Data(point_3)

# ----
point_color_2 = Data(point_color)

# ---- group: Capacity
data_10 = Data(data_3)

# ---- group: llinkage
data_11 = Data(curve_2)

# ---- group: Thickness
data_12 = Data(thickness)

# ---- group: Line Color
data_13 = Data(line_color)

# ---- group: Linkage
# 12
data_14 = Data(data_2)

# ---- group: Line Thickness
data_15 = Data(number_slider_12)

# ----
line_color_2 = Data(swatch)
previewlw = CustomPreviewLineweights(Geometry=data_14, Shader=line_color_2, Thickness=data_15, Absolute=False)

sqrt = SquareRoot(Value=data_10)
cir_6 = Circle(Plane=data_9, Radius=expr("x/40", sqrt))
boundary_2 = BoundarySurfaces(Edges=cir_6)
preview_4 = CustomPreview(Geometry=boundary_2, Material=point_color_2)
previewlw_2 = CustomPreviewLineweights(Geometry=data_11, Shader=data_13, Thickness=data_12, Absolute=False)

param_viewer_2 = ParamViewer(point_3)

# ----
# 12
param_viewer_3 = ParamViewer(point_2)

point_color_3 = Data(point_color)

# ---- group: Thickness
data_16 = Data(Slider(1, range=0..1))

# ---- group: Line Color
data_17 = Data(line_color)

# ----
# Residential points
point_4 = Point(Tree({0}: [Point(74.00661867, 21.87264322, 0)], {1}: [Point(47.30490932, 63.39716251, 0)], {2}: [Point(82.00635615, 28.00878913, 0)], {3}: [Point(47.94396143, 65.95178389, 0)], {4}: [Point(17.52669515, 25.94292827, 0)], {5}: [Point(21.9618074, 32.00988228, 0)]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))

# ----
# Facility points
point_5 = Point([Point(63.138, 22.91, 0), Point(53.731, 59.648, 0), Point(87.382, 22.645, 0), Point(15.677, 18.203, 0), Point(20.478, 40.372, 0), Point(38.233, 27.226, 0), Point(71.827, 40.835, 0), Point(37.009, 70.702, 0), Point(63.646, 69.315, 0), Point(49.329, 85.007, 0), Point(39.726, 57.841, 0)])

# ----
# Mininmal Spanning(km)
cluster_2 = Cluster_7(d1=point_4, d2=point_5)  # -> mininmal_spanning, crv_2; disabled
data_18 = Data(651.4185519)
panel_17 = Panel(data_18)
data_19 = Data([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])

# ----
# Facility capacity(TPD)
data_20 = Data([1260, 660, 1380, 1260, 1260, 1380, 1380, 900, 720, 1320, 480])
panel_18 = Panel(data_20)

# ----
# Facility linkage
curve_3 = Curve(Tree({0}: [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], {1}: [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], {2}: [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], {3}: [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], {4}: [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], {5}: [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]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))
param_viewer_4 = ParamViewer(curve_3)

# ----
# Linkage mileage(km)
data_21 = Data(1609.832)
panel_19 = Panel(data_21)

# ----
# Total Cost(euro)
data_22 = Data("38798185.661904")
panel_20 = Panel(data_22)

# ----
# GWP
data_23 = Data("40443.95381")
panel_21 = Panel(data_23)

# ----
# Recovered organic waste (ton)
data_24 = Data("1630200.076639")
# 11
panel_22 = Panel(data_24)

# ----
# Total revenue (euro)
data_25 = Data("275255055.6")
panel_23 = Panel(data_25)

# ---- group: Points
data_26 = Data(point_5)

# ----
point_color_4 = Data(point_color)

# ---- group: Capacity
data_27 = Data(data_20)

# ---- group: llinkage
data_28 = Data(curve_3)

# ---- group: Thickness
data_29 = Data(thickness)

# ---- group: Line Color
data_30 = Data(line_color)

# ---- group: Linkage
# 11
data_31 = Data(data_19)

# ---- group: Line Thickness
data_32 = Data(number_slider_12)

# ----
line_color_3 = Data(swatch)
previewlw_3 = CustomPreviewLineweights(Geometry=data_31, Shader=line_color_3, Thickness=data_32, Absolute=False)

sqrt_2 = SquareRoot(Value=data_27)
cir_7 = Circle(Plane=data_26, Radius=expr("x/40", sqrt_2))
boundary_3 = BoundarySurfaces(Edges=cir_7)
preview_5 = CustomPreview(Geometry=boundary_3, Material=point_color_4)
previewlw_4 = CustomPreviewLineweights(Geometry=data_28, Shader=data_30, Thickness=data_29, Absolute=False)

param_viewer_5 = ParamViewer(point_5)

# ----
# 11
param_viewer_6 = ParamViewer(point_4)

# ----
# Lowerest point of monetary cost
# Residential points
point_6 = Point(Tree({0}: [Point(74.00661867, 21.87264322, 0)], {1}: [Point(47.30490932, 63.39716251, 0)], {2}: [Point(82.00635615, 28.00878913, 0)], {3}: [Point(47.94396143, 65.95178389, 0)], {4}: [Point(17.52669515, 25.94292827, 0)], {5}: [Point(21.9618074, 32.00988228, 0)]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))

# ----
# Facility points
point_7 = Point([Point(61.781, 39.012, 0), Point(45.318, 55.207, 0), Point(41.183, 33.802, 0)])

# ----
# Mininmal Spanning(km)
cluster_3 = Cluster_7(d1=point_6, d2=point_7)  # -> mininmal_spanning, crv_2; disabled
data_33 = Data()
panel_24 = Panel(data_33)
data_34 = Data()

# ----
# Facility capacity(TPD)
data_35 = Data([4020, 4020, 3960])
panel_25 = Panel(data_35)

# ----
# Facility linkage
curve_4 = Curve(Tree({0}: [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], {1}: [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], {2}: [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], {3}: [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], {4}: [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], {5}: [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]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))
param_viewer_7 = ParamViewer(curve_4)

# ----
# Linkage mileage(km)
data_36 = Data(3941.279)
panel_26 = Panel(data_36)

# ----
# Total Cost(euro)
data_37 = Data("37376839.467636")
panel_27 = Panel(data_37)

# ----
# GWP
data_38 = Data("43212.029003")
panel_28 = Panel(data_38)

# ----
# Residential points
point_8 = Point(Tree({0}: [Point(74.00661867, 21.87264322, 0)], {1}: [Point(47.30490932, 63.39716251, 0)], {2}: [Point(82.00635615, 28.00878913, 0)], {3}: [Point(47.94396143, 65.95178389, 0)], {4}: [Point(17.52669515, 25.94292827, 0)], {5}: [Point(21.9618074, 32.00988228, 0)]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))

# ----
# Facility points
point_9 = Point([Point(63.133, 22.907, 0), Point(44.211, 58.605, 0), Point(87.399, 22.621, 0), Point(15.693, 18.184, 0), Point(20.388, 40.3, 0), Point(38.223, 27.144, 0), Point(71.769, 40.824, 0), Point(36.829, 71.033, 0), Point(62.927, 67.761, 0), Point(49.303, 84.997, 0)])

# ----
# Mininmal Spanning(km)
cluster_4 = Cluster_7(d1=point_8, d2=point_9)  # -> mininmal_spanning, crv_2; disabled
data_39 = Data(653.3834128)
panel_29 = Panel(data_39)
data_40 = Data([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])

# ----
# Facility capacity(TPD)
data_41 = Data([1260, 960, 1380, 1260, 1260, 1380, 1380, 840, 960, 1320])
panel_30 = Panel(data_41)

# ----
# Facility linkage
curve_5 = Curve(Tree({0}: [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], {1}: [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], {2}: [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], {3}: [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], {4}: [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], {5}: [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]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))
param_viewer_8 = ParamViewer(curve_5)

# ----
# Linkage mileage(km)
data_42 = Data(1649.06)
panel_31 = Panel(data_42)

# ----
# Total Cost(euro)
data_43 = Data("38651174.331552")
panel_32 = Panel(data_43)

# ----
# GWP
data_44 = Data("40381.070558")
panel_33 = Panel(data_44)

# ----
# Recovered organic waste (ton)
data_45 = Data("1630982.293109")
# 10
panel_34 = Panel(data_45)

# ----
# Total revenue (euro)
data_46 = Data("275467529.4")
panel_35 = Panel(data_46)

# ---- group: Points
data_47 = Data(point_9)

# ----
point_color_5 = Data(point_color)

# ---- group: Capacity
data_48 = Data(data_41)

# ---- group: llinkage
data_49 = Data(curve_5)

# ---- group: Thickness
data_50 = Data(thickness)

# ---- group: Line Color
data_51 = Data(line_color)

# ---- group: Linkage
# 10
data_52 = Data(data_40)

# ---- group: Line Thickness
data_53 = Data(number_slider_12)

# ----
line_color_4 = Data(swatch)
previewlw_5 = CustomPreviewLineweights(Geometry=data_52, Shader=line_color_4, Thickness=data_53, Absolute=False)

param_viewer_9 = ParamViewer(point_7)

param_viewer_10 = ParamViewer(point_6)

sqrt_3 = SquareRoot(Value=data_48)
cir_8 = Circle(Plane=data_47, Radius=expr("x/40", sqrt_3))
boundary_4 = BoundarySurfaces(Edges=cir_8)
preview_6 = CustomPreview(Geometry=boundary_4, Material=point_color_5)
previewlw_6 = CustomPreviewLineweights(Geometry=data_49, Shader=data_51, Thickness=data_50, Absolute=False)

param_viewer_11 = ParamViewer(point_9)

# ----
# 10
param_viewer_12 = ParamViewer(point_8)

# ----
# Residential points
point_10 = Point(Tree({0}: [Point(74.00661867, 21.87264322, 0)], {1}: [Point(47.30490932, 63.39716251, 0)], {2}: [Point(82.00635615, 28.00878913, 0)], {3}: [Point(47.94396143, 65.95178389, 0)], {4}: [Point(17.52669515, 25.94292827, 0)], {5}: [Point(21.9618074, 32.00988228, 0)]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))

# ----
# Facility points
point_11 = Point([Point(63.16, 22.854, 0), Point(39.571, 63.309, 0), Point(87.161, 22.103, 0), Point(15.716, 18.15, 0), Point(20.38, 40.273, 0), Point(38.217, 27.142, 0), Point(71.417, 40.892, 0), Point(48.304, 84.75, 0), Point(61.858, 66.298, 0)])

# ----
# Mininmal Spanning(km)
cluster_5 = Cluster_7(d1=point_10, d2=point_11)  # -> mininmal_spanning, crv_2; disabled
data_54 = Data(650.662438)
panel_36 = Panel(data_54)
data_55 = Data([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])

# ----
# Facility capacity(TPD)
data_56 = Data([1260, 1440, 1380, 1260, 1260, 1380, 1440, 1440, 1140])
panel_37 = Panel(data_56)

# ----
# Facility linkage
curve_6 = Curve(Tree({0}: [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], {1}: [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], {2}: [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], {3}: [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], {4}: [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], {5}: [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]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))
param_viewer_13 = ParamViewer(curve_6)

# ----
# Linkage mileage(km)
data_57 = Data(1704.097)
panel_38 = Panel(data_57)

# ----
# Total Cost(euro)
data_58 = Data("38531684.482258")
panel_39 = Panel(data_58)

# ----
# Recovered organic waste (ton)
data_59 = Data("1632851.485714")
# 9
panel_40 = Panel(data_59)

# ----
# GWP
data_60 = Data("40343.818196")
panel_41 = Panel(data_60)

# ----
# Total revenue (euro)
data_61 = Data("275975259")
panel_42 = Panel(data_61)

# ---- group: Points
data_62 = Data(point_11)

# ----
point_color_6 = Data(point_color)

# ---- group: Capacity
data_63 = Data(data_56)

# ---- group: llinkage
data_64 = Data(curve_6)

# ---- group: Thickness
data_65 = Data(thickness)

# ---- group: Line Color
data_66 = Data(line_color)

# ---- group: Linkage
# 9
data_67 = Data(data_55)

# ---- group: Line Thickness
data_68 = Data(number_slider_12)

# ----
line_color_5 = Data(swatch)
previewlw_7 = CustomPreviewLineweights(Geometry=data_67, Shader=line_color_5, Thickness=data_68, Absolute=False)

sqrt_4 = SquareRoot(Value=data_63)
cir_9 = Circle(Plane=data_62, Radius=expr("x/40", sqrt_4))
boundary_5 = BoundarySurfaces(Edges=cir_9)
preview_7 = CustomPreview(Geometry=boundary_5, Material=point_color_6)
previewlw_8 = CustomPreviewLineweights(Geometry=data_64, Shader=data_66, Thickness=data_65, Absolute=False)

param_viewer_14 = ParamViewer(point_11)

# ----
# 9
param_viewer_15 = ParamViewer(point_10)

# ---- group: Surface represent land price
# VII.Land price based location (euro/m2)
srfgrid = SurfaceFromPoints(Points=move.Geometry, UCount=expr("x+1", number_slider_9), Interpolate=False)
srf = Surface(srfgrid)

# ----
# Residential points
point_12 = Point(Tree({0}: [Point(74.00661867, 21.87264322, 0)], {1}: [Point(47.30490932, 63.39716251, 0)], {2}: [Point(82.00635615, 28.00878913, 0)], {3}: [Point(47.94396143, 65.95178389, 0)], {4}: [Point(17.52669515, 25.94292827, 0)], {5}: [Point(21.9618074, 32.00988228, 0)]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))

# ----
# Facility points
point_13 = Point([Point(63.158, 22.884, 0), Point(39.565, 63.29, 0), Point(87.093, 21.923, 0), Point(16.66, 37.638, 0), Point(36.556, 23.021, 0), Point(71.297, 40.927, 0), Point(48.341, 84.768, 0), Point(61.828, 66.245, 0)])

# ----
# Mininmal Spanning(km)
cluster_6 = Cluster_7(d1=point_12, d2=point_13)  # -> mininmal_spanning, crv_2; disabled
data_69 = Data(651.4401607)
panel_43 = Panel(data_69)
data_70 = Data([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])

# ----
# Facility capacity(TPD)
data_71 = Data([1260, 1440, 1380, 1920, 1980, 1440, 1440, 1140])
panel_44 = Panel(data_71)

# ----
# Facility linkage
curve_7 = Curve(Tree({0}: [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], {1}: [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], {2}: [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], {3}: [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], {4}: [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], {5}: [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]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))
param_viewer_16 = ParamViewer(curve_7)

# ----
# Linkage mileage(km)
data_72 = Data(1844.623)
panel_45 = Panel(data_72)

# ----
# Total Cost(euro)
data_73 = Data("38499966.542318")
panel_46 = Panel(data_73)

# ----
# GWP
data_74 = Data("40445.167837")
panel_47 = Panel(data_74)

# ----
# Total revenue (euro)
data_75 = Data("276943808.4")
panel_48 = Panel(data_75)

# ----
# Recovered organic waste (ton)
data_76 = Data("1636417.173782")
# 8
panel_49 = Panel(data_76)

# ---- group: Points
data_77 = Data(point_13)

# ----
point_color_7 = Data(point_color)

# ---- group: Capacity
data_78 = Data(data_71)

# ---- group: llinkage
data_79 = Data(curve_7)

# ---- group: Thickness
data_80 = Data(thickness)

# ---- group: Line Color
data_81 = Data(line_color)

# ---- group: Linkage
# 8
data_82 = Data(data_70)

# ---- group: Line Thickness
data_83 = Data(number_slider_12)

# ----
line_color_6 = Data(swatch)
previewlw_9 = CustomPreviewLineweights(Geometry=data_82, Shader=line_color_6, Thickness=data_83, Absolute=False)

# ----
# Lowerest point of monetary cost
# Residential points
point_14 = Point(Tree({0}: [Point(74.00661867, 21.87264322, 0)], {1}: [Point(47.30490932, 63.39716251, 0)], {2}: [Point(82.00635615, 28.00878913, 0)], {3}: [Point(47.94396143, 65.95178389, 0)], {4}: [Point(17.52669515, 25.94292827, 0)], {5}: [Point(21.9618074, 32.00988228, 0)]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))

# ----
# Facility points
point_15 = Point(Point(49.911, 42.761, 0))

# ----
# Mininmal Spanning(km)
cluster_7 = Cluster_7(d1=point_14, d2=point_15)  # -> mininmal_spanning, crv_2; disabled
data_84 = Data(643.4318144)
panel_50 = Panel(data_84)
data_85 = Data([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])

# ----
# Facility capacity(TPD)
data_86 = Data(12000)
panel_51 = Panel(data_86)

# ----
# Facility linkage
curve_8 = Curve(Tree({0}: [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], {1}: [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], {2}: [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], {3}: [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], {4}: [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], {5}: [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]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))
param_viewer_17 = ParamViewer(curve_8)

# ----
# Linkage mileage(km)
data_87 = Data(6096.78)
panel_52 = Panel(data_87)

# ----
# Total Cost(euro)
data_88 = Data("37893995.648529")
panel_53 = Panel(data_88)

# ----
# GWP
data_89 = Data("46453.743683")
panel_54 = Panel(data_89)

sqrt_5 = SquareRoot(Value=data_78)
cir_10 = Circle(Plane=data_77, Radius=expr("x/40", sqrt_5))
boundary_6 = BoundarySurfaces(Edges=cir_10)
preview_8 = CustomPreview(Geometry=boundary_6, Material=point_color_7)
previewlw_10 = CustomPreviewLineweights(Geometry=data_79, Shader=data_81, Thickness=data_80, Absolute=False)

param_viewer_18 = ParamViewer(point_13)

# ----
# Weighted-COST as fitness
# 8
param_viewer_19 = ParamViewer(point_12)

param_viewer_20 = ParamViewer(point_15)

param_viewer_21 = ParamViewer(point_14)

# ----
# Residential points
point_16 = Point(Tree({0}: [Point(74.00661867, 21.87264322, 0)], {1}: [Point(47.30490932, 63.39716251, 0)], {2}: [Point(82.00635615, 28.00878913, 0)], {3}: [Point(47.94396143, 65.95178389, 0)], {4}: [Point(17.52669515, 25.94292827, 0)], {5}: [Point(21.9618074, 32.00988228, 0)]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))

# ----
# Facility points
point_17 = Point([Point(81.321, 16.577, 0), Point(39.58, 63.291, 0), Point(16.875, 37.926, 0), Point(68.466, 39.049, 0), Point(36.818, 23.22, 0), Point(48.336, 84.77, 0), Point(61.81, 66.242, 0)])

# ----
# Mininmal Spanning(km)
cluster_8 = Cluster_7(d1=point_16, d2=point_17)  # -> mininmal_spanning, crv_2; disabled
data_90 = Data(645.9219716)
panel_55 = Panel(data_90)
data_91 = Data([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])

# ----
# Facility capacity(TPD)
data_92 = Data([1980, 1440, 1920, 2040, 2040, 1440, 1140])
panel_56 = Panel(data_92)

# ----
# Facility linkage
curve_9 = Curve(Tree({0}: [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], {1}: [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], {2}: [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], {3}: [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], {4}: [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], {5}: [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]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))
param_viewer_22 = ParamViewer(curve_9)

# ----
# Linkage mileage(km)
data_93 = Data(1979.941)
panel_57 = Panel(data_93)

# ----
# Total Cost(euro)
data_94 = Data("38418236.266081")
panel_58 = Panel(data_94)

# ----
# Recovered organic waste (ton)
data_95 = Data("1640307.938824")
# 7
panel_59 = Panel(data_95)

# ----
# GWP
data_96 = Data("40538.073828")
panel_60 = Panel(data_96)

# ----
# Total revenue (euro)
data_97 = Data("278000658.6")
panel_61 = Panel(data_97)

# ---- group: Points
data_98 = Data(point_17)

# ----
point_color_8 = Data(point_color)

# ---- group: Capacity
data_99 = Data(data_92)

# ---- group: llinkage
data_100 = Data(curve_9)

# ---- group: Thickness
data_101 = Data(thickness)

# ---- group: Line Color
data_102 = Data(line_color)

# ---- group: Linkage
# 7
data_103 = Data(data_91)

# ---- group: Line Thickness
# Visualization
data_104 = Data(number_slider_12)

# ----
line_color_7 = Data(swatch)
previewlw_11 = CustomPreviewLineweights(Geometry=data_103, Shader=line_color_7, Thickness=data_104, Absolute=False)

sqrt_6 = SquareRoot(Value=data_99)
cir_11 = Circle(Plane=data_98, Radius=expr("x/40", sqrt_6))
boundary_7 = BoundarySurfaces(Edges=cir_11)
preview_9 = CustomPreview(Geometry=boundary_7, Material=point_color_8)
previewlw_12 = CustomPreviewLineweights(Geometry=data_100, Shader=data_102, Thickness=data_101, Absolute=False)

param_viewer_23 = ParamViewer(point_17)

# ----
# Database
# 7
param_viewer_24 = ParamViewer(point_16)

# ----
# Residential points
point_18 = Point(Tree({0}: [Point(74.00661867, 21.87264322, 0)], {1}: [Point(47.30490932, 63.39716251, 0)], {2}: [Point(82.00635615, 28.00878913, 0)], {3}: [Point(47.94396143, 65.95178389, 0)], {4}: [Point(17.52669515, 25.94292827, 0)], {5}: [Point(21.9618074, 32.00988228, 0)]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))

# ----
# Facility points
point_19 = Point([Point(82.07, 16.754, 0), Point(53.951, 60.099, 0), Point(17.046, 38.047, 0), Point(68.098, 38.357, 0), Point(36.904, 23.357, 0), Point(43.284, 82.798, 0)])

# ----
# Mininmal Spanning(km)
cluster_9 = Cluster_7(d1=point_18, d2=point_19)  # -> mininmal_spanning, crv_2; disabled
data_105 = Data(641.7885402)
panel_62 = Panel(data_105)
data_106 = Data([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])

# ----
# Facility capacity(TPD)
data_107 = Data([1920, 1860, 1980, 2040, 2040, 2160])
panel_63 = Panel(data_107)

# ----
# Facility linkage
curve_10 = Curve(Tree({0}: [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], {1}: [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], {2}: [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], {3}: [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], {4}: [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], {5}: [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]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))
param_viewer_25 = ParamViewer(curve_10)

# ----
# Linkage mileage(km)
data_108 = Data(2139.323)
panel_64 = Panel(data_108)

# ----
# Total Cost(euro)
data_109 = Data("38370112.942649")
panel_65 = Panel(data_109)

# ----
# GWP
data_110 = Data("40669.994412")
panel_66 = Panel(data_110)

# ----
# Total revenue (euro)
data_111 = Data("279027155.4")
panel_67 = Panel(data_111)

# ----
# Recovered organic waste (ton)
data_112 = Data("1644086.958655")
# 6
panel_68 = Panel(data_112)

# ---- group: Points
data_113 = Data(point_19)

# ----
point_color_9 = Data(point_color)

# ---- group: Capacity
data_114 = Data(data_107)

# ---- group: llinkage
data_115 = Data(curve_10)

# ---- group: Thickness
data_116 = Data(thickness)

# ---- group: Line Color
data_117 = Data(line_color)

# ---- group: Linkage
# 6
data_118 = Data(data_106)

# ---- group: Line Thickness
data_119 = Data(number_slider_12)

# ----
line_color_8 = Data(swatch)
previewlw_13 = CustomPreviewLineweights(Geometry=data_118, Shader=line_color_8, Thickness=data_119, Absolute=False)

sqrt_7 = SquareRoot(Value=data_114)
cir_12 = Circle(Plane=data_113, Radius=expr("x/40", sqrt_7))
boundary_8 = BoundarySurfaces(Edges=cir_12)
preview_10 = CustomPreview(Geometry=boundary_8, Material=point_color_9)
previewlw_14 = CustomPreviewLineweights(Geometry=data_115, Shader=data_117, Thickness=data_116, Absolute=False)

param_viewer_26 = ParamViewer(point_19)

# ----
# 6
param_viewer_27 = ParamViewer(point_18)

# ----
# Residential points
point_20 = Point(Tree({0}: [Point(74.00661867, 21.87264322, 0)], {1}: [Point(47.30490932, 63.39716251, 0)], {2}: [Point(82.00635615, 28.00878913, 0)], {3}: [Point(47.94396143, 65.95178389, 0)], {4}: [Point(17.52669515, 25.94292827, 0)], {5}: [Point(21.9618074, 32.00988228, 0)]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))

# ----
# Facility points
point_21 = Point([Point(66.712, 36.293, 0), Point(53.682, 59.902, 0), Point(17.052, 38.051, 0), Point(36.915, 23.37, 0), Point(43.006, 82.774, 0)])

# ----
# Mininmal Spanning(km)
cluster_10 = Cluster_7(d1=point_20, d2=point_21)  # -> mininmal_spanning, crv_2; disabled
data_120 = Data(639.7977635)
panel_69 = Panel(data_120)
data_121 = Data([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])

# ----
# Facility capacity(TPD)
data_122 = Data([3960, 1860, 1980, 2040, 2160])
panel_70 = Panel(data_122)

# ----
# Facility linkage
curve_11 = Curve(Tree({0}: [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], {1}: [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], {2}: [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], {3}: [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], {4}: [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], {5}: [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]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))
param_viewer_28 = ParamViewer(curve_11)

# ----
# Linkage mileage(km)
data_123 = Data(2465.115)
panel_71 = Panel(data_123)

# ----
# Total Cost(euro)
data_124 = Data("38311381.06343")
panel_72 = Panel(data_124)

# ----
# GWP
data_125 = Data("41071.712976")
panel_73 = Panel(data_125)

# ----
# Total revenue (euro)
data_126 = Data("282029382.6")
panel_74 = Panel(data_126)

# ----
# Recovered organic waste (ton)
data_127 = Data("1655139.575798")
# 5
panel_75 = Panel(data_127)

# ---- group: Points
data_128 = Data(point_21)

# ----
point_color_10 = Data(point_color)

# ---- group: Capacity
data_129 = Data(data_122)

# ---- group: llinkage
data_130 = Data(curve_11)

# ---- group: Thickness
data_131 = Data(thickness)

# ---- group: Line Color
data_132 = Data(line_color)

# ---- group: Linkage
# 5
data_133 = Data(data_121)

# ---- group: Line Thickness
data_134 = Data(number_slider_12)

# ----
line_color_9 = Data(swatch)
previewlw_15 = CustomPreviewLineweights(Geometry=data_133, Shader=line_color_9, Thickness=data_134, Absolute=False)

# ---- group: Z height range for price surface
panel_76 = Panel("1")
panel_77 = Panel("30")

# ---- group: Landprice in reality
panel_78 = Panel("60")
panel_79 = Panel("20")

# ----
sqrt_8 = SquareRoot(Value=data_129)
cir_13 = Circle(Plane=data_128, Radius=expr("x/40", sqrt_8))
boundary_9 = BoundarySurfaces(Edges=cir_13)
preview_11 = CustomPreview(Geometry=boundary_9, Material=point_color_10)
previewlw_16 = CustomPreviewLineweights(Geometry=data_130, Shader=data_132, Thickness=data_131, Absolute=False)

param_viewer_29 = ParamViewer(point_21)

# ----
# 5
param_viewer_30 = ParamViewer(point_20)

# ----
# Residential points
point_22 = Point(Tree({0}: [Point(74.00661867, 21.87264322, 0)], {1}: [Point(47.30490932, 63.39716251, 0)], {2}: [Point(82.00635615, 28.00878913, 0)], {3}: [Point(47.94396143, 65.95178389, 0)], {4}: [Point(17.52669515, 25.94292827, 0)], {5}: [Point(21.9618074, 32.00988228, 0)]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))

# ----
# Facility points
point_23 = Point([Point(66.414, 36.03, 0), Point(54.475, 60.181, 0), Point(34.063, 35.502, 0), Point(43.294, 82.685, 0)])

# ----
# Mininmal Spanning(km)
cluster_11 = Cluster_7(d1=point_22, d2=point_23)  # -> mininmal_spanning, crv_2; disabled
data_135 = Data(640.4195868)
panel_80 = Panel(data_135)
data_136 = Data([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])

# ----
# Facility capacity(TPD)
data_137 = Data([4020, 1800, 4020, 2160])
panel_81 = Panel(data_137)

# ----
# Facility linkage
curve_12 = Curve(Tree({0}: [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], {1}: [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], {2}: [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], {3}: [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], {4}: [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], {5}: [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]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))
param_viewer_31 = ParamViewer(curve_12)

# ----
# Linkage mileage(km)
data_138 = Data(2765.853)
panel_82 = Panel(data_138)

# ----
# Total Cost(euro)
data_139 = Data("38219753.226894")
panel_83 = Panel(data_139)

# ----
# GWP
data_140 = Data("41432.811874")
panel_84 = Panel(data_140)

# ----
# Total revenue (euro)
data_141 = Data("285224767.8")
panel_85 = Panel(data_141)

# ----
# Recovered organic waste (ton)
data_142 = Data("1666903.298824")
# 4
panel_86 = Panel(data_142)

# ---- group: Points
data_143 = Data(point_23)

# ----
point_color_11 = Data(point_color)

# ---- group: Capacity
data_144 = Data(data_137)

# ---- group: llinkage
data_145 = Data(curve_12)

# ---- group: Thickness
data_146 = Data(thickness)

# ---- group: Line Color
data_147 = Data(line_color)

# ---- group: Linkage
# 4
data_148 = Data(data_136)

# ---- group: Line Thickness
data_149 = Data(number_slider_12)

# ----
line_color_10 = Data(swatch)
previewlw_17 = CustomPreviewLineweights(Geometry=data_148, Shader=line_color_10, Thickness=data_149, Absolute=False)

sqrt_9 = SquareRoot(Value=data_144)
cir_14 = Circle(Plane=data_143, Radius=expr("x/40", sqrt_9))
boundary_10 = BoundarySurfaces(Edges=cir_14)
preview_12 = CustomPreview(Geometry=boundary_10, Material=point_color_11)
previewlw_18 = CustomPreviewLineweights(Geometry=data_145, Shader=data_147, Thickness=data_146, Absolute=False)

param_viewer_32 = ParamViewer(point_23)

# ----
# 4
param_viewer_33 = ParamViewer(point_22)

# ----
# Residential points
point_24 = Point(Tree({0}: [Point(74.00661867, 21.87264322, 0)], {1}: [Point(47.30490932, 63.39716251, 0)], {2}: [Point(82.00635615, 28.00878913, 0)], {3}: [Point(47.94396143, 65.95178389, 0)], {4}: [Point(17.52669515, 25.94292827, 0)], {5}: [Point(21.9618074, 32.00988228, 0)]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))

# ----
# Facility points
point_25 = Point([Point(66.413, 36.184, 0), Point(42.294, 63.049, 0), Point(34.041, 35.534, 0)])

# ----
# Mininmal Spanning(km)
cluster_12 = Cluster_7(d1=point_24, d2=point_25)  # -> mininmal_spanning, crv_2; disabled
data_150 = Data(638.8561175)
panel_87 = Panel(data_150)
data_151 = Data([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])

# ----
# Facility capacity(TPD)
data_152 = Data([4080, 3900, 4020])
panel_88 = Panel(data_152)

# ----
# Facility linkage
curve_13 = Curve(Tree({0}: [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], {1}: [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], {2}: [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], {3}: [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], {4}: [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], {5}: [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]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))
param_viewer_34 = ParamViewer(curve_13)

# ----
# Linkage mileage(km)
data_153 = Data("3071.715")
panel_89 = Panel(data_153)

# ----
# Total Cost(euro)
data_154 = Data("38183560.615965")
panel_90 = Panel(data_154)

# ----
# GWP
data_155 = Data("41802.218235")
panel_91 = Panel(data_155)

# ----
# Total revenue (euro)
data_156 = Data("288210438.6")
panel_92 = Panel(data_156)

# ----
# Recovered organic waste (ton)
data_157 = Data("1677894.964034")
# 3
panel_93 = Panel(data_157)

# ---- group: Points
data_158 = Data(point_25)

# ----
point_color_12 = Data(point_color)

# ---- group: Capacity
data_159 = Data(data_152)

# ---- group: llinkage
data_160 = Data(curve_13)

# ---- group: Thickness
data_161 = Data(thickness)

# ---- group: Line Color
data_162 = Data(line_color)

# ---- group: Linkage
data_163 = Data(data_151)

# ---- group: Line Thickness
data_164 = Data(number_slider_12)

# ----
line_color_11 = Data(swatch)
# 3
previewlw_19 = CustomPreviewLineweights(Geometry=data_163, Shader=line_color_11, Thickness=data_164, Absolute=False)

sqrt_10 = SquareRoot(Value=data_159)
cir_15 = Circle(Plane=data_158, Radius=expr("x/40", sqrt_10))
boundary_11 = BoundarySurfaces(Edges=cir_15)
preview_13 = CustomPreview(Geometry=boundary_11, Material=point_color_12)
previewlw_20 = CustomPreviewLineweights(Geometry=data_160, Shader=data_162, Thickness=data_161, Absolute=False)

param_viewer_35 = ParamViewer(point_25)

# ----
# 3
param_viewer_36 = ParamViewer(point_24)

# ----
# Residential points
point_26 = Point(Tree({0}: [Point(74.00661867, 21.87264322, 0)], {1}: [Point(47.30490932, 63.39716251, 0)], {2}: [Point(82.00635615, 28.00878913, 0)], {3}: [Point(47.94396143, 65.95178389, 0)], {4}: [Point(17.52669515, 25.94292827, 0)], {5}: [Point(21.9618074, 32.00988228, 0)]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))

# ----
# Facility points
point_27 = Point([Point(66.372, 36.772, 0), Point(36.026, 49.2, 0)])

# ----
# Mininmal Spanning(km)
cluster_13 = Cluster_7(d1=point_26, d2=point_27)  # -> mininmal_spanning, crv_2; disabled
data_165 = Data(634.9431796)
panel_94 = Panel(data_165)
data_166 = Data([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])

# ----
# Facility capacity(TPD)
data_167 = Data([4500, 7500])
panel_95 = Panel(data_167)

# ----
# Facility linkage
curve_14 = Curve(Tree({0}: [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], {1}: [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], {2}: [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], {3}: [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], {4}: [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], {5}: [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]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))
param_viewer_37 = ParamViewer(curve_14)

# ----
# Linkage mileage(km)
data_168 = Data(4572.294)
panel_96 = Panel(data_168)

# ----
# Total Cost(euro)
data_169 = Data("37788581.661744")
panel_97 = Panel(data_169)

# ----
# GWP
data_170 = Data("44108.600933")
panel_98 = Panel(data_170)

# ----
# Total revenue (euro)
data_171 = Data("299126625")
panel_99 = Panel(data_171)

# ----
# Recovered organic waste (ton)
data_172 = Data("1718082.605042")
# 2
panel_100 = Panel(data_172)

# ---- group: Points
data_173 = Data(point_27)

# ----
point_color_13 = Data(point_color)

# ---- group: Capacity
data_174 = Data(data_167)

# ---- group: llinkage
data_175 = Data(curve_14)

# ---- group: Thickness
data_176 = Data(thickness)

# ---- group: Line Color
data_177 = Data(line_color)

# ---- group: Linkage
data_178 = Data(data_166)

# ---- group: Line Thickness
data_179 = Data(number_slider_12)

# ----
line_color_12 = Data(swatch)
# 2
previewlw_21 = CustomPreviewLineweights(Geometry=data_178, Shader=line_color_12, Thickness=data_179, Absolute=False)

sqrt_11 = SquareRoot(Value=data_174)
cir_16 = Circle(Plane=data_173, Radius=expr("x/40", sqrt_11))
boundary_12 = BoundarySurfaces(Edges=cir_16)
preview_14 = CustomPreview(Geometry=boundary_12, Material=point_color_13)
previewlw_22 = CustomPreviewLineweights(Geometry=data_175, Shader=data_177, Thickness=data_176, Absolute=False)

param_viewer_38 = ParamViewer(point_27)

life_time = Slider(20, range=0..100)
# 1. Calculation of Cost per Year
days = Slider(365, range=0..1000)

# ----
# 2
param_viewer_39 = ParamViewer(point_26)

# ----
# Residential points
point_28 = Point(Tree({0}: [Point(74.00661867, 21.87264322, 0)], {1}: [Point(47.30490932, 63.39716251, 0)], {2}: [Point(82.00635615, 28.00878913, 0)], {3}: [Point(47.94396143, 65.95178389, 0)], {4}: [Point(17.52669515, 25.94292827, 0)], {5}: [Point(21.9618074, 32.00988228, 0)]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))

# ----
# Facility points
point_29 = Point(Point(49.91, 42.764, 0))

# ----
# Mininmal Spanning(km)
cluster_14 = Cluster_7(d1=point_28, d2=point_29)  # -> mininmal_spanning, crv_2; disabled
data_180 = Data(643.4339034)
panel_101 = Panel(data_180)
data_181 = Data([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])

# ----
# Facility capacity(TPD)
data_182 = Data(12000)
panel_102 = Panel(data_182)

# ----
# Facility linkage
curve_15 = Curve(Tree({0}: [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], {1}: [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], {2}: [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], {3}: [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], {4}: [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], {5}: [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]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))
param_viewer_40 = ParamViewer(curve_15)

# ----
# Linkage mileage(km)
data_183 = Data(6096.78)
panel_103 = Panel(data_183)

# ----
# Total Cost(euro)
data_184 = Data("37893995.640582")
panel_104 = Panel(data_184)

# ----
# Recovered organic waste (ton)
data_185 = Data("1813320")
# 1
panel_105 = Panel(data_185)

# ----
# GWP
data_186 = Data("46453.743683")
panel_106 = Panel(data_186)

# ----
# Total revenue (euro)
data_187 = Data("324996000")
panel_107 = Panel(data_187)

# ---- group: Points
data_188 = Data(point_29)

# ----
point_color_14 = Data(point_color)

# ---- group: Capacity
data_189 = Data(data_182)

# ---- group: llinkage
data_190 = Data(curve_15)

# ---- group: Thickness
data_191 = Data(thickness)

# ---- group: Line Color
data_192 = Data(line_color)

# ---- group: Linkage
data_193 = Data(data_181)

# ---- group: Line Thickness
data_194 = Data(number_slider_12)

# ----
line_color_13 = Data(swatch)
# 1
previewlw_23 = CustomPreviewLineweights(Geometry=data_193, Shader=line_color_13, Thickness=data_194, Absolute=False)

sqrt_12 = SquareRoot(Value=data_189)
cir_17 = Circle(Plane=data_188, Radius=expr("x/40", sqrt_12))
boundary_13 = BoundarySurfaces(Edges=cir_17)
preview_15 = CustomPreview(Geometry=boundary_13, Material=point_color_14)
previewlw_24 = CustomPreviewLineweights(Geometry=data_190, Shader=data_192, Thickness=data_191, Absolute=False)

param_viewer_41 = ParamViewer(point_29)

# ----
# P-Dispersed
# 1
param_viewer_42 = ParamViewer(point_28)

# ----
# Solver
galapagos = Galapagos(fitness=ma_9, gene=[genelist_x, genelist_y])

merge = Merge(Data1=flatten(data_4), Data2=flatten(data_5), Data3=flatten(data_8), Data4=flatten(data_7), Data5=flatten(data_6))
merge_2 = Merge(Data1=flatten(data_21), Data2=flatten(data_22), Data3=flatten(data_23), Data4=flatten(data_25), Data5=flatten(data_24))
merge_3 = Merge(Data1=flatten(data_42), Data2=flatten(data_43), Data3=flatten(data_44), Data4=flatten(data_46), Data5=flatten(data_45))
merge_4 = Merge(Data1=flatten(data_57), Data2=flatten(data_58), Data3=flatten(data_60), Data4=flatten(data_61), Data5=flatten(data_59))
merge_5 = Merge(Data1=flatten(data_72), Data2=flatten(data_73), Data3=flatten(data_74), Data4=flatten(data_75), Data5=flatten(data_76))
merge_6 = Merge(Data1=flatten(data_93), Data2=flatten(data_94), Data3=flatten(data_96), Data4=flatten(data_97), Data5=flatten(data_95))
merge_7 = Merge(
    Data1=flatten(data_108),
    Data2=flatten(data_109),
    Data3=flatten(data_110),
    Data4=flatten(data_111),
    Data5=flatten(data_112))
merge_8 = Merge(
    Data1=flatten(data_123),
    Data2=flatten(data_124),
    Data3=flatten(data_125),
    Data4=flatten(data_126),
    Data5=flatten(data_127))
merge_9 = Merge(
    Data1=flatten(data_138),
    Data2=flatten(data_139),
    Data3=flatten(data_140),
    Data4=flatten(data_141),
    Data5=flatten(data_142))
merge_10 = Merge(
    Data1=flatten(data_153),
    Data2=flatten(data_154),
    Data3=flatten(data_155),
    Data4=flatten(data_156),
    Data5=flatten(data_157))
merge_11 = Merge(
    Data1=flatten(data_168),
    Data2=flatten(data_169),
    Data3=flatten(data_170),
    Data4=flatten(data_171),
    Data5=flatten(data_172))
merge_12 = Merge(
    Data1=flatten(data_183),
    Data2=flatten(data_184),
    Data3=flatten(data_186),
    Data4=flatten(data_187),
    Data5=flatten(data_185))
# Write in Excel
panel_108 = Panel("""12
11
10
9
8
7
6
5
4
3
2
1""")
entwine = Entwine(
    Branch00=merge,
    Branch01=merge_2,
    Branch02=merge_3,
    Branch03=merge_4,
    Branch04=merge_5,
    Branch05=merge_6,
    Branch06=merge_7,
    Branch07=merge_8,
    Branch08=merge_9,
    Branch09=merge_10,
    Branch010=merge_11,
    Branch011=merge_12,
    FlattenInputs=True)
panel_109 = Panel(entwine)
excelwrite = ExcelWrite(WriteExcelData=False, WorksheetName="Sheet1", ColumnHeadings=panel_108, Data=entwine, ClearSheet=False)

# ----
# Residential points
point_30 = Point(Tree({0}: [Point(74.00661867, 21.87264322, 0)], {1}: [Point(47.30490932, 63.39716251, 0)], {2}: [Point(82.00635615, 28.00878913, 0)], {3}: [Point(47.94396143, 65.95178389, 0)], {4}: [Point(17.52669515, 25.94292827, 0)], {5}: [Point(21.9618074, 32.00988228, 0)]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))

# ----
# Facility points
point_31 = Point()

# ----
# Mininmal Spanning(km)
cluster_15 = Cluster_7(d1=point_30, d2=point_31)  # -> mininmal_spanning, crv_2; disabled
data_195 = Data()
panel_110 = Panel(data_195)
data_196 = Data()

# ----
# Facility capacity(TPD)
data_197 = Data()
panel_111 = Panel(data_197)

# ----
# Facility linkage
curve_16 = Curve()
param_viewer_43 = ParamViewer(curve_16)

# ----
# Linkage mileage(km)
data_198 = Data()
panel_112 = Panel(data_198)

# ----
# Total Cost(euro)
data_199 = Data()
panel_113 = Panel(data_199)

# ----
# GWP
data_200 = Data()
panel_114 = Panel(data_200)

# ----
# Total revenue (euro)
data_201 = Data()
panel_115 = Panel(data_201)

# ----
# Recovered organic waste (ton)
data_202 = Data()
panel_116 = Panel(data_202)

param_viewer_44 = ParamViewer(point_31)

# ----
# 4
param_viewer_45 = ParamViewer(point_30)

# ----
# Buffer
number_slider_13 = Slider(12, range=0..100)

# ----
# Buffer
number_slider_14 = Slider(1, range=0..10)

# ----
# V.DISTRIBUTION OF 200 RESIDENTIAL BLOCKS
crv_2 = Curve([<curve referenced from the Rhino model> x628])
pt_3 = Point(point)

cir_18 = Circle(Plane=pt_3, Radius=Slider(20, range=0..100))
offset = OffsetCurve(Curve=cir_18, Distance=number_slider_14, Plane=pt_3, Corners=1)

cir_19 = Circle(Plane=pt_3, Radius=number_slider_13)
offset_2 = OffsetCurve(Curve=cir_19, Distance=Slider(1, range=0..10), Plane=PlaneXY(0, 0, 0), Corners=1)

# ----
# 2.Target
merge_13 = Merge(Data1=area.Area, Data2=area_2.Area, Data3=area_3.Area)
merge_14 = Merge(Data1=merge_13, Data2=merge_13, Data3=merge_13)
ma = MassAddition(Input=merge_14)  # -> Result, PartialResults

# ----
# 1.Ratio of household distribution
division_2 = Division(A=merge_14, B=ma.Result)
multiplication_2 = Multiplication(A=division_2, B="100")
int = Integer(multiplication_2)
division_3 = Division(A=int, B="100")
ratio = Panel(division_3)

# ---- group: 10Million
multiplication_3 = Multiplication(A=ratio, B="10")

# ----
divide = DivideCurve(Curve=offset, Count=number_slider_4, Kinks=False)  # -> flatten(Points), Tangents, Parameters
divide_2 = DivideCurve(Curve=offset_2, Count=number_slider_5, Kinks=False)  # -> flatten(Points), Tangents, Parameters

# ----
# First Tier
# Second Tier
# Third Tier
neighborhood_cells = NeighborhoodCells(basic_cells=crv_2, points=pt_3, start_number=cbd, target_number=panel_2)  # -> flatten(cells), rest_cells, flatten(R)
neighborhood_cells_2 = NeighborhoodCells(basic_cells=neighborhood_cells.rest_cells, points=divide_2.Points, start_number=number_slider_8, target_number="3")  # -> flatten(cells), rest_cells, flatten(R)
neighborhood_cells_3 = NeighborhoodCells(basic_cells=neighborhood_cells_2.rest_cells, points=divide.Points, start_number=number_slider_7, target_number="2")  # -> flatten(cells), rest_cells, flatten(R)
panel_117 = Panel(neighborhood_cells_3.R)
panel_118 = Panel(neighborhood_cells_2.R)
panel_119 = Panel(neighborhood_cells.R)

random_reduce = RandomReduce(List=neighborhood_cells.cells, Reduction=1, Seed=1)  # -> flatten(List)

# ---- group: All of the Residential cells
# Centroid points of Residential Cells
merge_15 = Merge(Data1=random_reduce, Data2=neighborhood_cells_2.cells, Data3=neighborhood_cells_3.cells)  # -> graft(Result)
area_5 = Area(Geometry=merge_15)  # -> Area, simplify(Centroid)

# ---- group: Duplicate points list into Tree
# Duplicating Facility list into a tree which
# contains 200 branch (same number with cells)
flatten = FlattenTree(Tree=area_5.Centroid, Path="{0}")
lng_3 = ListLength(List=flatten)
dup = DuplicateData(Data="0", Number=lng_3, Order=True)
branch = TreeBranch(Tree=pt, Path=dup, MaintainPaths=False)
viewer_2 = ParamViewer(branch)
panel_120 = Panel(branch)

# ---- group: Nearest facility
# Distance from Cell to facility>Sorting>Smallest number
# (nearest facility in a list)>Index of nearest facility for each cell
dist = Distance(PointA=area_5.Centroid, PointB=pt)  # -> simplify(Distance)
panel_121 = Panel(dist)
cset = CreateSet(List=dist)  # -> Set, Map
sort = SortList(Keys=dist)  # -> Keys, ValuesA
panel_122 = Panel(sort.Keys)
dom_2 = ConstructDomain(DomainStart=0, DomainEnd=0.5)
subset = SubList(List=sort.Keys, Domain=dom_2, Wrap=True)  # -> simplify(List), Index
panel_123 = Panel(subset.List)
mindex = MemberIndex(Set=cset.Set, Member=subset.List)  # -> simplify(Index), Count
panel_124 = Panel(mindex.Index)

# ----
boundary_14 = BoundarySurfaces(Edges=random_reduce)
boundary_15 = BoundarySurfaces(Edges=neighborhood_cells_2.cells)
boundary_16 = BoundarySurfaces(Edges=neighborhood_cells_3.cells)

preview_16 = CustomPreview(Geometry=boundary_14, Material=ColourSwatch(SwatchColor=RGBA(255, 0, 0, 180)))
preview_17 = CustomPreview(Geometry=boundary_15, Material=ColourSwatch(SwatchColor=RGBA(255, 0, 0, 130)))
preview_18 = CustomPreview(Geometry=boundary_16, Material=ColourSwatch(SwatchColor=RGBA(255, 0, 0, 60)))

# ---- group: Facility points
item = ListItem(List=branch, Index=mindex.Index, Wrap=True)

# ---- group: Cells points
pt_4 = Point(area_5.Centroid)

# ---- group: Connections
ln = Line(StartPoint=pt_4, EndPoint=item)

# ---- group: Cull duplicate
flatten_2 = FlattenTree(Tree=item, Path="{0}")
cullpt = CullDuplicates(Points=flatten_2, Tolerance=0.1, CullMode=1)  # -> Points, Indices, Valence

# ---- group: Mileage
len = Length(Curve=ln)  # -> flatten(Length)
ma_2 = MassAddition(Input=len)  # -> Result, PartialResults

# ----
# Facility location
data_203 = Data(cullpt.Points)

# ----
# Linkage
data_204 = Data(ln)

# ---- group: Points
data_205 = Data(data_203)

# ---- group: llinkage
data_206 = Data(data_204)

# ---- group: Facility Location
# 1095-2920RMB/m2 for 1 year
# Source:Study on the Rational Determination of the Standard of Industrial Land Prices
# 
# 成都 １ ∶ ０ ．５３ ∶ ０ ．２０
point_32 = Point(data_203)

# ----
# industrial land price
# one year(euro/m2)
line_2 = LineSDL(Start=point_32, Direction=Vector(0, 0, 1), Length=200)
scx = SurfaceCurve(Surface=srf, Curve=line_2)  # -> Curves, Points, UVPoints, Normals, Parameters, Tangents
pdecon_3 = Deconstruct(Point=flatten(scx.Points))  # -> XComponent, YComponent, ZComponent
dom_3 = ConstructDomain(DomainStart=panel_76, DomainEnd=panel_77)
dom_4 = ConstructDomain(DomainStart=panel_79, DomainEnd=panel_78)
remap_4 = RemapNumbers(Value=pdecon_3.ZComponent, Source=dom_3, Target=dom_4)  # -> Mapped, Clipped

# ----
# VI.Distribution of Facilities
viewer_3 = ParamViewer(area_5.Centroid)
precesion = Precesion(A=ma_2.Result)
multiplication_4 = Multiplication(A=cullpt.Valence, B=60)
viewer_4 = ParamViewer(data_203)
number_slider_15 = Slider(0.5, range=0.1..0.9)
subtraction = Subtraction(A=1, B=number_slider_15)

# ----
# Transportation Distances
data_207 = Data(precesion)

# ----
# Facility Capacity
data_208 = Data(multiplication_4)

# ---- group: Capacity
data_209 = Data(data_208)

# ----
sqrt_13 = SquareRoot(Value=data_209)
cir_20 = Circle(Plane=data_205, Radius=expr("x/40", sqrt_13))
boundary_17 = BoundarySurfaces(Edges=cir_20)
preview_19 = CustomPreview(Geometry=boundary_17, Material=point_color_3)
previewlw_25 = CustomPreviewLineweights(Geometry=data_206, Shader=data_17, Thickness=data_16, Absolute=False)

# ---- group: Material revenue
# 3. Calculation of Material Revenue per Year
cluster_16 = Cluster_6(facility_capacity=data_208, days=days)  # -> paper_revenue, glass_revenue, ferrous_revenue, alum_revenue, plastic_revenue, recovered_organic_waste

# ---- group: Total revenue(euro)
merge_16 = Merge(
    Data1=cluster_16.paper_revenue,
    Data2=cluster_16.glass_revenue,
    Data3=cluster_16.ferrous_revenue,
    Data4=cluster_16.alum_revenue,
    Data5=cluster_16.plastic_revenue)
ma_3 = MassAddition(Input=merge_16)  # -> Result, PartialResults
panel_125 = Panel(ma_3.Result)

# ----
# VIII.Evaluation
coefficients = Coefficients(
    land_price_for_each_facility=remap_4.Mapped,
    transportation_distance=data_207,
    facility_capacity=data_208,
    function_days_per_year=days,
    life_time=life_time)  # -> indoor_floor_area, cost_of_construction_per_year, required_land_area, cost_of_land_lease_per_year, consumption_of_diesel_per_year, cost_of_diesel_per_year, consumption_of_electricity_per_year, cost_of_electricity_per_year, cost_of_equipment_per_year
ma_4 = MassAddition(Input=coefficients.indoor_floor_area)  # -> Result, PartialResults
ma_5 = MassAddition(Input=coefficients.required_land_area)  # -> Result, PartialResults

# ---- group: Diesel
# Emission Factor :
# 
# Diesel fuel
# CO2: (10.21kg/gallon) (2.6975kg/L)
# CH4: (0.57g/gallon)(0.1506g/L)
# N2O: (0.26g/gallon)(0.0687g/L)
# Emission Factor :
# 
# Electricity
# CO2: (1,232.35lb/MWh) (0.55899396kg/KWh)
# CH4: (0.02414lb/MWh)(0.000010949904kg/KWh)
# N2O: (0.01826lb/MWh)(0.000008282736kg/KWh)
number_slider_16 = Slider(1, range=0..1)
# 2. Calculation of Airborne Emissions per Year
# Total Airborne Emission per Year
cluster_17 = Cluster(consumption_of_diesel_per_year=coefficients.consumption_of_diesel_per_year, year=number_slider_16)  # -> co2_emission_ton, ch4_emission_ton, n2o_emission_ton

# ---- group: Electricity
cluster_18 = Cluster_2(consumption_of_electricity_per_year=coefficients.consumption_of_electricity_per_year, year=number_slider_16)  # -> co2_emission_ton, ch4_emission_ton, n2o_emission_ton

# ---- group: Total CO2(ton)
merge_17 = Merge(Data1=flatten(cluster_17.co2_emission_ton), Data2=flatten(cluster_18.co2_emission_ton))
ma_6 = MassAddition(Input=merge_17)  # -> Result, PartialResults

# ---- group: Total CH4(ton)
merge_18 = Merge(Data1=flatten(cluster_17.ch4_emission_ton), Data2=flatten(cluster_18.ch4_emission_ton))
ma_7 = MassAddition(Input=merge_18)  # -> Result, PartialResults

# ---- group: Total N2O(ton)
merge_19 = Merge(Data1=flatten(cluster_17.n2o_emission_ton), Data2=flatten(cluster_18.n2o_emission_ton))
ma_8 = MassAddition(Input=merge_19)  # -> Result, PartialResults

# ----
# Material Composition of Generated MSW
# 
# Paper 28%
# Glass 5%
# Ferrous 7%
# Aluminium 1%
# Plastic 13%
# Food waste 14%
# Yard trimming 13%
# other 19%
# Efficiency of highly automated sorting system %
# 
# Paper 50-75
# Glass 80-90
# Ferrous 90-95
# Aluminium 90-95
# Plastic 75-90
# organic 80-90
# Material revenue (euro/Mg)
# 
# Paper 70
# Glass 23
# Ferrous 120
# Aluminium 1250
# Plastic 330
# organic: depends on biodegestion
panel_126 = Panel(cluster_16.recovered_organic_waste)

# ---- group: CH4
expression = Expression(x=ma_7.Result, Expression="25*x")

# ---- group: N2O
expression_2 = Expression(x=ma_8.Result, Expression="298*x")

# ---- group: CO2
expression_3 = Expression(x=ma_6.Result, Expression="1*x")

# ----
# Global Warming Potentials (GWPs)
# 100-year GWP :
# 
# CO2: 1
# CH4: 25
# N2O: 298
ma_9 = MassAddition(Input=[expression_3, expression, expression_2])  # -> Result, PartialResults
panel_127 = Panel(ma_9.Result)

# ---- group: refer to landprice
data_210 = Data(coefficients.cost_of_land_lease_per_year)

# ----
populations = Panel(multiplication_3)

# ---- group: Residential district(0.05Million)
division_4 = Division(A=populations, B="0.05")

# ----
number_of_needed_districts = Panel(division_4)

ma_10 = MassAddition(Input=data_208)  # -> Result, PartialResults
panel_128 = Panel(ma_10.Result)
panel_129 = Panel(data_207)
panel_130 = Panel(data_208)
merge_20 = Merge(
    Data1=flatten(coefficients.cost_of_construction_per_year),
    Data2=flatten(coefficients.cost_of_land_lease_per_year),
    Data3=flatten(coefficients.cost_of_diesel_per_year),
    Data4=flatten(coefficients.cost_of_electricity_per_year),
    Data5=flatten(coefficients.cost_of_equipment_per_year))
multiplication_5 = Multiplication(A=coefficients.cost_of_diesel_per_year, B=6.5)
multiplication_6 = Multiplication(A=data_210, B=number_slider_15)

# ----
# Total Cost per Year
ma_11 = MassAddition(Input=merge_20)  # -> Result, PartialResults
panel_131 = Panel(ma_11.Result)

# ---- group: refer to distance
data_211 = Data(multiplication_5)

# ----
multiplication_7 = Multiplication(A=data_211, B=subtraction)
addition = Addition(A=multiplication_6, B=multiplication_7)

# ----
# Lloyd's algorithm
voronoi = Voronoi(Points=hs.Feedback, Boundary=crv, BruteForceOverride=False)
area_6 = Area(Geometry=voronoi)  # -> Area, Centroid
# 3.Voronoi Relaxation
hs = HoopSnake(
    StartingData=cull,
    Data=area_6.Centroid,
    Hoopsnake_Data_autoUpdate=False,
    Hoopsnake_Data_dataLimit=2147483647,
    Hoopsnake_Data_delay=0,
    Hoopsnake_Data_resetCounter=False,
    Hoopsnake_Data_updateView=True)  # -> Feedback, CumulativeFeedback, LoopsCounter, flatten(IterationsCounter)
panel_132 = Panel(hs.IterationsCounter)

# ==== cluster NeighborhoodCells
basic_cells = ClusterInput()
points = ClusterInput()
start_number = ClusterInput()
target_number = ClusterInput()
area = Area(Geometry=basic_cells)  # -> Area, Centroid
graft = GraftTree(Tree=points, IncludeEmptyLists=True, IncludeNullItems=True)
addition = Addition(A=start_number, B=target_number)
dom = ConstructDomain(DomainStart=start_number, DomainEnd=expr("x-1", addition))
dist = Distance(PointA=area.Centroid, PointB=graft)  # -> simplify(Distance)
sort = SortList(Keys=dist)  # -> Keys, ValuesA
subset = SubList(List=sort.Keys, Domain=dom, Wrap=True)  # -> simplify(List), Index
lng = ListLength(List=points)
index = ItemIndex(List=basic_cells, Item=basic_cells)
mindex = MemberIndex(Set=dist, Member=subset.List)  # -> Index, Count
lng_2 = ListLength(List=subset.List)
difference = SetDifference(SetA=flatten(index), SetB=flatten(mindex.Index))
item = ListItem(List=basic_cells, Index=mindex.Index, Wrap=True)
multiplication = Multiplication(A=lng_2, B=lng)
item_2 = ListItem(List=basic_cells, Index=difference, Wrap=True)
panel = Panel(multiplication)
R = ClusterOutput(multiplication)
cells = ClusterOutput(item)
rest_cells = ClusterOutput(item_2)
sort_2 = SortList(Keys=flatten(mindex.Index))  # -> Keys, ValuesA
panel_2 = Panel(sort_2.Keys)
cset = CreateSet(List=panel_2)  # -> Set, Map
panel_3 = Panel(cset.Set)

# ==== cluster Coefficients
land_price_for_each_facility = ClusterInput()  # euro/m2 per year
transportation_distance = ClusterInput()
facility_capacity = ClusterInput()
function_days_per_year = ClusterInput()
life_time = ClusterInput()

# ---- group: Indoor Floor Area(m2)
expression = Expression(x=facility_capacity, Expression="15.39*x+800")

# ---- group: Electricity Consumption（kwh)
expression_2 = Expression(x=expression, Expression="1.607*0.04*x+0.706*(1-0.04)*x")

# ---- group: Construction Cost 600Euro/m2
expression_3 = Expression(A=expression, Expression="612*A")

# ---- group: Transportation Diesel Consumption（L）
expression_4 = Expression(D=transportation_distance, Expression="D*60*0.0272")

# ---- group: Processing Diesel Consumption(L)
expression_5 = Expression(x=facility_capacity, Expression="0.7*x+4.8")

# ---- group: Equipment Cost(Euro/Mg)
expression_6 = Expression(x=facility_capacity, Expression="2.69*x+200")

# ----
# Diesel Consumption (L)
merge = Merge(Data1=flatten(expression_4), Data2=flatten(expression_5))
mass_addition = MassAddition(Input=flatten(merge))  # -> Result, PartialResults
# Cost of Diesel per Year (euro)
multiplication = Multiplication(A=mass_addition.Result, B=function_days_per_year)

# ----
# Electricity Consumption per Year (L)
mass_addition_2 = MassAddition(Input=flatten(expression_2))  # -> Result, PartialResults
# Cost of Electricity per Year (euro)
multiplication_2 = Multiplication(A=mass_addition_2.Result, B=function_days_per_year)

# ----
# Equipment Cost per Year (euro)
mass_addition_3 = MassAddition(Input=flatten(expression_6))  # -> Result, PartialResults
multiplication_3 = Multiplication(A=mass_addition_3.Result, B=function_days_per_year)

# ----
# Construction Cost per Year (euro)
mass_addition_4 = MassAddition(Input=flatten(expression_3))  # -> Result, PartialResults
division = Division(A=mass_addition_4.Result, B=life_time)

# ---- group: Diesel Cost(euro/L)
E = Expression(D=multiplication, Expression="0.842*D")

# ---- group: Electricity Cost(euro/kwh)
E_2 = Expression(E=multiplication_2, Expression="0.0868*E")

# ---- group: Requied Land Area(m2)
expression_7 = Expression(I=expression, Expression="3*I")

# ----
# Land Cost per Year (euro)
multiplication_4 = Multiplication(LandPrice=land_price_for_each_facility, LandArea=expression_7)
# Indoor Floor Area & Site Area
mass_addition_5 = MassAddition(Input=multiplication_4)  # -> Result, PartialResults

consumption_of_electricity_per_year = ClusterOutput(multiplication_2)  # (kwh)
consumption_of_diesel_per_year = ClusterOutput(multiplication)  # (L)
cost_of_construction_per_year = ClusterOutput(division)  # Total Cost/Life time
# Equipment Cost = 2.69*SUM(capacity)+200*N
# N
cost_of_equipment_per_year = ClusterOutput(multiplication_3)  # Includes purchasing, O&M; equation represents how much will be cost when processing one Mg.
cost_of_land_lease_per_year = ClusterOutput(mass_addition_5.Result)  # (euro)
# N
# 1.607*0.04*x+0.706*(1-0.04)*x=(1.607*0.04+0.706*0.96)*Indoor Floor Area
cost_of_electricity_per_year = ClusterOutput(E_2)  # (euro)
# Location&Linkages
cost_of_diesel_per_year = ClusterOutput(E)  # (euro)
# Cost of Construction= 612* Indoor Floor Area=(15.39*SUM x+800*N)*612
# N
# Required Land Area=(15.39*SUM x+800*N)*3
# Location
# Land price various based on the location
required_land_area = ClusterOutput(expression_7)  # (m2)
# N
# indoor Floor Area=(15.39*x1+800)+(15.39*x2+800)+......(15.39*xn+800)
# =15.39*(x1+x2+x3+...Xn)+800*N
# =15.39*SUM x+800*N
# N
indoor_floor_area = ClusterOutput(expression)

# ==== cluster Cluster
# Emission Factor :
# 
# Diesel fuel
# CO2: (10.21kg/gallon) (2.6975kg/L)
# CH4: (0.57g/gallon)(0.1506g/L)
# N2O: (0.26g/gallon)(0.0687g/L)
consumption_of_diesel_per_year = ClusterInput()
year = ClusterInput()
expression = Expression(x=consumption_of_diesel_per_year, y=year, Expression="0.1506*x*y*0.001*0.001")
expression_2 = Expression(x=consumption_of_diesel_per_year, y=year, Expression="0.0687*x*y*0.001*0.001")
expression_3 = Expression(x=consumption_of_diesel_per_year, y=year, Expression="2.6975*x*y*0.001")
co2_emission_ton = ClusterOutput(expression_3)
ch4_emission_ton = ClusterOutput(expression)
n2o_emission_ton = ClusterOutput(expression_2)

# ==== cluster Cluster_2
# Emission Factor :
# 
# Electricity
# CO2: (1,232.35lb/MWh) (0.55899396kg/KWh)
# CH4: (0.02414lb/MWh)(0.000010949904kg/KWh)
# N2O: (0.01826lb/MWh)(0.000008282736kg/KWh)
consumption_of_electricity_per_year = ClusterInput()
year = ClusterInput()
expression = Expression(x=consumption_of_electricity_per_year, y=year, Expression="0.000008282736*x*y*0.001")
expression_2 = Expression(x=consumption_of_electricity_per_year, y=year, Expression="0.000010949904*x*y*0.001")
expression_3 = Expression(x=consumption_of_electricity_per_year, y=year, Expression="0.55899396*x*y*0.001")
ch4_emission_ton = ClusterOutput(expression_2)
co2_emission_ton = ClusterOutput(expression_3)
n2o_emission_ton = ClusterOutput(expression)

# ==== cluster Cluster_6
facility_capacity = ClusterInput()
days = ClusterInput()  # operating days per year

# ---- group: Efficiency
cluster = Cluster_4(facility_capacity=facility_capacity)  # -> e_paper, e_glass, e_ferrous, e_aluminium, e_plastic, e_organic

# ---- group: Generated Waste per Year
cluster_2 = Cluster_5(facility_capacity=facility_capacity, days=days)  # -> paper_ton, glass_ton, ferrous_ton, alum_ton, plastic_ton, organic_ton

# ---- group: Recoveryed material
multiplication = Multiplication(A=cluster_2.paper_ton, B=cluster.e_paper)
multiplication_2 = Multiplication(A=cluster_2.glass_ton, B=cluster.e_glass)
multiplication_3 = Multiplication(A=cluster_2.ferrous_ton, B=cluster.e_ferrous)
multiplication_4 = Multiplication(A=cluster_2.alum_ton, B=cluster.e_aluminium)
multiplication_5 = Multiplication(A=cluster_2.plastic_ton, B=cluster.e_plastic)
multiplication_6 = Multiplication(A=cluster_2.organic_ton, B=cluster.e_organic)

# ----
expression = Expression(x=multiplication_4, Expression="x*1250")
expression_2 = Expression(x=multiplication_5, Expression="x*330")
expression_3 = Expression(x=multiplication_3, Expression="x*120")
expression_4 = Expression(x=multiplication, Expression="x*70")
expression_5 = Expression(x=multiplication_2, Expression="x*23")

ma = MassAddition(Input=multiplication_6)  # -> Result, PartialResults
ma_2 = MassAddition(Input=expression)  # -> Result, PartialResults
ma_3 = MassAddition(Input=expression_3)  # -> Result, PartialResults
ma_4 = MassAddition(Input=expression_5)  # -> Result, PartialResults
ma_5 = MassAddition(Input=expression_4)  # -> Result, PartialResults
ma_6 = MassAddition(Input=expression_2)  # -> Result, PartialResults
recovered_organic_waste = ClusterOutput(ma.Result)
paper_revenue = ClusterOutput(ma_5.Result)
glass_revenue = ClusterOutput(ma_4.Result)
alum_revenue = ClusterOutput(ma_2.Result)
ferrous_revenue = ClusterOutput(ma_3.Result)
plastic_revenue = ClusterOutput(ma_6.Result)

# ==== cluster Precesion
A = ClusterInput()
multiplication = Multiplication(A=A, B="1000")
integer = Integer(multiplication)
division = Division(A=integer, B="1000")
result = ClusterOutput(division)

# ==== cluster Cluster_7
d1 = ClusterInput()
d2 = ClusterInput()
merge = Merge(Data1=flatten(d1), Data2=flatten(d2))
graphfrompoints = GraphFromPoints(GraphPoints=merge, ConnectingDistance=Slider(50, range=0..100), undirected=True)
minst = MinST(Graph=graphfrompoints)
display_graph = DisplayGraph(Graph=minst, GraphPoints=merge, Value="-1", hidden=False)  # -> VertexCount, EdgeCount, Edge
length = Length(Curve=display_graph.Edge)
mass_addition = MassAddition(Input=length)  # -> Result, PartialResults
division = Division(A=mass_addition.Result, B=2)
crv = Curve(display_graph.Edge)
panel = Panel(division)
mininmal_spanning = ClusterOutput(division)
crv_2 = ClusterOutput(crv)

# ==== cluster Cluster_4
facility_capacity = ClusterInput()

# ---- group: E-Paper
cluster = Cluster_3(facility_capacity=facility_capacity, lowest_number="0.50", largest_number="0.75")

# ---- group: E-Glass
cluster_2 = Cluster_3(facility_capacity=facility_capacity, lowest_number="0.80", largest_number="0.90")

# ---- group: E-Aluminium
cluster_3 = Cluster_3(facility_capacity=facility_capacity, lowest_number="0.90", largest_number="0.95")

# ---- group: E-Ferrous
cluster_4 = Cluster_3(facility_capacity=facility_capacity, lowest_number="0.90", largest_number="0.95")

# ---- group: E-Plastic
cluster_5 = Cluster_3(facility_capacity=facility_capacity, lowest_number="0.75", largest_number="0.90")

# ---- group: E-Organic
cluster_6 = Cluster_3(facility_capacity=facility_capacity, lowest_number="0.80", largest_number="0.90")

# ----
e_ferrous = ClusterOutput(cluster_4)
e_aluminium = ClusterOutput(cluster_3)
e_organic = ClusterOutput(cluster_6)
e_plastic = ClusterOutput(cluster_5)
e_paper = ClusterOutput(cluster)
e_glass = ClusterOutput(cluster_2)

# ==== cluster Cluster_5
days = ClusterInput()
facility_capacity = ClusterInput()  # how much waste will be dealt each day
multiplication = Multiplication(TPD=facility_capacity, OperatingDays=days)

# ---- group: Paper(ton)
expression = Expression(x=multiplication, Expression="0.28*x")

# ---- group: Glass(ton)
expression_2 = Expression(x=multiplication, Expression="0.05*x")

# ---- group: Ferrous(ton)
expression_3 = Expression(x=multiplication, Expression="0.07*x")

# ---- group: Alum(ton)
expression_4 = Expression(x=multiplication, Expression="0.01*x")

# ---- group: Plastic(ton)
expression_5 = Expression(x=multiplication, Expression="0.13*x")

# ---- group: Organic(ton)
expression_6 = Expression(x=multiplication, Expression="0.46*x")

# ----
organic_ton = ClusterOutput(expression_6)
ferrous_ton = ClusterOutput(expression_3)
plastic_ton = ClusterOutput(expression_5)
paper_ton = ClusterOutput(expression)
glass_ton = ClusterOutput(expression_2)
alum_ton = ClusterOutput(expression_4)

# ==== cluster Cluster_3
facility_capacity = ClusterInput()
lowest_number = ClusterInput()
largest_number = ClusterInput()
dom = ConstructDomain(DomainStart=lowest_number, DomainEnd=largest_number)
remap = RemapNumbers(Value=facility_capacity, Source=Domain(100, 12000), Target=dom)  # -> Mapped, Clipped
efficiency_for_each_facility = ClusterOutput(remap.Mapped)
